# Dynamo graph Aba Componentes (Cobertura).dyn (Dynamo 3.3.0.6316)

# group: Componentes - Cobertura > Caminho da planilha
# Descrição <Clique duas vezes aqui para editar a descrição do grupo>
file_path = Filename("..\estudo de caso\INI_C-input_interface.xlsx")

# group: Componentes - Cobertura > Recebe a cobertura
# Descrição <Clique duas vezes aqui para editar a descrição do grupo>
categories = Categories("OST_Roofs")
all_elements_of_category = ElementsOfCategory(Category=categories)

# group: Componentes - Cobertura
# Descrição <Clique duas vezes aqui para editar a descrição do grupo>
extração_dos_dados_da_cobertura = CodeBlock(a=all_elements_of_category)
# ---------- extração_dos_dados_da_cobertura.designscript (23 lines) ----------
Cobertura = a.ElementType;
a1 = a.GetParameterValueByName("Área");
areas = List.RemoveIfNot(a1,"double");
// Transmitância Térmica (U)
b1 = Cobertura.GetParameterValueByName("Coeficiente de transferência de calor (U)");
b2 = List.RemoveIfNot(b1,"double");
b3 = areas*b2;
b = Math.Sum(b3)/Math.Sum(areas);
// Capacidade Térmica (CT)
c1 = Cobertura.GetParameterValueByName("Massa térmica");
c2 = List.RemoveIfNot(c1,"double");
c3 = areas*c2;
c = Math.Sum(c3)/Math.Sum(areas);
// Absortância
d1 = Cobertura.GetParameterValueByName("Absorção");
d2 = List.RemoveIfNot(d1,"double");
d3 = areas*d2;
d = Math.Sum(d3)/Math.Sum(areas);
"Componentes";
11;
10;
resultados = ["Cobertura",b,c,d];
false;
# ----------------------------------------

# group: Componentes - Cobertura > Exporta dados para planilha
# Descrição <Clique duas vezes aqui para editar a descrição do grupo>
exportToExcel = Data.ExportToExcel(filePath=file_path, sheetName=extração_dos_dados_da_cobertura.out15, startRow=extração_dos_dados_da_cobertura.out16, startColumn=extração_dos_dados_da_cobertura.out17, data=extração_dos_dados_da_cobertura.resultados@L3, overWrite=extração_dos_dados_da_cobertura.out19)
