# Dynamo graph Aba Componentes (Condicionamento de ar).dyn (Dynamo 3.3.0.6316)

# group: Recebe Equipamentos mecânicos
# Descrição <Clique duas vezes aqui para editar a descrição do grupo>
categories = Categories("OST_MechanicalEquipment")
all_elements_of_category = ElementsOfCategory(Category=categories)

code_block = CodeBlock { "Família"; "Condicionador"; }

# group: Filtra os condicionadores de ar
# Descrição <Clique duas vezes aqui para editar a descrição do grupo>
getParameterValueByName = Element.GetParameterValueByName(element=all_elements_of_category, parameterName=code_block.out0)
string_from_object = FromObject(object=getParameterValueByName)
contains = String.Contains(string=string_from_object, searchFor=code_block.out1)
filterByBoolMask = List.FilterByBoolMask(list=all_elements_of_category, mask=contains)

# group: Busca parâmetros
# Descrição <Clique duas vezes aqui para editar a descrição do grupo>
code_block_2 = CodeBlock(a=filterByBoolMask.in) { listacompleta = a.GetParameterValueByName("Família"); listacompacta = List.UniqueItems(listacompleta); }
contains_2 = List.Contains(list=getParameterValueByName@L1, item=code_block_2.listacompacta, lacing=CrossProduct)
transpose = List.Transpose(lists=contains_2)
countTrue = List.CountTrue(list=transpose@L2)
code_block_3 = CodeBlock(condicionadores=filterByBoolMask.in)
# ---------- code_block_3.designscript (4 lines) ----------
a = condicionadores.ElementType;
b = List.UniqueItems(a.GetParameterValueByName("Capacidade de refrigeração"))/1000;
c = List.UniqueItems(a.GetParameterValueByName("IDRS"));
d = List.UniqueItems(a.GetParameterValueByName("Tipo de equipamento"));
# ----------------------------------------

# group: Organização dos resultados
# Descrição <Clique duas vezes aqui para editar a descrição do grupo>
file_path = Filename("..\..\estudo de caso\INI_C-input_interface.xlsx")
code_block_4 = CodeBlock(lista=countTrue)
# ---------- code_block_4.designscript (4 lines) ----------
amount = List.Count(lista);
List.OfRepeatedItem("Sistema unitário",amount);
List.OfRepeatedItem("IDRS",amount);
List.OfRepeatedItem(0,amount);
# ----------------------------------------
code_block_5 = CodeBlock(nome=code_block_2.listacompacta, quantidade=countTrue, sistema=code_block_4.out1, capresf=code_block_3.b) { "Componentes"; 10; 33; resultado1 = List.Transpose([nome,quantidade,sistema,capresf]); }
code_block_6 = CodeBlock(tipoiee=code_block_4.out2, idrs=code_block_3.c, a=code_block_4.out3) { "Componentes"; 10; 38; resultado1 = List.Transpose([tipoiee,idrs,a]); }

# group: Exporta dados
# Descrição <Clique duas vezes aqui para editar a descrição do grupo>
exportToExcel = Data.ExportToExcel(filePath=file_path, sheetName=code_block_5.out0, startRow=code_block_5.out1, startColumn=code_block_5.out2, data=code_block_5.resultado1)
exportToExcel_2 = Data.ExportToExcel(filePath=file_path, sheetName=code_block_6.out0, startRow=code_block_6.out1, startColumn=code_block_6.out2, data=code_block_6.resultado1)
