# Dynamo graph Aba Condicionamento de Ar.dyn (Dynamo 3.3.0.6316)

# group: Recebe áreas definidas
# Descrição <Clique duas vezes aqui para editar a descrição do grupo>
categories = Categories("OST_Areas")
all_elements_of_category = ElementsOfCategory(Category=categories)

# group: Filtra as zonas térmicas
# Descrição <Clique duas vezes aqui para editar a descrição do grupo>
code_block = CodeBlock(zonas=all_elements_of_category) { a = zonas.GetParameterValueByName("Nome"); String.Contains(a,"Z"); }
filterByBoolMask = List.FilterByBoolMask(list=code_block.a, mask=code_block.out1)

# group: Coleta nome e organiza dados
# Descrição <Clique duas vezes aqui para editar a descrição do grupo>
file_path = Filename("C:\Users\rafae\Desktop\BIM\estudo de caso\INI_C-input_interface.xlsx")
code_block_2 = CodeBlock(nomedaszonas=filterByBoolMask.in)
# ---------- code_block_2.designscript (6 lines) ----------
n = List.Count(nomedaszonas);
s = List.OfRepeatedItem("Sistemas unitários",n);
"CondicionamentoDeAr";
23;
1;
resultado = List.Transpose([nomedaszonas,s]);
# ----------------------------------------

# group: Exporta dados
# Descrição <Clique duas vezes aqui para editar a descrição do grupo>
exportToExcel = Data.ExportToExcel(filePath=file_path, sheetName=code_block_2.out2, startRow=code_block_2.out3, startColumn=code_block_2.out4, data=code_block_2.resultado)
