# Dynamo graph Aba Envoltória.dyn "5 - AbaEnvoltoria" (Dynamo 3.3.0.6316)

# group: Caminho da planilha
# Descrição <Clique duas vezes aqui para editar a descrição do grupo>
file_path = Filename("..\..\estudo de caso\INI_C-input_interface.xlsx")

# group: Recebe todas as paredes
# Descrição <Clique duas vezes aqui para editar a descrição do grupo>
categories = Categories("OST_Walls")
all_elements_of_category = ElementsOfCategory(Category=categories)
getLocation = Element.GetLocation(element=all_elements_of_category)

# group: Recebe todas as áreas
# Descrição <Clique duas vezes aqui para editar a descrição do grupo>
categories_2 = Categories("OST_Areas")
all_elements_of_category_2 = ElementsOfCategory(Category=categories_2)

# group: Identifica nível das áreas
# Descrição <Clique duas vezes aqui para editar a descrição do grupo>
code_block = CodeBlock(area=all_elements_of_category_2)
# ---------- code_block.designscript (4 lines) ----------
elementosareas = Parameter.ParameterByName(area,"Nome");
a = elementosareas.Value;
String.Contains(a,"N1");
String.Contains(a,"N2");
# ----------------------------------------

# group: Seleciona zonas nível 1
# Descrição <Clique duas vezes aqui para editar a descrição do grupo>
filterByBoolMask = List.FilterByBoolMask(list=all_elements_of_category_2, mask=code_block.out2)

# group: Identifica orientação das zonas
# Descrição <Clique duas vezes aqui para editar a descrição do grupo>
code_block_2 = CodeBlock(area=filterByBoolMask.in)
# ---------- code_block_2.designscript (11 lines) ----------
elementosareas = Parameter.ParameterByName(area,"Nome");
a = elementosareas.Value;
String.Contains(a,"- N");
String.Contains(a,"- L");
String.Contains(a,"- S");
String.Contains(a,"- O");
String.Contains(a,"- I");
String.Contains(a,"- NE");
String.Contains(a,"- NO");
String.Contains(a,"- SE");
String.Contains(a,"- SO");
# ----------------------------------------

# group: Zonas N - Nível 1 > Seleciona Zona N
# Descrição <Clique duas vezes aqui para editar a descrição do grupo>
filterByBoolMask_2 = List.FilterByBoolMask(list=filterByBoolMask.in, mask=code_block_2.out2)

# group: Zonas N - Nível 1 > Identifica numeração da zona
# Descrição <Clique duas vezes aqui para editar a descrição do grupo>
code_block_3 = CodeBlock(area=filterByBoolMask_2.in)
# ---------- code_block_3.designscript (6 lines) ----------
elementosareas = Parameter.ParameterByName(area,"Nome");
a = elementosareas.Value;
String.Contains(a,"Z1");
String.Contains(a,"Z2");
String.Contains(a,"Z3");
String.Contains(a,"Z4");
# ----------------------------------------

# group: Zonas N - Nível 1 > Seleciona Z1
# Descrição <Clique duas vezes aqui para editar a descrição do grupo>
filterByBoolMask_3 = List.FilterByBoolMask(list=filterByBoolMask_2.in, mask=code_block_3.out2)
code_block_4 = CodeBlock(a=filterByBoolMask_3.in) { b = a.Boundaries; List.Flatten(b); }
byJoinedCurves = PolyCurve.ByJoinedCurves(curves=code_block_4.out1)
byPatch = Surface.ByPatch(closedCurve=byJoinedCurves)

# group: Zonas N - Nível 1 > Identifica quais paredes estão dentro da Zona N
# Descrição <Clique duas vezes aqui para editar a descrição do grupo>
doesIntersect = Geometry.DoesIntersect(geometry=byPatch@L1, other=getLocation)
filterByBoolMask_4 = List.FilterByBoolMask(list=all_elements_of_category@L3, mask=doesIntersect)
code_block_5 = CodeBlock(a=filterByBoolMask_4.in) { b = List.Flatten(a); c = List.UniqueItems(b); List.Clean(c); }

# group: Zonas N - Nível 1 > Seleciona paredes externas e internas
# Descrição <Clique duas vezes aqui para editar a descrição do grupo>
identifica_parede_relacionada_e = CodeBlock(paredes=code_block_5.out2) { a = paredes.ElementType; b = a.GetParameterValueByName("Função"); b == 1; }  # "Identifica parede relacionada e se é externa"
filterByBoolMask_5 = List.FilterByBoolMask(list=code_block_5.out2, mask=identifica_parede_relacionada_e.out2)

# group: Zonas N - Nível 1 > Seleciona Z2
# Descrição <Clique duas vezes aqui para editar a descrição do grupo>
filterByBoolMask_6 = List.FilterByBoolMask(list=filterByBoolMask_2.in, mask=code_block_3.out3)
code_block_6 = CodeBlock(a=filterByBoolMask_6.in) { b = a.Boundaries; List.Flatten(b); }
byJoinedCurves_2 = PolyCurve.ByJoinedCurves(curves=code_block_6.out1)
byPatch_2 = Surface.ByPatch(closedCurve=byJoinedCurves_2)

# group: Zonas N - Nível 1 > Identifica quais paredes estão dentro da Zona N
# Descrição <Clique duas vezes aqui para editar a descrição do grupo>
doesIntersect_2 = Geometry.DoesIntersect(geometry=byPatch_2@L1, other=getLocation)
filterByBoolMask_7 = List.FilterByBoolMask(list=all_elements_of_category@L3, mask=doesIntersect_2)
code_block_7 = CodeBlock(a=filterByBoolMask_7.in) { b = List.Flatten(a); c = List.UniqueItems(b); List.Clean(c); }

# group: Zonas N - Nível 1 > Seleciona paredes externas e internas
# Descrição <Clique duas vezes aqui para editar a descrição do grupo>
identifica_parede_relacionada_e_2 = CodeBlock(paredes=code_block_7.out2) { a = paredes.ElementType; b = a.GetParameterValueByName("Função"); b == 1; }  # "Identifica parede relacionada e se é externa"
filterByBoolMask_8 = List.FilterByBoolMask(list=code_block_7.out2, mask=identifica_parede_relacionada_e_2.out2)

# group: Zonas N - Nível 1 > Seleciona Z3
# Descrição <Clique duas vezes aqui para editar a descrição do grupo>
filterByBoolMask_9 = List.FilterByBoolMask(list=filterByBoolMask_2.in, mask=code_block_3.out4)
code_block_8 = CodeBlock(a=filterByBoolMask_9.in) { b = a.Boundaries; List.Flatten(b); }
byJoinedCurves_3 = PolyCurve.ByJoinedCurves(curves=code_block_8.out1)
byPatch_3 = Surface.ByPatch(closedCurve=byJoinedCurves_3)

# group: Zonas N - Nível 1 > Identifica quais paredes estão dentro da Zona N
# Descrição <Clique duas vezes aqui para editar a descrição do grupo>
doesIntersect_3 = Geometry.DoesIntersect(geometry=byPatch_3@L1, other=getLocation)
filterByBoolMask_10 = List.FilterByBoolMask(list=all_elements_of_category@L3, mask=doesIntersect_3)
code_block_9 = CodeBlock(a=filterByBoolMask_10.in) { b = List.Flatten(a); c = List.UniqueItems(b); List.Clean(c); }

# group: Zonas N - Nível 1 > Seleciona paredes externas e internas
# Descrição <Clique duas vezes aqui para editar a descrição do grupo>
identifica_parede_relacionada_e_3 = CodeBlock(paredes=code_block_9.out2) { a = paredes.ElementType; b = a.GetParameterValueByName("Função"); b == 1; }  # "Identifica parede relacionada e se é externa"
filterByBoolMask_11 = List.FilterByBoolMask(list=code_block_9.out2, mask=identifica_parede_relacionada_e_3.out2)

# group: Zonas N - Nível 1 > Seleciona Z4
# Descrição <Clique duas vezes aqui para editar a descrição do grupo>
filterByBoolMask_12 = List.FilterByBoolMask(list=filterByBoolMask_2.in, mask=code_block_3.out5)
code_block_10 = CodeBlock(a=filterByBoolMask_12.in) { b = a.Boundaries; List.Flatten(b); }
byJoinedCurves_4 = PolyCurve.ByJoinedCurves(curves=code_block_10.out1)
byPatch_4 = Surface.ByPatch(closedCurve=byJoinedCurves_4)

# group: Zonas N - Nível 1 > Identifica quais paredes estão dentro da Zona N
# Descrição <Clique duas vezes aqui para editar a descrição do grupo>
doesIntersect_4 = Geometry.DoesIntersect(geometry=byPatch_4@L1, other=getLocation)
filterByBoolMask_13 = List.FilterByBoolMask(list=all_elements_of_category@L3, mask=doesIntersect_4)
code_block_11 = CodeBlock(a=filterByBoolMask_13.in) { b = List.Flatten(a); c = List.UniqueItems(b); List.Clean(c); }

# group: Zonas N - Nível 1 > Seleciona paredes externas e internas
# Descrição <Clique duas vezes aqui para editar a descrição do grupo>
identifica_parede_relacionada_e_4 = CodeBlock(paredes=code_block_11.out2) { a = paredes.ElementType; b = a.GetParameterValueByName("Função"); b == 1; }  # "Identifica parede relacionada e se é externa"
filterByBoolMask_14 = List.FilterByBoolMask(list=code_block_11.out2, mask=identifica_parede_relacionada_e_4.out2)

# group: Zonas N - Nível 1
# Descrição <Clique duas vezes aqui para editar a descrição do grupo>
paredes_externas = CodeBlock(ParedesExt=filterByBoolMask_5.in) { ParedesExternas = List.Flatten(ParedesExt); a = ParedesExternas.GetParameterValueByName("Área"); }
python_script = Python(IN[0]=paredes_externas.a)  # CPython3
# ---------- python_script.python (8 lines) ----------
# Entrada: lista com possíveis strings e números
input_list = IN[0]

# Substituir strings por 0.0
output_list = [0.0 if isinstance(x, str) else x for x in input_list]

# Saída: lista com strings substituídas por zero
OUT = output_list
# ----------------------------------------
dados_qualitativos_pe_direito_e = CodeBlock(a=python_script, Paredes=filterByBoolMask_5.in, zona=filterByBoolMask_3.in, superf=byPatch)  # "Dados qualitativos, pe direito e area"
# ---------- dados_qualitativos_pe_direito_e.designscript (13 lines) ----------
sa = Math.Sum(a);
b = Paredes.GetParameterValueByName("Altura desconectada");
pedireito = Math.Sum(a*b)/sa;
nome = zona.GetParameterValueByName("Nome");
areazona = Autodesk.Surface.Area(superf);
tipozona = "Perimetral";
orienta = "N";
// lista com resultados
"Envoltória";
18;
2;
resultados = List.Flatten([nome,areazona,pedireito,tipozona,orienta]);
false;
# ----------------------------------------
getHostedElements = Element.GetHostedElements(element=filterByBoolMask_5.in)
janelas_da_fachada = CodeBlock(janelasexternas=getHostedElements)
# ---------- janelas_da_fachada.designscript (7 lines) ----------
j1 = List.Flatten(janelasexternas);
janext = j1.ElementType;
// Area das janelas
largura = janext.GetParameterValueByName("Largura");
altura = janext.GetParameterValueByName("Altura");
areas = largura*altura;
Math.Sum(areas);
# ----------------------------------------
componentes_e_paf = CodeBlock(zona=filterByBoolMask_3.in, a=python_script, areaabertura=janelas_da_fachada.out5)
# ---------- componentes_e_paf.designscript (10 lines) ----------
nome = zona.GetParameterValueByName("Nome");
sa = Math.Sum(a);
PAF = areaabertura/(areaabertura + sa);
cob = "Pvto interm.";
// lista com resultados
"Envoltória";
18;
9;
resultados = List.Flatten([nome,nome,cob,nome,nome,PAF]);
false;
# ----------------------------------------
paredes_externas_2 = CodeBlock(ParedesExt=filterByBoolMask_8.in) { ParedesExternas = List.Flatten(ParedesExt); a = ParedesExternas.GetParameterValueByName("Área"); }
python_script_2 = Python(IN[0]=paredes_externas_2.a)  # CPython3; same code as python_script
getHostedElements_2 = Element.GetHostedElements(element=filterByBoolMask_8.in)
janelas_da_fachada_2 = CodeBlock(janelasexternas=getHostedElements_2)  # same code as janelas_da_fachada
componentes_e_paf_2 = CodeBlock(zona=filterByBoolMask_6.in, a=python_script_2, areaabertura=janelas_da_fachada_2.out5)
# ---------- componentes_e_paf_2.designscript (10 lines) ----------
nome = zona.GetParameterValueByName("Nome");
sa = Math.Sum(a);
PAF = areaabertura/(areaabertura + sa);
cob = "Pvto interm.";
// lista com resultados
"Envoltória";
19;
9;
resultados = List.Flatten([nome,nome,cob,nome,nome,PAF]);
false;
# ----------------------------------------
dados_qualitativos_pe_direito_e_2 = CodeBlock(a=python_script_2, Paredes=filterByBoolMask_8.in, zona=filterByBoolMask_6.in, superf=byPatch_2)  # "Dados qualitativos, pe direito e area"
# ---------- dados_qualitativos_pe_direito_e_2.designscript (13 lines) ----------
sa = Math.Sum(a);
b = Paredes.GetParameterValueByName("Altura desconectada");
pedireito = Math.Sum(a*b)/sa;
nome = zona.GetParameterValueByName("Nome");
areazona = Autodesk.Surface.Area(superf);
tipozona = "Perimetral";
orienta = "N";
// lista com resultados
"Envoltória";
19;
2;
resultados = List.Flatten([nome,areazona,pedireito,tipozona,orienta]);
false;
# ----------------------------------------
paredes_externas_3 = CodeBlock(ParedesExt=filterByBoolMask_11.in) { ParedesExternas = List.Flatten(ParedesExt); a = ParedesExternas.GetParameterValueByName("Área"); }
python_script_3 = Python(IN[0]=paredes_externas_3.a)  # CPython3; same code as python_script
dados_qualitativos_pe_direito_e_3 = CodeBlock(a=python_script_3, Paredes=filterByBoolMask_11.in, zona=filterByBoolMask_9.in, superf=byPatch_3)  # "Dados qualitativos, pe direito e area"
# ---------- dados_qualitativos_pe_direito_e_3.designscript (13 lines) ----------
sa = Math.Sum(a);
b = Paredes.GetParameterValueByName("Altura desconectada");
pedireito = Math.Sum(a*b)/sa;
nome = zona.GetParameterValueByName("Nome");
areazona = Autodesk.Surface.Area(superf);
tipozona = "Perimetral";
orienta = "N";
// lista com resultados
"Envoltória";
20;
2;
resultados = List.Flatten([nome,areazona,pedireito,tipozona,orienta]);
false;
# ----------------------------------------
getHostedElements_3 = Element.GetHostedElements(element=filterByBoolMask_11.in)
janelas_da_fachada_3 = CodeBlock(janelasexternas=getHostedElements_3)  # same code as janelas_da_fachada
componentes_e_paf_3 = CodeBlock(zona=filterByBoolMask_9.in, a=python_script_3, areaabertura=janelas_da_fachada_3.out5)
# ---------- componentes_e_paf_3.designscript (10 lines) ----------
nome = zona.GetParameterValueByName("Nome");
sa = Math.Sum(a);
PAF = areaabertura/(areaabertura + sa);
cob = "Pvto interm.";
// lista com resultados
"Envoltória";
20;
9;
resultados = List.Flatten([nome,nome,cob,nome,nome,PAF]);
false;
# ----------------------------------------
paredes_externas_4 = CodeBlock(ParedesExt=filterByBoolMask_14.in) { ParedesExternas = List.Flatten(ParedesExt); a = ParedesExternas.GetParameterValueByName("Área"); }
python_script_4 = Python(IN[0]=paredes_externas_4.a)  # CPython3; same code as python_script
dados_qualitativos_pe_direito_e_4 = CodeBlock(a=python_script_4, Paredes=filterByBoolMask_14.in, zona=filterByBoolMask_12.in, superf=byPatch_4)  # "Dados qualitativos, pe direito e area"
# ---------- dados_qualitativos_pe_direito_e_4.designscript (13 lines) ----------
sa = Math.Sum(a);
b = Paredes.GetParameterValueByName("Altura desconectada");
pedireito = Math.Sum(a*b)/sa;
nome = zona.GetParameterValueByName("Nome");
areazona = Autodesk.Surface.Area(superf);
tipozona = "Perimetral";
orienta = "N";
// lista com resultados
"Envoltória";
21;
2;
resultados = List.Flatten([nome,areazona,pedireito,tipozona,orienta]);
false;
# ----------------------------------------
getHostedElements_4 = Element.GetHostedElements(element=filterByBoolMask_14.in)
janelas_da_fachada_4 = CodeBlock(janelasexternas=getHostedElements_4)  # same code as janelas_da_fachada
componentes_e_paf_4 = CodeBlock(zona=filterByBoolMask_12.in, a=python_script_4, areaabertura=janelas_da_fachada_4.out5)
# ---------- componentes_e_paf_4.designscript (10 lines) ----------
nome = zona.GetParameterValueByName("Nome");
sa = Math.Sum(a);
PAF = areaabertura/(areaabertura + sa);
cob = "Pvto interm.";
// lista com resultados
"Envoltória";
21;
9;
resultados = List.Flatten([nome,nome,cob,nome,nome,PAF]);
false;
# ----------------------------------------

# group: Zonas N - Nível 1 > Exporta dados paredes para planilha
# Descrição <Clique duas vezes aqui para editar a descrição do grupo>
exportToExcel = Data.ExportToExcel(filePath=file_path, sheetName=dados_qualitativos_pe_direito_e.out7, startRow=dados_qualitativos_pe_direito_e.out8, startColumn=dados_qualitativos_pe_direito_e.out9, data=dados_qualitativos_pe_direito_e.resultados@L3)
exportToExcel_2 = Data.ExportToExcel(filePath=file_path, sheetName=componentes_e_paf.out4, startRow=componentes_e_paf.out5, startColumn=componentes_e_paf.out6, data=componentes_e_paf.resultados@L3)

# group: Zonas N - Nível 1 > Exporta dados paredes para planilha
# Descrição <Clique duas vezes aqui para editar a descrição do grupo>
exportToExcel_3 = Data.ExportToExcel(filePath=file_path, sheetName=componentes_e_paf_2.out4, startRow=componentes_e_paf_2.out5, startColumn=componentes_e_paf_2.out6, data=componentes_e_paf_2.resultados@L3)
exportToExcel_4 = Data.ExportToExcel(filePath=file_path, sheetName=dados_qualitativos_pe_direito_e_2.out7, startRow=dados_qualitativos_pe_direito_e_2.out8, startColumn=dados_qualitativos_pe_direito_e_2.out9, data=dados_qualitativos_pe_direito_e_2.resultados@L3)

# group: Zonas N - Nível 1 > Exporta dados paredes para planilha
# Descrição <Clique duas vezes aqui para editar a descrição do grupo>
exportToExcel_5 = Data.ExportToExcel(filePath=file_path, sheetName=dados_qualitativos_pe_direito_e_3.out7, startRow=dados_qualitativos_pe_direito_e_3.out8, startColumn=dados_qualitativos_pe_direito_e_3.out9, data=dados_qualitativos_pe_direito_e_3.resultados@L3)
exportToExcel_6 = Data.ExportToExcel(filePath=file_path, sheetName=componentes_e_paf_3.out4, startRow=componentes_e_paf_3.out5, startColumn=componentes_e_paf_3.out6, data=componentes_e_paf_3.resultados@L3)

# group: Zonas N - Nível 1 > Exporta dados paredes para planilha
# Descrição <Clique duas vezes aqui para editar a descrição do grupo>
exportToExcel_7 = Data.ExportToExcel(filePath=file_path, sheetName=dados_qualitativos_pe_direito_e_4.out7, startRow=dados_qualitativos_pe_direito_e_4.out8, startColumn=dados_qualitativos_pe_direito_e_4.out9, data=dados_qualitativos_pe_direito_e_4.resultados@L3)
exportToExcel_8 = Data.ExportToExcel(filePath=file_path, sheetName=componentes_e_paf_4.out4, startRow=componentes_e_paf_4.out5, startColumn=componentes_e_paf_4.out6, data=componentes_e_paf_4.resultados@L3)

# group: Zonas L - Nível 1 > Seleciona Zona L
# Descrição <Clique duas vezes aqui para editar a descrição do grupo>
filterByBoolMask_15 = List.FilterByBoolMask(list=filterByBoolMask.in, mask=code_block_2.out3)

# group: Zonas L - Nível 1 > Identifica numeração da zona
# Descrição <Clique duas vezes aqui para editar a descrição do grupo>
code_block_12 = CodeBlock(area=filterByBoolMask_15.in)  # same code as code_block_3

# group: Zonas L - Nível 1 > Seleciona Z1
# Descrição <Clique duas vezes aqui para editar a descrição do grupo>
filterByBoolMask_16 = List.FilterByBoolMask(list=filterByBoolMask_15.in, mask=code_block_12.out2)
code_block_13 = CodeBlock(a=filterByBoolMask_16.in) { b = a.Boundaries; List.Flatten(b); }
byJoinedCurves_5 = PolyCurve.ByJoinedCurves(curves=code_block_13.out1)
byPatch_5 = Surface.ByPatch(closedCurve=byJoinedCurves_5)

# group: Zonas L - Nível 1 > Identifica quais paredes estão dentro da Zona N
# Descrição <Clique duas vezes aqui para editar a descrição do grupo>
doesIntersect_5 = Geometry.DoesIntersect(geometry=byPatch_5@L1, other=getLocation)
filterByBoolMask_17 = List.FilterByBoolMask(list=all_elements_of_category@L3, mask=doesIntersect_5)
code_block_14 = CodeBlock(a=filterByBoolMask_17.in) { b = List.Flatten(a); c = List.UniqueItems(b); List.Clean(c); }

# group: Zonas L - Nível 1 > Seleciona paredes externas e internas
# Descrição <Clique duas vezes aqui para editar a descrição do grupo>
identifica_parede_relacionada_e_5 = CodeBlock(paredes=code_block_14.out2) { a = paredes.ElementType; b = a.GetParameterValueByName("Função"); b == 1; }  # "Identifica parede relacionada e se é externa"
filterByBoolMask_18 = List.FilterByBoolMask(list=code_block_14.out2, mask=identifica_parede_relacionada_e_5.out2)

# group: Zonas L - Nível 1 > Seleciona Z2
# Descrição <Clique duas vezes aqui para editar a descrição do grupo>
filterByBoolMask_19 = List.FilterByBoolMask(list=filterByBoolMask_15.in, mask=code_block_12.out3)
code_block_15 = CodeBlock(a=filterByBoolMask_19.in) { b = a.Boundaries; List.Flatten(b); }
byJoinedCurves_6 = PolyCurve.ByJoinedCurves(curves=code_block_15.out1)
byPatch_6 = Surface.ByPatch(closedCurve=byJoinedCurves_6)

# group: Zonas L - Nível 1 > Identifica quais paredes estão dentro da Zona N
# Descrição <Clique duas vezes aqui para editar a descrição do grupo>
doesIntersect_6 = Geometry.DoesIntersect(geometry=byPatch_6@L1, other=getLocation)
filterByBoolMask_20 = List.FilterByBoolMask(list=all_elements_of_category@L3, mask=doesIntersect_6)
code_block_16 = CodeBlock(a=filterByBoolMask_20.in) { b = List.Flatten(a); c = List.UniqueItems(b); List.Clean(c); }

# group: Zonas L - Nível 1 > Seleciona paredes externas e internas
# Descrição <Clique duas vezes aqui para editar a descrição do grupo>
identifica_parede_relacionada_e_6 = CodeBlock(paredes=code_block_16.out2) { a = paredes.ElementType; b = a.GetParameterValueByName("Função"); b == 1; }  # "Identifica parede relacionada e se é externa"
filterByBoolMask_21 = List.FilterByBoolMask(list=code_block_16.out2, mask=identifica_parede_relacionada_e_6.out2)

# group: Zonas L - Nível 1 > Seleciona Z3
# Descrição <Clique duas vezes aqui para editar a descrição do grupo>
filterByBoolMask_22 = List.FilterByBoolMask(list=filterByBoolMask_15.in, mask=code_block_12.out4)
code_block_17 = CodeBlock(a=filterByBoolMask_22.in) { b = a.Boundaries; List.Flatten(b); }
byJoinedCurves_7 = PolyCurve.ByJoinedCurves(curves=code_block_17.out1)
byPatch_7 = Surface.ByPatch(closedCurve=byJoinedCurves_7)

# group: Zonas L - Nível 1 > Identifica quais paredes estão dentro da Zona N
# Descrição <Clique duas vezes aqui para editar a descrição do grupo>
doesIntersect_7 = Geometry.DoesIntersect(geometry=byPatch_7@L1, other=getLocation)
filterByBoolMask_23 = List.FilterByBoolMask(list=all_elements_of_category@L3, mask=doesIntersect_7)
code_block_18 = CodeBlock(a=filterByBoolMask_23.in) { b = List.Flatten(a); c = List.UniqueItems(b); List.Clean(c); }

# group: Zonas L - Nível 1 > Seleciona paredes externas e internas
# Descrição <Clique duas vezes aqui para editar a descrição do grupo>
identifica_parede_relacionada_e_7 = CodeBlock(paredes=code_block_18.out2) { a = paredes.ElementType; b = a.GetParameterValueByName("Função"); b == 1; }  # "Identifica parede relacionada e se é externa"
filterByBoolMask_24 = List.FilterByBoolMask(list=code_block_18.out2, mask=identifica_parede_relacionada_e_7.out2)

# group: Zonas L - Nível 1 > Seleciona Z4
# Descrição <Clique duas vezes aqui para editar a descrição do grupo>
filterByBoolMask_25 = List.FilterByBoolMask(list=filterByBoolMask_15.in, mask=code_block_12.out5)
code_block_19 = CodeBlock(a=filterByBoolMask_25.in) { b = a.Boundaries; List.Flatten(b); }
byJoinedCurves_8 = PolyCurve.ByJoinedCurves(curves=code_block_19.out1)
byPatch_8 = Surface.ByPatch(closedCurve=byJoinedCurves_8)

# group: Zonas L - Nível 1 > Identifica quais paredes estão dentro da Zona N
# Descrição <Clique duas vezes aqui para editar a descrição do grupo>
doesIntersect_8 = Geometry.DoesIntersect(geometry=byPatch_8@L1, other=getLocation)
filterByBoolMask_26 = List.FilterByBoolMask(list=all_elements_of_category@L3, mask=doesIntersect_8)
code_block_20 = CodeBlock(a=filterByBoolMask_26.in) { b = List.Flatten(a); c = List.UniqueItems(b); List.Clean(c); }

# group: Zonas L - Nível 1 > Seleciona paredes externas e internas
# Descrição <Clique duas vezes aqui para editar a descrição do grupo>
identifica_parede_relacionada_e_8 = CodeBlock(paredes=code_block_20.out2) { a = paredes.ElementType; b = a.GetParameterValueByName("Função"); b == 1; }  # "Identifica parede relacionada e se é externa"
filterByBoolMask_27 = List.FilterByBoolMask(list=code_block_20.out2, mask=identifica_parede_relacionada_e_8.out2)

# group: Zonas L - Nível 1
# Descrição <Clique duas vezes aqui para editar a descrição do grupo>
paredes_externas_5 = CodeBlock(ParedesExt=filterByBoolMask_18.in) { ParedesExternas = List.Flatten(ParedesExt); a = ParedesExternas.GetParameterValueByName("Área"); }
python_script_5 = Python(IN[0]=paredes_externas_5.a)  # CPython3; same code as python_script
dados_qualitativos_pe_direito_e_5 = CodeBlock(a=python_script_5, Paredes=filterByBoolMask_18.in, zona=filterByBoolMask_16.in, superf=byPatch_5)  # "Dados qualitativos, pe direito e area"
# ---------- dados_qualitativos_pe_direito_e_5.designscript (13 lines) ----------
sa = Math.Sum(a);
b = Paredes.GetParameterValueByName("Altura desconectada");
pedireito = Math.Sum(a*b)/sa;
nome = zona.GetParameterValueByName("Nome");
areazona = Autodesk.Surface.Area(superf);
tipozona = "Perimetral";
orienta = "L";
// lista com resultados
"Envoltória";
22;
2;
resultados = List.Flatten([nome,areazona,pedireito,tipozona,orienta]);
false;
# ----------------------------------------
getHostedElements_5 = Element.GetHostedElements(element=filterByBoolMask_18.in)
janelas_da_fachada_5 = CodeBlock(janelasexternas=getHostedElements_5)  # same code as janelas_da_fachada
componentes_e_paf_5 = CodeBlock(zona=filterByBoolMask_16.in, a=python_script_5, areaabertura=janelas_da_fachada_5.out5)
# ---------- componentes_e_paf_5.designscript (10 lines) ----------
nome = zona.GetParameterValueByName("Nome");
sa = Math.Sum(a);
PAF = areaabertura/(areaabertura + sa);
cob = "Pvto interm.";
// lista com resultados
"Envoltória";
22;
9;
resultados = List.Flatten([nome,nome,cob,nome,nome,PAF]);
false;
# ----------------------------------------
paredes_externas_6 = CodeBlock(ParedesExt=filterByBoolMask_21.in) { ParedesExternas = List.Flatten(ParedesExt); a = ParedesExternas.GetParameterValueByName("Área"); }
python_script_6 = Python(IN[0]=paredes_externas_6.a)  # CPython3; same code as python_script
dados_qualitativos_pe_direito_e_6 = CodeBlock(a=python_script_6, Paredes=filterByBoolMask_21.in, zona=filterByBoolMask_19.in, superf=byPatch_6)  # "Dados qualitativos, pe direito e area"
# ---------- dados_qualitativos_pe_direito_e_6.designscript (13 lines) ----------
sa = Math.Sum(a);
b = Paredes.GetParameterValueByName("Altura desconectada");
pedireito = Math.Sum(a*b)/sa;
nome = zona.GetParameterValueByName("Nome");
areazona = Autodesk.Surface.Area(superf);
tipozona = "Perimetral";
orienta = "L";
// lista com resultados
"Envoltória";
23;
2;
resultados = List.Flatten([nome,areazona,pedireito,tipozona,orienta]);
false;
# ----------------------------------------
getHostedElements_6 = Element.GetHostedElements(element=filterByBoolMask_21.in)
janelas_da_fachada_6 = CodeBlock(janelasexternas=getHostedElements_6)  # same code as janelas_da_fachada
componentes_e_paf_6 = CodeBlock(zona=filterByBoolMask_19.in, a=python_script_6, areaabertura=janelas_da_fachada_6.out5)
# ---------- componentes_e_paf_6.designscript (10 lines) ----------
nome = zona.GetParameterValueByName("Nome");
sa = Math.Sum(a);
PAF = areaabertura/(areaabertura + sa);
cob = "Pvto interm.";
// lista com resultados
"Envoltória";
23;
9;
resultados = List.Flatten([nome,nome,cob,nome,nome,PAF]);
false;
# ----------------------------------------
paredes_externas_7 = CodeBlock(ParedesExt=filterByBoolMask_24.in) { ParedesExternas = List.Flatten(ParedesExt); a = ParedesExternas.GetParameterValueByName("Área"); }
python_script_7 = Python(IN[0]=paredes_externas_7.a)  # CPython3; same code as python_script
dados_qualitativos_pe_direito_e_7 = CodeBlock(a=python_script_7, Paredes=filterByBoolMask_24.in, zona=filterByBoolMask_22.in, superf=byPatch_7)  # "Dados qualitativos, pe direito e area"
# ---------- dados_qualitativos_pe_direito_e_7.designscript (13 lines) ----------
sa = Math.Sum(a);
b = Paredes.GetParameterValueByName("Altura desconectada");
pedireito = Math.Sum(a*b)/sa;
nome = zona.GetParameterValueByName("Nome");
areazona = Autodesk.Surface.Area(superf);
tipozona = "Perimetral";
orienta = "L";
// lista com resultados
"Envoltória";
24;
2;
resultados = List.Flatten([nome,areazona,pedireito,tipozona,orienta]);
false;
# ----------------------------------------
getHostedElements_7 = Element.GetHostedElements(element=filterByBoolMask_24.in)
janelas_da_fachada_7 = CodeBlock(janelasexternas=getHostedElements_7)  # same code as janelas_da_fachada
componentes_e_paf_7 = CodeBlock(zona=filterByBoolMask_22.in, a=python_script_7, areaabertura=janelas_da_fachada_7.out5)
# ---------- componentes_e_paf_7.designscript (10 lines) ----------
nome = zona.GetParameterValueByName("Nome");
sa = Math.Sum(a);
PAF = areaabertura/(areaabertura + sa);
cob = "Pvto interm.";
// lista com resultados
"Envoltória";
24;
9;
resultados = List.Flatten([nome,nome,cob,nome,nome,PAF]);
false;
# ----------------------------------------
paredes_externas_8 = CodeBlock(ParedesExt=filterByBoolMask_27.in) { ParedesExternas = List.Flatten(ParedesExt); a = ParedesExternas.GetParameterValueByName("Área"); }
python_script_8 = Python(IN[0]=paredes_externas_8.a)  # CPython3; same code as python_script
dados_qualitativos_pe_direito_e_8 = CodeBlock(a=python_script_8, Paredes=filterByBoolMask_27.in, zona=filterByBoolMask_25.in, superf=byPatch_8)  # "Dados qualitativos, pe direito e area"
# ---------- dados_qualitativos_pe_direito_e_8.designscript (13 lines) ----------
sa = Math.Sum(a);
b = Paredes.GetParameterValueByName("Altura desconectada");
pedireito = Math.Sum(a*b)/sa;
nome = zona.GetParameterValueByName("Nome");
areazona = Autodesk.Surface.Area(superf);
tipozona = "Perimetral";
orienta = "L";
// lista com resultados
"Envoltória";
25;
2;
resultados = List.Flatten([nome,areazona,pedireito,tipozona,orienta]);
false;
# ----------------------------------------
getHostedElements_8 = Element.GetHostedElements(element=filterByBoolMask_27.in)
janelas_da_fachada_8 = CodeBlock(janelasexternas=getHostedElements_8)  # same code as janelas_da_fachada
componentes_e_paf_8 = CodeBlock(zona=filterByBoolMask_25.in, a=python_script_8, areaabertura=janelas_da_fachada_8.out5)
# ---------- componentes_e_paf_8.designscript (10 lines) ----------
nome = zona.GetParameterValueByName("Nome");
sa = Math.Sum(a);
PAF = areaabertura/(areaabertura + sa);
cob = "Pvto interm.";
// lista com resultados
"Envoltória";
25;
9;
resultados = List.Flatten([nome,nome,cob,nome,nome,PAF]);
false;
# ----------------------------------------

# group: Zonas L - Nível 1 > Exporta dados paredes para planilha
# Descrição <Clique duas vezes aqui para editar a descrição do grupo>
exportToExcel_9 = Data.ExportToExcel(filePath=file_path, sheetName=dados_qualitativos_pe_direito_e_5.out7, startRow=dados_qualitativos_pe_direito_e_5.out8, startColumn=dados_qualitativos_pe_direito_e_5.out9, data=dados_qualitativos_pe_direito_e_5.resultados@L3)
exportToExcel_10 = Data.ExportToExcel(filePath=file_path, sheetName=componentes_e_paf_5.out4, startRow=componentes_e_paf_5.out5, startColumn=componentes_e_paf_5.out6, data=componentes_e_paf_5.resultados@L3)

# group: Zonas L - Nível 1 > Exporta dados paredes para planilha
# Descrição <Clique duas vezes aqui para editar a descrição do grupo>
exportToExcel_11 = Data.ExportToExcel(filePath=file_path, sheetName=dados_qualitativos_pe_direito_e_6.out7, startRow=dados_qualitativos_pe_direito_e_6.out8, startColumn=dados_qualitativos_pe_direito_e_6.out9, data=dados_qualitativos_pe_direito_e_6.resultados@L3)
exportToExcel_12 = Data.ExportToExcel(filePath=file_path, sheetName=componentes_e_paf_6.out4, startRow=componentes_e_paf_6.out5, startColumn=componentes_e_paf_6.out6, data=componentes_e_paf_6.resultados@L3)

# group: Zonas L - Nível 1 > Exporta dados paredes para planilha
# Descrição <Clique duas vezes aqui para editar a descrição do grupo>
exportToExcel_13 = Data.ExportToExcel(filePath=file_path, sheetName=dados_qualitativos_pe_direito_e_7.out7, startRow=dados_qualitativos_pe_direito_e_7.out8, startColumn=dados_qualitativos_pe_direito_e_7.out9, data=dados_qualitativos_pe_direito_e_7.resultados@L3)
exportToExcel_14 = Data.ExportToExcel(filePath=file_path, sheetName=componentes_e_paf_7.out4, startRow=componentes_e_paf_7.out5, startColumn=componentes_e_paf_7.out6, data=componentes_e_paf_7.resultados@L3)

# group: Zonas L - Nível 1 > Exporta dados paredes para planilha
# Descrição <Clique duas vezes aqui para editar a descrição do grupo>
exportToExcel_15 = Data.ExportToExcel(filePath=file_path, sheetName=dados_qualitativos_pe_direito_e_8.out7, startRow=dados_qualitativos_pe_direito_e_8.out8, startColumn=dados_qualitativos_pe_direito_e_8.out9, data=dados_qualitativos_pe_direito_e_8.resultados@L3)
exportToExcel_16 = Data.ExportToExcel(filePath=file_path, sheetName=componentes_e_paf_8.out4, startRow=componentes_e_paf_8.out5, startColumn=componentes_e_paf_8.out6, data=componentes_e_paf_8.resultados@L3)

# group: Zonas S - Nível 1 > Seleciona Zona S
# Descrição <Clique duas vezes aqui para editar a descrição do grupo>
filterByBoolMask_28 = List.FilterByBoolMask(list=filterByBoolMask.in, mask=code_block_2.out4)

# group: Zonas S - Nível 1 > Identifica numeração da zona
# Descrição <Clique duas vezes aqui para editar a descrição do grupo>
code_block_21 = CodeBlock(area=filterByBoolMask_28.in)  # same code as code_block_3

# group: Zonas S - Nível 1 > Seleciona Z1
# Descrição <Clique duas vezes aqui para editar a descrição do grupo>
filterByBoolMask_29 = List.FilterByBoolMask(list=filterByBoolMask_28.in, mask=code_block_21.out2)
code_block_22 = CodeBlock(a=filterByBoolMask_29.in) { b = a.Boundaries; List.Flatten(b); }
byJoinedCurves_9 = PolyCurve.ByJoinedCurves(curves=code_block_22.out1)
byPatch_9 = Surface.ByPatch(closedCurve=byJoinedCurves_9)

# group: Zonas S - Nível 1 > Identifica quais paredes estão dentro da Zona N
# Descrição <Clique duas vezes aqui para editar a descrição do grupo>
doesIntersect_9 = Geometry.DoesIntersect(geometry=byPatch_9@L1, other=getLocation)
filterByBoolMask_30 = List.FilterByBoolMask(list=all_elements_of_category@L3, mask=doesIntersect_9)
code_block_23 = CodeBlock(a=filterByBoolMask_30.in) { b = List.Flatten(a); c = List.UniqueItems(b); List.Clean(c); }

# group: Zonas S - Nível 1 > Seleciona paredes externas e internas
# Descrição <Clique duas vezes aqui para editar a descrição do grupo>
identifica_parede_relacionada_e_9 = CodeBlock(paredes=code_block_23.out2) { a = paredes.ElementType; b = a.GetParameterValueByName("Função"); b == 1; }  # "Identifica parede relacionada e se é externa"
filterByBoolMask_31 = List.FilterByBoolMask(list=code_block_23.out2, mask=identifica_parede_relacionada_e_9.out2)

# group: Zonas S - Nível 1 > Seleciona Z2
# Descrição <Clique duas vezes aqui para editar a descrição do grupo>
filterByBoolMask_32 = List.FilterByBoolMask(list=filterByBoolMask_28.in, mask=code_block_21.out3)
code_block_24 = CodeBlock(a=filterByBoolMask_32.in) { b = a.Boundaries; List.Flatten(b); }
byJoinedCurves_10 = PolyCurve.ByJoinedCurves(curves=code_block_24.out1)
byPatch_10 = Surface.ByPatch(closedCurve=byJoinedCurves_10)

# group: Zonas S - Nível 1 > Identifica quais paredes estão dentro da Zona N
# Descrição <Clique duas vezes aqui para editar a descrição do grupo>
doesIntersect_10 = Geometry.DoesIntersect(geometry=byPatch_10@L1, other=getLocation)
filterByBoolMask_33 = List.FilterByBoolMask(list=all_elements_of_category@L3, mask=doesIntersect_10)
code_block_25 = CodeBlock(a=filterByBoolMask_33.in) { b = List.Flatten(a); c = List.UniqueItems(b); List.Clean(c); }

# group: Zonas S - Nível 1 > Seleciona paredes externas e internas
# Descrição <Clique duas vezes aqui para editar a descrição do grupo>
identifica_parede_relacionada_e_10 = CodeBlock(paredes=code_block_25.out2) { a = paredes.ElementType; b = a.GetParameterValueByName("Função"); b == 1; }  # "Identifica parede relacionada e se é externa"
filterByBoolMask_34 = List.FilterByBoolMask(list=code_block_25.out2, mask=identifica_parede_relacionada_e_10.out2)

# group: Zonas S - Nível 1 > Seleciona Z3
# Descrição <Clique duas vezes aqui para editar a descrição do grupo>
filterByBoolMask_35 = List.FilterByBoolMask(list=filterByBoolMask_28.in, mask=code_block_21.out4)
code_block_26 = CodeBlock(a=filterByBoolMask_35.in) { b = a.Boundaries; List.Flatten(b); }
byJoinedCurves_11 = PolyCurve.ByJoinedCurves(curves=code_block_26.out1)
byPatch_11 = Surface.ByPatch(closedCurve=byJoinedCurves_11)

# group: Zonas S - Nível 1 > Identifica quais paredes estão dentro da Zona N
# Descrição <Clique duas vezes aqui para editar a descrição do grupo>
doesIntersect_11 = Geometry.DoesIntersect(geometry=byPatch_11@L1, other=getLocation)
filterByBoolMask_36 = List.FilterByBoolMask(list=all_elements_of_category@L3, mask=doesIntersect_11)
code_block_27 = CodeBlock(a=filterByBoolMask_36.in) { b = List.Flatten(a); c = List.UniqueItems(b); List.Clean(c); }

# group: Zonas S - Nível 1 > Seleciona paredes externas e internas
# Descrição <Clique duas vezes aqui para editar a descrição do grupo>
identifica_parede_relacionada_e_11 = CodeBlock(paredes=code_block_27.out2) { a = paredes.ElementType; b = a.GetParameterValueByName("Função"); b == 1; }  # "Identifica parede relacionada e se é externa"
filterByBoolMask_37 = List.FilterByBoolMask(list=code_block_27.out2, mask=identifica_parede_relacionada_e_11.out2)

# group: Zonas S - Nível 1 > Seleciona Z4
# Descrição <Clique duas vezes aqui para editar a descrição do grupo>
filterByBoolMask_38 = List.FilterByBoolMask(list=filterByBoolMask_28.in, mask=code_block_21.out5)
code_block_28 = CodeBlock(a=filterByBoolMask_38.in) { b = a.Boundaries; List.Flatten(b); }
byJoinedCurves_12 = PolyCurve.ByJoinedCurves(curves=code_block_28.out1)
byPatch_12 = Surface.ByPatch(closedCurve=byJoinedCurves_12)

# group: Zonas S - Nível 1 > Identifica quais paredes estão dentro da Zona N
# Descrição <Clique duas vezes aqui para editar a descrição do grupo>
doesIntersect_12 = Geometry.DoesIntersect(geometry=byPatch_12@L1, other=getLocation)
filterByBoolMask_39 = List.FilterByBoolMask(list=all_elements_of_category@L3, mask=doesIntersect_12)
code_block_29 = CodeBlock(a=filterByBoolMask_39.in) { b = List.Flatten(a); c = List.UniqueItems(b); List.Clean(c); }

# group: Zonas S - Nível 1 > Seleciona paredes externas e internas
# Descrição <Clique duas vezes aqui para editar a descrição do grupo>
identifica_parede_relacionada_e_12 = CodeBlock(paredes=code_block_29.out2) { a = paredes.ElementType; b = a.GetParameterValueByName("Função"); b == 1; }  # "Identifica parede relacionada e se é externa"
filterByBoolMask_40 = List.FilterByBoolMask(list=code_block_29.out2, mask=identifica_parede_relacionada_e_12.out2)

# group: Zonas S - Nível 1
# Descrição <Clique duas vezes aqui para editar a descrição do grupo>
paredes_externas_9 = CodeBlock(ParedesExt=filterByBoolMask_31.in) { ParedesExternas = List.Flatten(ParedesExt); a = ParedesExternas.GetParameterValueByName("Área"); }
python_script_9 = Python(IN[0]=paredes_externas_9.a)  # CPython3; same code as python_script
dados_qualitativos_pe_direito_e_9 = CodeBlock(a=python_script_9, Paredes=filterByBoolMask_31.in, zona=filterByBoolMask_29.in, superf=byPatch_9)  # "Dados qualitativos, pe direito e area"
# ---------- dados_qualitativos_pe_direito_e_9.designscript (13 lines) ----------
sa = Math.Sum(a);
b = Paredes.GetParameterValueByName("Altura desconectada");
pedireito = Math.Sum(a*b)/sa;
nome = zona.GetParameterValueByName("Nome");
areazona = Autodesk.Surface.Area(superf);
tipozona = "Perimetral";
orienta = "S";
// lista com resultados
"Envoltória";
26;
2;
resultados = List.Flatten([nome,areazona,pedireito,tipozona,orienta]);
false;
# ----------------------------------------
getHostedElements_9 = Element.GetHostedElements(element=filterByBoolMask_31.in)
janelas_da_fachada_9 = CodeBlock(janelasexternas=getHostedElements_9)  # same code as janelas_da_fachada
componentes_e_paf_9 = CodeBlock(zona=filterByBoolMask_29.in, a=python_script_9, areaabertura=janelas_da_fachada_9.out5)
# ---------- componentes_e_paf_9.designscript (10 lines) ----------
nome = zona.GetParameterValueByName("Nome");
sa = Math.Sum(a);
PAF = areaabertura/(areaabertura + sa);
cob = "Pvto interm.";
// lista com resultados
"Envoltória";
26;
9;
resultados = List.Flatten([nome,nome,cob,nome,nome,PAF]);
false;
# ----------------------------------------
paredes_externas_10 = CodeBlock(ParedesExt=filterByBoolMask_34.in) { ParedesExternas = List.Flatten(ParedesExt); a = ParedesExternas.GetParameterValueByName("Área"); }
python_script_10 = Python(IN[0]=paredes_externas_10.a)  # CPython3; same code as python_script
dados_qualitativos_pe_direito_e_10 = CodeBlock(a=python_script_10, Paredes=filterByBoolMask_34.in, zona=filterByBoolMask_32.in, superf=byPatch_10)  # "Dados qualitativos, pe direito e area"
# ---------- dados_qualitativos_pe_direito_e_10.designscript (13 lines) ----------
sa = Math.Sum(a);
b = Paredes.GetParameterValueByName("Altura desconectada");
pedireito = Math.Sum(a*b)/sa;
nome = zona.GetParameterValueByName("Nome");
areazona = Autodesk.Surface.Area(superf);
tipozona = "Perimetral";
orienta = "S";
// lista com resultados
"Envoltória";
27;
2;
resultados = List.Flatten([nome,areazona,pedireito,tipozona,orienta]);
false;
# ----------------------------------------
getHostedElements_10 = Element.GetHostedElements(element=filterByBoolMask_34.in)
janelas_da_fachada_10 = CodeBlock(janelasexternas=getHostedElements_10)  # same code as janelas_da_fachada
componentes_e_paf_10 = CodeBlock(zona=filterByBoolMask_32.in, a=python_script_10, areaabertura=janelas_da_fachada_10.out5)
# ---------- componentes_e_paf_10.designscript (10 lines) ----------
nome = zona.GetParameterValueByName("Nome");
sa = Math.Sum(a);
PAF = areaabertura/(areaabertura + sa);
cob = "Pvto interm.";
// lista com resultados
"Envoltória";
27;
9;
resultados = List.Flatten([nome,nome,cob,nome,nome,PAF]);
false;
# ----------------------------------------
paredes_externas_11 = CodeBlock(ParedesExt=filterByBoolMask_37.in) { ParedesExternas = List.Flatten(ParedesExt); a = ParedesExternas.GetParameterValueByName("Área"); }
python_script_11 = Python(IN[0]=paredes_externas_11.a)  # CPython3; same code as python_script
dados_qualitativos_pe_direito_e_11 = CodeBlock(a=python_script_11, Paredes=filterByBoolMask_37.in, zona=filterByBoolMask_35.in, superf=byPatch_11)  # "Dados qualitativos, pe direito e area"
# ---------- dados_qualitativos_pe_direito_e_11.designscript (13 lines) ----------
sa = Math.Sum(a);
b = Paredes.GetParameterValueByName("Altura desconectada");
pedireito = Math.Sum(a*b)/sa;
nome = zona.GetParameterValueByName("Nome");
areazona = Autodesk.Surface.Area(superf);
tipozona = "Perimetral";
orienta = "S";
// lista com resultados
"Envoltória";
28;
2;
resultados = List.Flatten([nome,areazona,pedireito,tipozona,orienta]);
false;
# ----------------------------------------
getHostedElements_11 = Element.GetHostedElements(element=filterByBoolMask_37.in)
janelas_da_fachada_11 = CodeBlock(janelasexternas=getHostedElements_11)  # same code as janelas_da_fachada
componentes_e_paf_11 = CodeBlock(zona=filterByBoolMask_35.in, a=python_script_11, areaabertura=janelas_da_fachada_11.out5)
# ---------- componentes_e_paf_11.designscript (10 lines) ----------
nome = zona.GetParameterValueByName("Nome");
sa = Math.Sum(a);
PAF = areaabertura/(areaabertura + sa);
cob = "Pvto interm.";
// lista com resultados
"Envoltória";
28;
9;
resultados = List.Flatten([nome,nome,cob,nome,nome,PAF]);
false;
# ----------------------------------------
paredes_externas_12 = CodeBlock(ParedesExt=filterByBoolMask_40.in) { ParedesExternas = List.Flatten(ParedesExt); a = ParedesExternas.GetParameterValueByName("Área"); }
python_script_12 = Python(IN[0]=paredes_externas_12.a)  # CPython3; same code as python_script
dados_qualitativos_pe_direito_e_12 = CodeBlock(a=python_script_12, Paredes=filterByBoolMask_40.in, zona=filterByBoolMask_38.in, superf=byPatch_12)  # "Dados qualitativos, pe direito e area"
# ---------- dados_qualitativos_pe_direito_e_12.designscript (13 lines) ----------
sa = Math.Sum(a);
b = Paredes.GetParameterValueByName("Altura desconectada");
pedireito = Math.Sum(a*b)/sa;
nome = zona.GetParameterValueByName("Nome");
areazona = Autodesk.Surface.Area(superf);
tipozona = "Perimetral";
orienta = "S";
// lista com resultados
"Envoltória";
29;
2;
resultados = List.Flatten([nome,areazona,pedireito,tipozona,orienta]);
false;
# ----------------------------------------
getHostedElements_12 = Element.GetHostedElements(element=filterByBoolMask_40.in)
janelas_da_fachada_12 = CodeBlock(janelasexternas=getHostedElements_12)  # same code as janelas_da_fachada
componentes_e_paf_12 = CodeBlock(zona=filterByBoolMask_38.in, a=python_script_12, areaabertura=janelas_da_fachada_12.out5)
# ---------- componentes_e_paf_12.designscript (10 lines) ----------
nome = zona.GetParameterValueByName("Nome");
sa = Math.Sum(a);
PAF = areaabertura/(areaabertura + sa);
cob = "Pvto interm.";
// lista com resultados
"Envoltória";
29;
9;
resultados = List.Flatten([nome,nome,cob,nome,nome,PAF]);
false;
# ----------------------------------------

# group: Zonas S - Nível 1 > Exporta dados paredes para planilha
# Descrição <Clique duas vezes aqui para editar a descrição do grupo>
exportToExcel_17 = Data.ExportToExcel(filePath=file_path, sheetName=dados_qualitativos_pe_direito_e_9.out7, startRow=dados_qualitativos_pe_direito_e_9.out8, startColumn=dados_qualitativos_pe_direito_e_9.out9, data=dados_qualitativos_pe_direito_e_9.resultados@L3)
exportToExcel_18 = Data.ExportToExcel(filePath=file_path, sheetName=componentes_e_paf_9.out4, startRow=componentes_e_paf_9.out5, startColumn=componentes_e_paf_9.out6, data=componentes_e_paf_9.resultados@L3)

# group: Zonas S - Nível 1 > Exporta dados paredes para planilha
# Descrição <Clique duas vezes aqui para editar a descrição do grupo>
exportToExcel_19 = Data.ExportToExcel(filePath=file_path, sheetName=dados_qualitativos_pe_direito_e_10.out7, startRow=dados_qualitativos_pe_direito_e_10.out8, startColumn=dados_qualitativos_pe_direito_e_10.out9, data=dados_qualitativos_pe_direito_e_10.resultados@L3)
exportToExcel_20 = Data.ExportToExcel(filePath=file_path, sheetName=componentes_e_paf_10.out4, startRow=componentes_e_paf_10.out5, startColumn=componentes_e_paf_10.out6, data=componentes_e_paf_10.resultados@L3)

# group: Zonas S - Nível 1 > Exporta dados paredes para planilha
# Descrição <Clique duas vezes aqui para editar a descrição do grupo>
exportToExcel_21 = Data.ExportToExcel(filePath=file_path, sheetName=dados_qualitativos_pe_direito_e_11.out7, startRow=dados_qualitativos_pe_direito_e_11.out8, startColumn=dados_qualitativos_pe_direito_e_11.out9, data=dados_qualitativos_pe_direito_e_11.resultados@L3)
exportToExcel_22 = Data.ExportToExcel(filePath=file_path, sheetName=componentes_e_paf_11.out4, startRow=componentes_e_paf_11.out5, startColumn=componentes_e_paf_11.out6, data=componentes_e_paf_11.resultados@L3)

# group: Zonas S - Nível 1 > Exporta dados paredes para planilha
# Descrição <Clique duas vezes aqui para editar a descrição do grupo>
exportToExcel_23 = Data.ExportToExcel(filePath=file_path, sheetName=dados_qualitativos_pe_direito_e_12.out7, startRow=dados_qualitativos_pe_direito_e_12.out8, startColumn=dados_qualitativos_pe_direito_e_12.out9, data=dados_qualitativos_pe_direito_e_12.resultados@L3)
exportToExcel_24 = Data.ExportToExcel(filePath=file_path, sheetName=componentes_e_paf_12.out4, startRow=componentes_e_paf_12.out5, startColumn=componentes_e_paf_12.out6, data=componentes_e_paf_12.resultados@L3)

# group: Zonas O - Nível 1 > Seleciona Zona O
# Descrição <Clique duas vezes aqui para editar a descrição do grupo>
filterByBoolMask_41 = List.FilterByBoolMask(list=filterByBoolMask.in, mask=code_block_2.out5)

# group: Zonas O - Nível 1 > Identifica numeração da zona
# Descrição <Clique duas vezes aqui para editar a descrição do grupo>
code_block_30 = CodeBlock(area=filterByBoolMask_41.in)  # same code as code_block_3

# group: Zonas O - Nível 1 > Seleciona Z1
# Descrição <Clique duas vezes aqui para editar a descrição do grupo>
filterByBoolMask_42 = List.FilterByBoolMask(list=filterByBoolMask_41.in, mask=code_block_30.out2)
code_block_31 = CodeBlock(a=filterByBoolMask_42.in) { b = a.Boundaries; List.Flatten(b); }
byJoinedCurves_13 = PolyCurve.ByJoinedCurves(curves=code_block_31.out1)
byPatch_13 = Surface.ByPatch(closedCurve=byJoinedCurves_13)

# group: Zonas O - Nível 1 > Identifica quais paredes estão dentro da Zona N
# Descrição <Clique duas vezes aqui para editar a descrição do grupo>
doesIntersect_13 = Geometry.DoesIntersect(geometry=byPatch_13@L1, other=getLocation)
filterByBoolMask_43 = List.FilterByBoolMask(list=all_elements_of_category@L3, mask=doesIntersect_13)
code_block_32 = CodeBlock(a=filterByBoolMask_43.in) { b = List.Flatten(a); c = List.UniqueItems(b); List.Clean(c); }

# group: Zonas O - Nível 1 > Seleciona paredes externas e internas
# Descrição <Clique duas vezes aqui para editar a descrição do grupo>
identifica_parede_relacionada_e_13 = CodeBlock(paredes=code_block_32.out2) { a = paredes.ElementType; b = a.GetParameterValueByName("Função"); b == 1; }  # "Identifica parede relacionada e se é externa"
filterByBoolMask_44 = List.FilterByBoolMask(list=code_block_32.out2, mask=identifica_parede_relacionada_e_13.out2)

# group: Zonas O - Nível 1 > Seleciona Z2
# Descrição <Clique duas vezes aqui para editar a descrição do grupo>
filterByBoolMask_45 = List.FilterByBoolMask(list=filterByBoolMask_41.in, mask=code_block_30.out3)
code_block_33 = CodeBlock(a=filterByBoolMask_45.in) { b = a.Boundaries; List.Flatten(b); }
byJoinedCurves_14 = PolyCurve.ByJoinedCurves(curves=code_block_33.out1)
byPatch_14 = Surface.ByPatch(closedCurve=byJoinedCurves_14)

# group: Zonas O - Nível 1 > Identifica quais paredes estão dentro da Zona N
# Descrição <Clique duas vezes aqui para editar a descrição do grupo>
doesIntersect_14 = Geometry.DoesIntersect(geometry=byPatch_14@L1, other=getLocation)
filterByBoolMask_46 = List.FilterByBoolMask(list=all_elements_of_category@L3, mask=doesIntersect_14)
code_block_34 = CodeBlock(a=filterByBoolMask_46.in) { b = List.Flatten(a); c = List.UniqueItems(b); List.Clean(c); }

# group: Zonas O - Nível 1 > Seleciona paredes externas e internas
# Descrição <Clique duas vezes aqui para editar a descrição do grupo>
identifica_parede_relacionada_e_14 = CodeBlock(paredes=code_block_34.out2) { a = paredes.ElementType; b = a.GetParameterValueByName("Função"); b == 1; }  # "Identifica parede relacionada e se é externa"
filterByBoolMask_47 = List.FilterByBoolMask(list=code_block_34.out2, mask=identifica_parede_relacionada_e_14.out2)

# group: Zonas O - Nível 1 > Seleciona Z3
# Descrição <Clique duas vezes aqui para editar a descrição do grupo>
filterByBoolMask_48 = List.FilterByBoolMask(list=filterByBoolMask_41.in, mask=code_block_30.out4)
code_block_35 = CodeBlock(a=filterByBoolMask_48.in) { b = a.Boundaries; List.Flatten(b); }
byJoinedCurves_15 = PolyCurve.ByJoinedCurves(curves=code_block_35.out1)
byPatch_15 = Surface.ByPatch(closedCurve=byJoinedCurves_15)

# group: Zonas O - Nível 1 > Identifica quais paredes estão dentro da Zona N
# Descrição <Clique duas vezes aqui para editar a descrição do grupo>
doesIntersect_15 = Geometry.DoesIntersect(geometry=byPatch_15@L1, other=getLocation)
filterByBoolMask_49 = List.FilterByBoolMask(list=all_elements_of_category@L3, mask=doesIntersect_15)
code_block_36 = CodeBlock(a=filterByBoolMask_49.in) { b = List.Flatten(a); c = List.UniqueItems(b); List.Clean(c); }

# group: Zonas O - Nível 1 > Seleciona paredes externas e internas
# Descrição <Clique duas vezes aqui para editar a descrição do grupo>
identifica_parede_relacionada_e_15 = CodeBlock(paredes=code_block_36.out2) { a = paredes.ElementType; b = a.GetParameterValueByName("Função"); b == 1; }  # "Identifica parede relacionada e se é externa"
filterByBoolMask_50 = List.FilterByBoolMask(list=code_block_36.out2, mask=identifica_parede_relacionada_e_15.out2)

# group: Zonas O - Nível 1 > Seleciona Z4
# Descrição <Clique duas vezes aqui para editar a descrição do grupo>
filterByBoolMask_51 = List.FilterByBoolMask(list=filterByBoolMask_41.in, mask=code_block_30.out5)
code_block_37 = CodeBlock(a=filterByBoolMask_51.in) { b = a.Boundaries; List.Flatten(b); }
byJoinedCurves_16 = PolyCurve.ByJoinedCurves(curves=code_block_37.out1)
byPatch_16 = Surface.ByPatch(closedCurve=byJoinedCurves_16)

# group: Zonas O - Nível 1 > Identifica quais paredes estão dentro da Zona N
# Descrição <Clique duas vezes aqui para editar a descrição do grupo>
doesIntersect_16 = Geometry.DoesIntersect(geometry=byPatch_16@L1, other=getLocation)
filterByBoolMask_52 = List.FilterByBoolMask(list=all_elements_of_category@L3, mask=doesIntersect_16)
code_block_38 = CodeBlock(a=filterByBoolMask_52.in) { b = List.Flatten(a); c = List.UniqueItems(b); List.Clean(c); }

# group: Zonas O - Nível 1 > Seleciona paredes externas e internas
# Descrição <Clique duas vezes aqui para editar a descrição do grupo>
identifica_parede_relacionada_e_16 = CodeBlock(paredes=code_block_38.out2) { a = paredes.ElementType; b = a.GetParameterValueByName("Função"); b == 1; }  # "Identifica parede relacionada e se é externa"
filterByBoolMask_53 = List.FilterByBoolMask(list=code_block_38.out2, mask=identifica_parede_relacionada_e_16.out2)

# group: Zonas O - Nível 1
# Descrição <Clique duas vezes aqui para editar a descrição do grupo>
paredes_externas_13 = CodeBlock(ParedesExt=filterByBoolMask_44.in) { ParedesExternas = List.Flatten(ParedesExt); a = ParedesExternas.GetParameterValueByName("Área"); }
python_script_13 = Python(IN[0]=paredes_externas_13.a)  # CPython3; same code as python_script
dados_qualitativos_pe_direito_e_13 = CodeBlock(a=python_script_13, Paredes=filterByBoolMask_44.in, zona=filterByBoolMask_42.in, superf=byPatch_13)  # "Dados qualitativos, pe direito e area"
# ---------- dados_qualitativos_pe_direito_e_13.designscript (13 lines) ----------
sa = Math.Sum(a);
b = Paredes.GetParameterValueByName("Altura desconectada");
pedireito = Math.Sum(a*b)/sa;
nome = zona.GetParameterValueByName("Nome");
areazona = Autodesk.Surface.Area(superf);
tipozona = "Perimetral";
orienta = "O";
// lista com resultados
"Envoltória";
30;
2;
resultados = List.Flatten([nome,areazona,pedireito,tipozona,orienta]);
false;
# ----------------------------------------
getHostedElements_13 = Element.GetHostedElements(element=filterByBoolMask_44.in)
janelas_da_fachada_13 = CodeBlock(janelasexternas=getHostedElements_13)  # same code as janelas_da_fachada
componentes_e_paf_13 = CodeBlock(zona=filterByBoolMask_42.in, a=python_script_13, areaabertura=janelas_da_fachada_13.out5)
# ---------- componentes_e_paf_13.designscript (10 lines) ----------
nome = zona.GetParameterValueByName("Nome");
sa = Math.Sum(a);
PAF = areaabertura/(areaabertura + sa);
cob = "Pvto interm.";
// lista com resultados
"Envoltória";
30;
9;
resultados = List.Flatten([nome,nome,cob,nome,nome,PAF]);
false;
# ----------------------------------------
paredes_externas_14 = CodeBlock(ParedesExt=filterByBoolMask_47.in) { ParedesExternas = List.Flatten(ParedesExt); a = ParedesExternas.GetParameterValueByName("Área"); }
python_script_14 = Python(IN[0]=paredes_externas_14.a)  # CPython3; same code as python_script
dados_qualitativos_pe_direito_e_14 = CodeBlock(a=python_script_14, Paredes=filterByBoolMask_47.in, zona=filterByBoolMask_45.in, superf=byPatch_14)  # "Dados qualitativos, pe direito e area"
# ---------- dados_qualitativos_pe_direito_e_14.designscript (13 lines) ----------
sa = Math.Sum(a);
b = Paredes.GetParameterValueByName("Altura desconectada");
pedireito = Math.Sum(a*b)/sa;
nome = zona.GetParameterValueByName("Nome");
areazona = Autodesk.Surface.Area(superf);
tipozona = "Perimetral";
orienta = "O";
// lista com resultados
"Envoltória";
31;
2;
resultados = List.Flatten([nome,areazona,pedireito,tipozona,orienta]);
false;
# ----------------------------------------
getHostedElements_14 = Element.GetHostedElements(element=filterByBoolMask_47.in)
janelas_da_fachada_14 = CodeBlock(janelasexternas=getHostedElements_14)  # same code as janelas_da_fachada
componentes_e_paf_14 = CodeBlock(zona=filterByBoolMask_45.in, a=python_script_14, areaabertura=janelas_da_fachada_14.out5)
# ---------- componentes_e_paf_14.designscript (10 lines) ----------
nome = zona.GetParameterValueByName("Nome");
sa = Math.Sum(a);
PAF = areaabertura/(areaabertura + sa);
cob = "Pvto interm.";
// lista com resultados
"Envoltória";
31;
9;
resultados = List.Flatten([nome,nome,cob,nome,nome,PAF]);
false;
# ----------------------------------------
paredes_externas_15 = CodeBlock(ParedesExt=filterByBoolMask_50.in) { ParedesExternas = List.Flatten(ParedesExt); a = ParedesExternas.GetParameterValueByName("Área"); }
python_script_15 = Python(IN[0]=paredes_externas_15.a)  # CPython3; same code as python_script
dados_qualitativos_pe_direito_e_15 = CodeBlock(a=python_script_15, Paredes=filterByBoolMask_50.in, zona=filterByBoolMask_48.in, superf=byPatch_15)  # "Dados qualitativos, pe direito e area"
# ---------- dados_qualitativos_pe_direito_e_15.designscript (13 lines) ----------
sa = Math.Sum(a);
b = Paredes.GetParameterValueByName("Altura desconectada");
pedireito = Math.Sum(a*b)/sa;
nome = zona.GetParameterValueByName("Nome");
areazona = Autodesk.Surface.Area(superf);
tipozona = "Perimetral";
orienta = "O";
// lista com resultados
"Envoltória";
32;
2;
resultados = List.Flatten([nome,areazona,pedireito,tipozona,orienta]);
false;
# ----------------------------------------
getHostedElements_15 = Element.GetHostedElements(element=filterByBoolMask_50.in)
janelas_da_fachada_15 = CodeBlock(janelasexternas=getHostedElements_15)  # same code as janelas_da_fachada
componentes_e_paf_15 = CodeBlock(zona=filterByBoolMask_48.in, a=python_script_15, areaabertura=janelas_da_fachada_15.out5)
# ---------- componentes_e_paf_15.designscript (10 lines) ----------
nome = zona.GetParameterValueByName("Nome");
sa = Math.Sum(a);
PAF = areaabertura/(areaabertura + sa);
cob = "Pvto interm.";
// lista com resultados
"Envoltória";
32;
9;
resultados = List.Flatten([nome,nome,cob,nome,nome,PAF]);
false;
# ----------------------------------------
paredes_externas_16 = CodeBlock(ParedesExt=filterByBoolMask_53.in) { ParedesExternas = List.Flatten(ParedesExt); a = ParedesExternas.GetParameterValueByName("Área"); }
python_script_16 = Python(IN[0]=paredes_externas_16.a)  # CPython3; same code as python_script
dados_qualitativos_pe_direito_e_16 = CodeBlock(a=python_script_16, Paredes=filterByBoolMask_53.in, zona=filterByBoolMask_51.in, superf=byPatch_16)  # "Dados qualitativos, pe direito e area"
# ---------- dados_qualitativos_pe_direito_e_16.designscript (13 lines) ----------
sa = Math.Sum(a);
b = Paredes.GetParameterValueByName("Altura desconectada");
pedireito = Math.Sum(a*b)/sa;
nome = zona.GetParameterValueByName("Nome");
areazona = Autodesk.Surface.Area(superf);
tipozona = "Perimetral";
orienta = "O";
// lista com resultados
"Envoltória";
33;
2;
resultados = List.Flatten([nome,areazona,pedireito,tipozona,orienta]);
false;
# ----------------------------------------
getHostedElements_16 = Element.GetHostedElements(element=filterByBoolMask_53.in)
janelas_da_fachada_16 = CodeBlock(janelasexternas=getHostedElements_16)  # same code as janelas_da_fachada
componentes_e_paf_16 = CodeBlock(zona=filterByBoolMask_51.in, a=python_script_16, areaabertura=janelas_da_fachada_16.out5)
# ---------- componentes_e_paf_16.designscript (10 lines) ----------
nome = zona.GetParameterValueByName("Nome");
sa = Math.Sum(a);
PAF = areaabertura/(areaabertura + sa);
cob = "Pvto interm.";
// lista com resultados
"Envoltória";
33;
9;
resultados = List.Flatten([nome,nome,cob,nome,nome,PAF]);
false;
# ----------------------------------------

# group: Zonas O - Nível 1 > Exporta dados paredes para planilha
# Descrição <Clique duas vezes aqui para editar a descrição do grupo>
exportToExcel_25 = Data.ExportToExcel(filePath=file_path, sheetName=dados_qualitativos_pe_direito_e_13.out7, startRow=dados_qualitativos_pe_direito_e_13.out8, startColumn=dados_qualitativos_pe_direito_e_13.out9, data=dados_qualitativos_pe_direito_e_13.resultados@L3)
exportToExcel_26 = Data.ExportToExcel(filePath=file_path, sheetName=componentes_e_paf_13.out4, startRow=componentes_e_paf_13.out5, startColumn=componentes_e_paf_13.out6, data=componentes_e_paf_13.resultados@L3)

# group: Zonas O - Nível 1 > Exporta dados paredes para planilha
# Descrição <Clique duas vezes aqui para editar a descrição do grupo>
exportToExcel_27 = Data.ExportToExcel(filePath=file_path, sheetName=dados_qualitativos_pe_direito_e_14.out7, startRow=dados_qualitativos_pe_direito_e_14.out8, startColumn=dados_qualitativos_pe_direito_e_14.out9, data=dados_qualitativos_pe_direito_e_14.resultados@L3)
exportToExcel_28 = Data.ExportToExcel(filePath=file_path, sheetName=componentes_e_paf_14.out4, startRow=componentes_e_paf_14.out5, startColumn=componentes_e_paf_14.out6, data=componentes_e_paf_14.resultados@L3)

# group: Zonas O - Nível 1 > Exporta dados paredes para planilha
# Descrição <Clique duas vezes aqui para editar a descrição do grupo>
exportToExcel_29 = Data.ExportToExcel(filePath=file_path, sheetName=dados_qualitativos_pe_direito_e_15.out7, startRow=dados_qualitativos_pe_direito_e_15.out8, startColumn=dados_qualitativos_pe_direito_e_15.out9, data=dados_qualitativos_pe_direito_e_15.resultados@L3)
exportToExcel_30 = Data.ExportToExcel(filePath=file_path, sheetName=componentes_e_paf_15.out4, startRow=componentes_e_paf_15.out5, startColumn=componentes_e_paf_15.out6, data=componentes_e_paf_15.resultados@L3)

# group: Zonas O - Nível 1 > Exporta dados paredes para planilha
# Descrição <Clique duas vezes aqui para editar a descrição do grupo>
exportToExcel_31 = Data.ExportToExcel(filePath=file_path, sheetName=dados_qualitativos_pe_direito_e_16.out7, startRow=dados_qualitativos_pe_direito_e_16.out8, startColumn=dados_qualitativos_pe_direito_e_16.out9, data=dados_qualitativos_pe_direito_e_16.resultados@L3)
exportToExcel_32 = Data.ExportToExcel(filePath=file_path, sheetName=componentes_e_paf_16.out4, startRow=componentes_e_paf_16.out5, startColumn=componentes_e_paf_16.out6, data=componentes_e_paf_16.resultados@L3)

# group: Zonas I - Nível 1 > Seleciona Zona I
# Descrição <Clique duas vezes aqui para editar a descrição do grupo>
filterByBoolMask_54 = List.FilterByBoolMask(list=filterByBoolMask.in, mask=code_block_2.out6)

# group: Zonas I - Nível 1 > Identifica numeração da zona
# Descrição <Clique duas vezes aqui para editar a descrição do grupo>
code_block_39 = CodeBlock(area=filterByBoolMask_54.in)  # same code as code_block_3

# group: Zonas I - Nível 1 > Seleciona Z1
# Descrição <Clique duas vezes aqui para editar a descrição do grupo>
filterByBoolMask_55 = List.FilterByBoolMask(list=filterByBoolMask_54.in, mask=code_block_39.out2)
code_block_40 = CodeBlock(a=filterByBoolMask_55.in) { b = a.Boundaries; List.Flatten(b); }
byJoinedCurves_17 = PolyCurve.ByJoinedCurves(curves=code_block_40.out1)
byPatch_17 = Surface.ByPatch(closedCurve=byJoinedCurves_17)

# group: Zonas I - Nível 1 > Identifica quais paredes estão dentro da Zona N
# Descrição <Clique duas vezes aqui para editar a descrição do grupo>
doesIntersect_17 = Geometry.DoesIntersect(geometry=byPatch_17@L1, other=getLocation)
filterByBoolMask_56 = List.FilterByBoolMask(list=all_elements_of_category@L3, mask=doesIntersect_17)
code_block_41 = CodeBlock(a=filterByBoolMask_56.in) { b = List.Flatten(a); c = List.UniqueItems(b); List.Clean(c); }

# group: Zonas I - Nível 1 > Seleciona paredes externas e internas
# Descrição <Clique duas vezes aqui para editar a descrição do grupo>
identifica_parede_relacionada_e_17 = CodeBlock(paredes=code_block_41.out2) { a = paredes.ElementType; b = a.GetParameterValueByName("Função"); b == 1; }  # "Identifica parede relacionada e se é externa"
filterByBoolMask_57 = List.FilterByBoolMask(list=code_block_41.out2, mask=identifica_parede_relacionada_e_17.out2)

# group: Zonas I - Nível 1 > Seleciona Z2
# Descrição <Clique duas vezes aqui para editar a descrição do grupo>
filterByBoolMask_58 = List.FilterByBoolMask(list=filterByBoolMask_54.in, mask=code_block_39.out3)
code_block_42 = CodeBlock(a=filterByBoolMask_58.in) { b = a.Boundaries; List.Flatten(b); }
byJoinedCurves_18 = PolyCurve.ByJoinedCurves(curves=code_block_42.out1)
byPatch_18 = Surface.ByPatch(closedCurve=byJoinedCurves_18)

# group: Zonas I - Nível 1 > Identifica quais paredes estão dentro da Zona N
# Descrição <Clique duas vezes aqui para editar a descrição do grupo>
doesIntersect_18 = Geometry.DoesIntersect(geometry=byPatch_18@L1, other=getLocation)
filterByBoolMask_59 = List.FilterByBoolMask(list=all_elements_of_category@L3, mask=doesIntersect_18)
code_block_43 = CodeBlock(a=filterByBoolMask_59.in) { b = List.Flatten(a); c = List.UniqueItems(b); List.Clean(c); }

# group: Zonas I - Nível 1 > Seleciona paredes externas e internas
# Descrição <Clique duas vezes aqui para editar a descrição do grupo>
identifica_parede_relacionada_e_18 = CodeBlock(paredes=code_block_43.out2) { a = paredes.ElementType; b = a.GetParameterValueByName("Função"); b == 1; }  # "Identifica parede relacionada e se é externa"
filterByBoolMask_60 = List.FilterByBoolMask(list=code_block_43.out2, mask=identifica_parede_relacionada_e_18.out2)

# group: Zonas I - Nível 1 > Seleciona Z3
# Descrição <Clique duas vezes aqui para editar a descrição do grupo>
filterByBoolMask_61 = List.FilterByBoolMask(list=filterByBoolMask_54.in, mask=code_block_39.out4)
code_block_44 = CodeBlock(a=filterByBoolMask_61.in) { b = a.Boundaries; List.Flatten(b); }
byJoinedCurves_19 = PolyCurve.ByJoinedCurves(curves=code_block_44.out1)
byPatch_19 = Surface.ByPatch(closedCurve=byJoinedCurves_19)

# group: Zonas I - Nível 1 > Identifica quais paredes estão dentro da Zona N
# Descrição <Clique duas vezes aqui para editar a descrição do grupo>
doesIntersect_19 = Geometry.DoesIntersect(geometry=byPatch_19@L1, other=getLocation)
filterByBoolMask_62 = List.FilterByBoolMask(list=all_elements_of_category@L3, mask=doesIntersect_19)
code_block_45 = CodeBlock(a=filterByBoolMask_62.in) { b = List.Flatten(a); c = List.UniqueItems(b); List.Clean(c); }

# group: Zonas I - Nível 1 > Seleciona paredes externas e internas
# Descrição <Clique duas vezes aqui para editar a descrição do grupo>
identifica_parede_relacionada_e_19 = CodeBlock(paredes=code_block_45.out2) { a = paredes.ElementType; b = a.GetParameterValueByName("Função"); b == 1; }  # "Identifica parede relacionada e se é externa"
filterByBoolMask_63 = List.FilterByBoolMask(list=code_block_45.out2, mask=identifica_parede_relacionada_e_19.out2)

# group: Zonas I - Nível 1 > Seleciona Z4
# Descrição <Clique duas vezes aqui para editar a descrição do grupo>
filterByBoolMask_64 = List.FilterByBoolMask(list=filterByBoolMask_54.in, mask=code_block_39.out5)
code_block_46 = CodeBlock(a=filterByBoolMask_64.in) { b = a.Boundaries; List.Flatten(b); }
byJoinedCurves_20 = PolyCurve.ByJoinedCurves(curves=code_block_46.out1)
byPatch_20 = Surface.ByPatch(closedCurve=byJoinedCurves_20)

# group: Zonas I - Nível 1 > Identifica quais paredes estão dentro da Zona N
# Descrição <Clique duas vezes aqui para editar a descrição do grupo>
doesIntersect_20 = Geometry.DoesIntersect(geometry=byPatch_20@L1, other=getLocation)
filterByBoolMask_65 = List.FilterByBoolMask(list=all_elements_of_category@L3, mask=doesIntersect_20)
code_block_47 = CodeBlock(a=filterByBoolMask_65.in) { b = List.Flatten(a); c = List.UniqueItems(b); List.Clean(c); }

# group: Zonas I - Nível 1 > Seleciona paredes externas e internas
# Descrição <Clique duas vezes aqui para editar a descrição do grupo>
identifica_parede_relacionada_e_20 = CodeBlock(paredes=code_block_47.out2) { a = paredes.ElementType; b = a.GetParameterValueByName("Função"); b == 1; }  # "Identifica parede relacionada e se é externa"
filterByBoolMask_66 = List.FilterByBoolMask(list=code_block_47.out2, mask=identifica_parede_relacionada_e_20.out2)

# group: Zonas I - Nível 1
# Descrição <Clique duas vezes aqui para editar a descrição do grupo>
paredes_internas = CodeBlock(ParedesIn=filterByBoolMask_57.out) { ParedesInternas = List.Flatten(ParedesIn); a = ParedesInternas.GetParameterValueByName("Área"); }
python_script_17 = Python(IN[0]=paredes_internas.a)  # CPython3; same code as python_script
dados_qualitativos_pe_direito_e_17 = CodeBlock(a=python_script_17, Paredes=filterByBoolMask_57.out, zona=filterByBoolMask_55.in, superf=byPatch_17)  # "Dados qualitativos, pe direito e area"
# ---------- dados_qualitativos_pe_direito_e_17.designscript (13 lines) ----------
sa = Math.Sum(a);
b = Paredes.GetParameterValueByName("Altura desconectada");
pedireito = Math.Sum(a*b)/sa;
nome = zona.GetParameterValueByName("Nome");
areazona = Autodesk.Surface.Area(superf);
tipozona = "Interna";
orienta = "Interna";
// lista com resultados
"Envoltória";
34;
2;
resultados = List.Flatten([nome,areazona,pedireito,tipozona,orienta]);
false;
# ----------------------------------------
componentes_e_paf_17 = CodeBlock(zona=filterByBoolMask_55.in)
# ---------- componentes_e_paf_17.designscript (9 lines) ----------
nome = zona.GetParameterValueByName("Nome");
cob = "Pvto interm.";
PAF = 0.0;
// lista com resultados
"Envoltória";
34;
9;
resultados = List.Flatten([nome,nome,cob,nome,nome,PAF]);
false;
# ----------------------------------------
paredes_internas_2 = CodeBlock(ParedesIn=filterByBoolMask_60.out) { ParedesInternas = List.Flatten(ParedesIn); a = ParedesInternas.GetParameterValueByName("Área"); }
python_script_18 = Python(IN[0]=paredes_internas_2.a)  # CPython3; same code as python_script
dados_qualitativos_pe_direito_e_18 = CodeBlock(a=python_script_18, Paredes=filterByBoolMask_60.out, zona=filterByBoolMask_58.in, superf=byPatch_18)  # "Dados qualitativos, pe direito e area"
# ---------- dados_qualitativos_pe_direito_e_18.designscript (13 lines) ----------
sa = Math.Sum(a);
b = Paredes.GetParameterValueByName("Altura desconectada");
pedireito = Math.Sum(a*b)/sa;
nome = zona.GetParameterValueByName("Nome");
areazona = Autodesk.Surface.Area(superf);
tipozona = "Interna";
orienta = "Interna";
// lista com resultados
"Envoltória";
35;
2;
resultados = List.Flatten([nome,areazona,pedireito,tipozona,orienta]);
false;
# ----------------------------------------
componentes_e_paf_18 = CodeBlock(zona=filterByBoolMask_58.in)
# ---------- componentes_e_paf_18.designscript (9 lines) ----------
nome = zona.GetParameterValueByName("Nome");
cob = "Pvto interm.";
PAF = 0.0;
// lista com resultados
"Envoltória";
35;
9;
resultados = List.Flatten([nome,nome,cob,nome,nome,PAF]);
false;
# ----------------------------------------
paredes_internas_3 = CodeBlock(ParedesIn=filterByBoolMask_63.out) { ParedesInternas = List.Flatten(ParedesIn); a = ParedesInternas.GetParameterValueByName("Área"); }
python_script_19 = Python(IN[0]=paredes_internas_3.a)  # CPython3; same code as python_script
dados_qualitativos_pe_direito_e_19 = CodeBlock(a=python_script_19, Paredes=filterByBoolMask_63.out, zona=filterByBoolMask_61.in, superf=byPatch_19)  # "Dados qualitativos, pe direito e area"
# ---------- dados_qualitativos_pe_direito_e_19.designscript (13 lines) ----------
sa = Math.Sum(a);
b = Paredes.GetParameterValueByName("Altura desconectada");
pedireito = Math.Sum(a*b)/sa;
nome = zona.GetParameterValueByName("Nome");
areazona = Autodesk.Surface.Area(superf);
tipozona = "Interna";
orienta = "Interna";
// lista com resultados
"Envoltória";
36;
2;
resultados = List.Flatten([nome,areazona,pedireito,tipozona,orienta]);
false;
# ----------------------------------------
componentes_e_paf_19 = CodeBlock(zona=filterByBoolMask_61.in)
# ---------- componentes_e_paf_19.designscript (9 lines) ----------
nome = zona.GetParameterValueByName("Nome");
cob = "Pvto interm.";
PAF = 0.0;
// lista com resultados
"Envoltória";
36;
9;
resultados = List.Flatten([nome,nome,cob,nome,nome,PAF]);
false;
# ----------------------------------------
paredes_internas_4 = CodeBlock(ParedesInt=filterByBoolMask_66.out) { ParedesInternas = List.Flatten(ParedesInt); a = ParedesInternas.GetParameterValueByName("Área"); }
python_script_20 = Python(IN[0]=paredes_internas_4.a)  # CPython3; same code as python_script
dados_qualitativos_pe_direito_e_20 = CodeBlock(a=python_script_20, Paredes=filterByBoolMask_66.out, zona=filterByBoolMask_64.in, superf=byPatch_20)  # "Dados qualitativos, pe direito e area"
# ---------- dados_qualitativos_pe_direito_e_20.designscript (13 lines) ----------
sa = Math.Sum(a);
b = Paredes.GetParameterValueByName("Altura desconectada");
pedireito = Math.Sum(a*b)/sa;
nome = zona.GetParameterValueByName("Nome");
areazona = Autodesk.Surface.Area(superf);
tipozona = "Interna";
orienta = "Interna";
// lista com resultados
"Envoltória";
37;
2;
resultados = List.Flatten([nome,areazona,pedireito,tipozona,orienta]);
false;
# ----------------------------------------
componentes_e_paf_20 = CodeBlock(zona=filterByBoolMask_64.in)
# ---------- componentes_e_paf_20.designscript (9 lines) ----------
nome = zona.GetParameterValueByName("Nome");
cob = "Pvto interm.";
PAF = 0.0;
// lista com resultados
"Envoltória";
37;
9;
resultados = List.Flatten([nome,nome,cob,nome,nome,PAF]);
false;
# ----------------------------------------

# group: Zonas I - Nível 1 > Exporta dados paredes para planilha
# Descrição <Clique duas vezes aqui para editar a descrição do grupo>
exportToExcel_33 = Data.ExportToExcel(filePath=file_path, sheetName=dados_qualitativos_pe_direito_e_17.out7, startRow=dados_qualitativos_pe_direito_e_17.out8, startColumn=dados_qualitativos_pe_direito_e_17.out9, data=dados_qualitativos_pe_direito_e_17.resultados@L3)
exportToExcel_34 = Data.ExportToExcel(filePath=file_path, sheetName=componentes_e_paf_17.out3, startRow=componentes_e_paf_17.out4, startColumn=componentes_e_paf_17.out5, data=componentes_e_paf_17.resultados@L3)

# group: Zonas I - Nível 1 > Exporta dados paredes para planilha
# Descrição <Clique duas vezes aqui para editar a descrição do grupo>
exportToExcel_35 = Data.ExportToExcel(filePath=file_path, sheetName=dados_qualitativos_pe_direito_e_18.out7, startRow=dados_qualitativos_pe_direito_e_18.out8, startColumn=dados_qualitativos_pe_direito_e_18.out9, data=dados_qualitativos_pe_direito_e_18.resultados@L3)
exportToExcel_36 = Data.ExportToExcel(filePath=file_path, sheetName=componentes_e_paf_18.out3, startRow=componentes_e_paf_18.out4, startColumn=componentes_e_paf_18.out5, data=componentes_e_paf_18.resultados@L3)

# group: Zonas I - Nível 1 > Exporta dados paredes para planilha
# Descrição <Clique duas vezes aqui para editar a descrição do grupo>
exportToExcel_37 = Data.ExportToExcel(filePath=file_path, sheetName=dados_qualitativos_pe_direito_e_19.out7, startRow=dados_qualitativos_pe_direito_e_19.out8, startColumn=dados_qualitativos_pe_direito_e_19.out9, data=dados_qualitativos_pe_direito_e_19.resultados@L3)
exportToExcel_38 = Data.ExportToExcel(filePath=file_path, sheetName=componentes_e_paf_19.out3, startRow=componentes_e_paf_19.out4, startColumn=componentes_e_paf_19.out5, data=componentes_e_paf_19.resultados@L3)

# group: Zonas I - Nível 1 > Exporta dados paredes para planilha
# Descrição <Clique duas vezes aqui para editar a descrição do grupo>
exportToExcel_39 = Data.ExportToExcel(filePath=file_path, sheetName=dados_qualitativos_pe_direito_e_20.out7, startRow=dados_qualitativos_pe_direito_e_20.out8, startColumn=dados_qualitativos_pe_direito_e_20.out9, data=dados_qualitativos_pe_direito_e_20.resultados@L3)
exportToExcel_40 = Data.ExportToExcel(filePath=file_path, sheetName=componentes_e_paf_20.out3, startRow=componentes_e_paf_20.out4, startColumn=componentes_e_paf_20.out5, data=componentes_e_paf_20.resultados@L3)

# group: Zonas NE - Nível 1 > Seleciona Zona NE
# Descrição <Clique duas vezes aqui para editar a descrição do grupo>
filterByBoolMask_67 = List.FilterByBoolMask(list=filterByBoolMask.in, mask=code_block_2.out7)

# group: Zonas NE - Nível 1 > Identifica numeração da zona
# Descrição <Clique duas vezes aqui para editar a descrição do grupo>
code_block_48 = CodeBlock(area=filterByBoolMask_67.in)  # same code as code_block_3

# group: Zonas NE - Nível 1 > Seleciona Z1
# Descrição <Clique duas vezes aqui para editar a descrição do grupo>
filterByBoolMask_68 = List.FilterByBoolMask(list=filterByBoolMask_67.in, mask=code_block_48.out2)
code_block_49 = CodeBlock(a=filterByBoolMask_68.in) { b = a.Boundaries; List.Flatten(b); }
byJoinedCurves_21 = PolyCurve.ByJoinedCurves(curves=code_block_49.out1)
byPatch_21 = Surface.ByPatch(closedCurve=byJoinedCurves_21)

# group: Zonas NE - Nível 1 > Identifica quais paredes estão dentro da Zona N
# Descrição <Clique duas vezes aqui para editar a descrição do grupo>
doesIntersect_21 = Geometry.DoesIntersect(geometry=byPatch_21@L1, other=getLocation)
filterByBoolMask_69 = List.FilterByBoolMask(list=all_elements_of_category@L3, mask=doesIntersect_21)
code_block_50 = CodeBlock(a=filterByBoolMask_69.in) { b = List.Flatten(a); c = List.UniqueItems(b); List.Clean(c); }

# group: Zonas NE - Nível 1 > Seleciona paredes externas e internas
# Descrição <Clique duas vezes aqui para editar a descrição do grupo>
identifica_parede_relacionada_e_21 = CodeBlock(paredes=code_block_50.out2) { a = paredes.ElementType; b = a.GetParameterValueByName("Função"); b == 1; }  # "Identifica parede relacionada e se é externa"
filterByBoolMask_70 = List.FilterByBoolMask(list=code_block_50.out2, mask=identifica_parede_relacionada_e_21.out2)

# group: Zonas NE - Nível 1 > Seleciona Z2
# Descrição <Clique duas vezes aqui para editar a descrição do grupo>
filterByBoolMask_71 = List.FilterByBoolMask(list=filterByBoolMask_67.in, mask=code_block_48.out3)
code_block_51 = CodeBlock(a=filterByBoolMask_71.in) { b = a.Boundaries; List.Flatten(b); }
byJoinedCurves_22 = PolyCurve.ByJoinedCurves(curves=code_block_51.out1)
byPatch_22 = Surface.ByPatch(closedCurve=byJoinedCurves_22)

# group: Zonas NE - Nível 1 > Identifica quais paredes estão dentro da Zona N
# Descrição <Clique duas vezes aqui para editar a descrição do grupo>
doesIntersect_22 = Geometry.DoesIntersect(geometry=byPatch_22@L1, other=getLocation)
filterByBoolMask_72 = List.FilterByBoolMask(list=all_elements_of_category@L3, mask=doesIntersect_22)
code_block_52 = CodeBlock(a=filterByBoolMask_72.in) { b = List.Flatten(a); c = List.UniqueItems(b); List.Clean(c); }

# group: Zonas NE - Nível 1 > Seleciona paredes externas e internas
# Descrição <Clique duas vezes aqui para editar a descrição do grupo>
identifica_parede_relacionada_e_22 = CodeBlock(paredes=code_block_52.out2) { a = paredes.ElementType; b = a.GetParameterValueByName("Função"); b == 1; }  # "Identifica parede relacionada e se é externa"
filterByBoolMask_73 = List.FilterByBoolMask(list=code_block_52.out2, mask=identifica_parede_relacionada_e_22.out2)

# group: Zonas NE - Nível 1 > Seleciona Z3
# Descrição <Clique duas vezes aqui para editar a descrição do grupo>
filterByBoolMask_74 = List.FilterByBoolMask(list=filterByBoolMask_67.in, mask=code_block_48.out4)
code_block_53 = CodeBlock(a=filterByBoolMask_74.in) { b = a.Boundaries; List.Flatten(b); }
byJoinedCurves_23 = PolyCurve.ByJoinedCurves(curves=code_block_53.out1)
byPatch_23 = Surface.ByPatch(closedCurve=byJoinedCurves_23)

# group: Zonas NE - Nível 1 > Identifica quais paredes estão dentro da Zona N
# Descrição <Clique duas vezes aqui para editar a descrição do grupo>
doesIntersect_23 = Geometry.DoesIntersect(geometry=byPatch_23@L1, other=getLocation)
filterByBoolMask_75 = List.FilterByBoolMask(list=all_elements_of_category@L3, mask=doesIntersect_23)
code_block_54 = CodeBlock(a=filterByBoolMask_75.in) { b = List.Flatten(a); c = List.UniqueItems(b); List.Clean(c); }

# group: Zonas NE - Nível 1 > Seleciona paredes externas e internas
# Descrição <Clique duas vezes aqui para editar a descrição do grupo>
identifica_parede_relacionada_e_23 = CodeBlock(paredes=code_block_54.out2) { a = paredes.ElementType; b = a.GetParameterValueByName("Função"); b == 1; }  # "Identifica parede relacionada e se é externa"
filterByBoolMask_76 = List.FilterByBoolMask(list=code_block_54.out2, mask=identifica_parede_relacionada_e_23.out2)

# group: Zonas NE - Nível 1 > Seleciona Z4
# Descrição <Clique duas vezes aqui para editar a descrição do grupo>
filterByBoolMask_77 = List.FilterByBoolMask(list=filterByBoolMask_67.in, mask=code_block_48.out5)
code_block_55 = CodeBlock(a=filterByBoolMask_77.in) { b = a.Boundaries; List.Flatten(b); }
byJoinedCurves_24 = PolyCurve.ByJoinedCurves(curves=code_block_55.out1)
byPatch_24 = Surface.ByPatch(closedCurve=byJoinedCurves_24)

# group: Zonas NE - Nível 1 > Identifica quais paredes estão dentro da Zona N
# Descrição <Clique duas vezes aqui para editar a descrição do grupo>
doesIntersect_24 = Geometry.DoesIntersect(geometry=byPatch_24@L1, other=getLocation)
filterByBoolMask_78 = List.FilterByBoolMask(list=all_elements_of_category@L3, mask=doesIntersect_24)
code_block_56 = CodeBlock(a=filterByBoolMask_78.in) { b = List.Flatten(a); c = List.UniqueItems(b); List.Clean(c); }

# group: Zonas NE - Nível 1 > Seleciona paredes externas e internas
# Descrição <Clique duas vezes aqui para editar a descrição do grupo>
identifica_parede_relacionada_e_24 = CodeBlock(paredes=code_block_56.out2) { a = paredes.ElementType; b = a.GetParameterValueByName("Função"); b == 1; }  # "Identifica parede relacionada e se é externa"
filterByBoolMask_79 = List.FilterByBoolMask(list=code_block_56.out2, mask=identifica_parede_relacionada_e_24.out2)

# group: Zonas NE - Nível 1
# Descrição <Clique duas vezes aqui para editar a descrição do grupo>
paredes_externas_17 = CodeBlock(ParedesExt=filterByBoolMask_70.in) { ParedesExternas = List.Flatten(ParedesExt); a = ParedesExternas.GetParameterValueByName("Área"); }
python_script_21 = Python(IN[0]=paredes_externas_17.a)  # CPython3; same code as python_script
dados_qualitativos_pe_direito_e_21 = CodeBlock(a=python_script_21, Paredes=filterByBoolMask_70.in, zona=filterByBoolMask_68.in, superf=byPatch_21)  # "Dados qualitativos, pe direito e area"
# ---------- dados_qualitativos_pe_direito_e_21.designscript (13 lines) ----------
sa = Math.Sum(a);
b = Paredes.GetParameterValueByName("Altura desconectada");
pedireito = Math.Sum(a*b)/sa;
nome = zona.GetParameterValueByName("Nome");
areazona = Autodesk.Surface.Area(superf);
tipozona = "Perimetral";
orienta = "NE";
// lista com resultados
"Envoltória";
38;
2;
resultados = List.Flatten([nome,areazona,pedireito,tipozona,orienta]);
false;
# ----------------------------------------
getHostedElements_17 = Element.GetHostedElements(element=filterByBoolMask_70.in)
janelas_da_fachada_17 = CodeBlock(janelasexternas=getHostedElements_17)  # same code as janelas_da_fachada
componentes_e_paf_21 = CodeBlock(zona=filterByBoolMask_68.in, a=python_script_21, areaabertura=janelas_da_fachada_17.out5)
# ---------- componentes_e_paf_21.designscript (10 lines) ----------
nome = zona.GetParameterValueByName("Nome");
sa = Math.Sum(a);
PAF = areaabertura/(areaabertura + sa);
cob = "Pvto interm.";
// lista com resultados
"Envoltória";
38;
9;
resultados = List.Flatten([nome,nome,cob,nome,nome,PAF]);
false;
# ----------------------------------------
paredes_externas_18 = CodeBlock(ParedesExt=filterByBoolMask_73.in) { ParedesExternas = List.Flatten(ParedesExt); a = ParedesExternas.GetParameterValueByName("Área"); }
python_script_22 = Python(IN[0]=paredes_externas_18.a)  # CPython3; same code as python_script
dados_qualitativos_pe_direito_e_22 = CodeBlock(a=python_script_22, Paredes=filterByBoolMask_73.in, zona=filterByBoolMask_71.in, superf=byPatch_22)  # "Dados qualitativos, pe direito e area"
# ---------- dados_qualitativos_pe_direito_e_22.designscript (13 lines) ----------
sa = Math.Sum(a);
b = Paredes.GetParameterValueByName("Altura desconectada");
pedireito = Math.Sum(a*b)/sa;
nome = zona.GetParameterValueByName("Nome");
areazona = Autodesk.Surface.Area(superf);
tipozona = "Perimetral";
orienta = "NE";
// lista com resultados
"Envoltória";
39;
2;
resultados = List.Flatten([nome,areazona,pedireito,tipozona,orienta]);
false;
# ----------------------------------------
getHostedElements_18 = Element.GetHostedElements(element=filterByBoolMask_73.in)
janelas_da_fachada_18 = CodeBlock(janelasexternas=getHostedElements_18)  # same code as janelas_da_fachada
componentes_e_paf_22 = CodeBlock(zona=filterByBoolMask_71.in, a=python_script_22, areaabertura=janelas_da_fachada_18.out5)
# ---------- componentes_e_paf_22.designscript (10 lines) ----------
nome = zona.GetParameterValueByName("Nome");
sa = Math.Sum(a);
PAF = areaabertura/(areaabertura + sa);
cob = "Pvto interm.";
// lista com resultados
"Envoltória";
39;
9;
resultados = List.Flatten([nome,nome,cob,nome,nome,PAF]);
false;
# ----------------------------------------
paredes_externas_19 = CodeBlock(ParedesExt=filterByBoolMask_76.in) { ParedesExternas = List.Flatten(ParedesExt); a = ParedesExternas.GetParameterValueByName("Área"); }
python_script_23 = Python(IN[0]=paredes_externas_19.a)  # CPython3; same code as python_script
dados_qualitativos_pe_direito_e_23 = CodeBlock(a=python_script_23, Paredes=filterByBoolMask_76.in, zona=filterByBoolMask_74.in, superf=byPatch_23)  # "Dados qualitativos, pe direito e area"
# ---------- dados_qualitativos_pe_direito_e_23.designscript (13 lines) ----------
sa = Math.Sum(a);
b = Paredes.GetParameterValueByName("Altura desconectada");
pedireito = Math.Sum(a*b)/sa;
nome = zona.GetParameterValueByName("Nome");
areazona = Autodesk.Surface.Area(superf);
tipozona = "Perimetral";
orienta = "NE";
// lista com resultados
"Envoltória";
40;
2;
resultados = List.Flatten([nome,areazona,pedireito,tipozona,orienta]);
false;
# ----------------------------------------
getHostedElements_19 = Element.GetHostedElements(element=filterByBoolMask_76.in)
janelas_da_fachada_19 = CodeBlock(janelasexternas=getHostedElements_19)  # same code as janelas_da_fachada
componentes_e_paf_23 = CodeBlock(zona=filterByBoolMask_74.in, a=python_script_23, areaabertura=janelas_da_fachada_19.out5)
# ---------- componentes_e_paf_23.designscript (10 lines) ----------
nome = zona.GetParameterValueByName("Nome");
sa = Math.Sum(a);
PAF = areaabertura/(areaabertura + sa);
cob = "Pvto interm.";
// lista com resultados
"Envoltória";
40;
9;
resultados = List.Flatten([nome,nome,cob,nome,nome,PAF]);
false;
# ----------------------------------------
paredes_externas_20 = CodeBlock(ParedesExt=filterByBoolMask_79.in) { ParedesExternas = List.Flatten(ParedesExt); a = ParedesExternas.GetParameterValueByName("Área"); }
python_script_24 = Python(IN[0]=paredes_externas_20.a)  # CPython3; same code as python_script
dados_qualitativos_pe_direito_e_24 = CodeBlock(a=python_script_24, Paredes=filterByBoolMask_79.in, zona=filterByBoolMask_77.in, superf=byPatch_24)  # "Dados qualitativos, pe direito e area"
# ---------- dados_qualitativos_pe_direito_e_24.designscript (13 lines) ----------
sa = Math.Sum(a);
b = Paredes.GetParameterValueByName("Altura desconectada");
pedireito = Math.Sum(a*b)/sa;
nome = zona.GetParameterValueByName("Nome");
areazona = Autodesk.Surface.Area(superf);
tipozona = "Perimetral";
orienta = "NE";
// lista com resultados
"Envoltória";
41;
2;
resultados = List.Flatten([nome,areazona,pedireito,tipozona,orienta]);
false;
# ----------------------------------------
getHostedElements_20 = Element.GetHostedElements(element=filterByBoolMask_79.in)
janelas_da_fachada_20 = CodeBlock(janelasexternas=getHostedElements_20)  # same code as janelas_da_fachada
componentes_e_paf_24 = CodeBlock(zona=filterByBoolMask_77.in, a=python_script_24, areaabertura=janelas_da_fachada_20.out5)
# ---------- componentes_e_paf_24.designscript (10 lines) ----------
nome = zona.GetParameterValueByName("Nome");
sa = Math.Sum(a);
PAF = areaabertura/(areaabertura + sa);
cob = "Pvto interm.";
// lista com resultados
"Envoltória";
41;
9;
resultados = List.Flatten([nome,nome,cob,nome,nome,PAF]);
false;
# ----------------------------------------

# group: Zonas NE - Nível 1 > Exporta dados paredes para planilha
# Descrição <Clique duas vezes aqui para editar a descrição do grupo>
exportToExcel_41 = Data.ExportToExcel(filePath=file_path, sheetName=dados_qualitativos_pe_direito_e_21.out7, startRow=dados_qualitativos_pe_direito_e_21.out8, startColumn=dados_qualitativos_pe_direito_e_21.out9, data=dados_qualitativos_pe_direito_e_21.resultados@L3)
exportToExcel_42 = Data.ExportToExcel(filePath=file_path, sheetName=componentes_e_paf_21.out4, startRow=componentes_e_paf_21.out5, startColumn=componentes_e_paf_21.out6, data=componentes_e_paf_21.resultados@L3)

# group: Zonas NE - Nível 1 > Exporta dados paredes para planilha
# Descrição <Clique duas vezes aqui para editar a descrição do grupo>
exportToExcel_43 = Data.ExportToExcel(filePath=file_path, sheetName=dados_qualitativos_pe_direito_e_22.out7, startRow=dados_qualitativos_pe_direito_e_22.out8, startColumn=dados_qualitativos_pe_direito_e_22.out9, data=dados_qualitativos_pe_direito_e_22.resultados@L3)
exportToExcel_44 = Data.ExportToExcel(filePath=file_path, sheetName=componentes_e_paf_22.out4, startRow=componentes_e_paf_22.out5, startColumn=componentes_e_paf_22.out6, data=componentes_e_paf_22.resultados@L3)

# group: Zonas NE - Nível 1 > Exporta dados paredes para planilha
# Descrição <Clique duas vezes aqui para editar a descrição do grupo>
exportToExcel_45 = Data.ExportToExcel(filePath=file_path, sheetName=dados_qualitativos_pe_direito_e_23.out7, startRow=dados_qualitativos_pe_direito_e_23.out8, startColumn=dados_qualitativos_pe_direito_e_23.out9, data=dados_qualitativos_pe_direito_e_23.resultados@L3)
exportToExcel_46 = Data.ExportToExcel(filePath=file_path, sheetName=componentes_e_paf_23.out4, startRow=componentes_e_paf_23.out5, startColumn=componentes_e_paf_23.out6, data=componentes_e_paf_23.resultados@L3)

# group: Zonas NE - Nível 1 > Exporta dados paredes para planilha
# Descrição <Clique duas vezes aqui para editar a descrição do grupo>
exportToExcel_47 = Data.ExportToExcel(filePath=file_path, sheetName=dados_qualitativos_pe_direito_e_24.out7, startRow=dados_qualitativos_pe_direito_e_24.out8, startColumn=dados_qualitativos_pe_direito_e_24.out9, data=dados_qualitativos_pe_direito_e_24.resultados@L3)
exportToExcel_48 = Data.ExportToExcel(filePath=file_path, sheetName=componentes_e_paf_24.out4, startRow=componentes_e_paf_24.out5, startColumn=componentes_e_paf_24.out6, data=componentes_e_paf_24.resultados@L3)

# group: Zonas NO - Nível 1 > Seleciona Zona NO
# Descrição <Clique duas vezes aqui para editar a descrição do grupo>
filterByBoolMask_80 = List.FilterByBoolMask(list=filterByBoolMask.in, mask=code_block_2.out8)

# group: Zonas NO - Nível 1 > Identifica numeração da zona
# Descrição <Clique duas vezes aqui para editar a descrição do grupo>
code_block_57 = CodeBlock(area=filterByBoolMask_80.in)  # same code as code_block_3

# group: Zonas NO - Nível 1 > Seleciona Z1
# Descrição <Clique duas vezes aqui para editar a descrição do grupo>
filterByBoolMask_81 = List.FilterByBoolMask(list=filterByBoolMask_80.in, mask=code_block_57.out2)
code_block_58 = CodeBlock(a=filterByBoolMask_81.in) { b = a.Boundaries; List.Flatten(b); }
byJoinedCurves_25 = PolyCurve.ByJoinedCurves(curves=code_block_58.out1)
byPatch_25 = Surface.ByPatch(closedCurve=byJoinedCurves_25)

# group: Zonas NO - Nível 1 > Identifica quais paredes estão dentro da Zona N
# Descrição <Clique duas vezes aqui para editar a descrição do grupo>
doesIntersect_25 = Geometry.DoesIntersect(geometry=byPatch_25@L1, other=getLocation)
filterByBoolMask_82 = List.FilterByBoolMask(list=all_elements_of_category@L3, mask=doesIntersect_25)
code_block_59 = CodeBlock(a=filterByBoolMask_82.in) { b = List.Flatten(a); c = List.UniqueItems(b); List.Clean(c); }

# group: Zonas NO - Nível 1 > Seleciona paredes externas e internas
# Descrição <Clique duas vezes aqui para editar a descrição do grupo>
identifica_parede_relacionada_e_25 = CodeBlock(paredes=code_block_59.out2) { a = paredes.ElementType; b = a.GetParameterValueByName("Função"); b == 1; }  # "Identifica parede relacionada e se é externa"
filterByBoolMask_83 = List.FilterByBoolMask(list=code_block_59.out2, mask=identifica_parede_relacionada_e_25.out2)

# group: Zonas NO - Nível 1 > Seleciona Z2
# Descrição <Clique duas vezes aqui para editar a descrição do grupo>
filterByBoolMask_84 = List.FilterByBoolMask(list=filterByBoolMask_80.in, mask=code_block_57.out3)
code_block_60 = CodeBlock(a=filterByBoolMask_84.in) { b = a.Boundaries; List.Flatten(b); }
byJoinedCurves_26 = PolyCurve.ByJoinedCurves(curves=code_block_60.out1)
byPatch_26 = Surface.ByPatch(closedCurve=byJoinedCurves_26)

# group: Zonas NO - Nível 1 > Identifica quais paredes estão dentro da Zona N
# Descrição <Clique duas vezes aqui para editar a descrição do grupo>
doesIntersect_26 = Geometry.DoesIntersect(geometry=byPatch_26@L1, other=getLocation)
filterByBoolMask_85 = List.FilterByBoolMask(list=all_elements_of_category@L3, mask=doesIntersect_26)
code_block_61 = CodeBlock(a=filterByBoolMask_85.in) { b = List.Flatten(a); c = List.UniqueItems(b); List.Clean(c); }

# group: Zonas NO - Nível 1 > Seleciona paredes externas e internas
# Descrição <Clique duas vezes aqui para editar a descrição do grupo>
identifica_parede_relacionada_e_26 = CodeBlock(paredes=code_block_61.out2) { a = paredes.ElementType; b = a.GetParameterValueByName("Função"); b == 1; }  # "Identifica parede relacionada e se é externa"
filterByBoolMask_86 = List.FilterByBoolMask(list=code_block_61.out2, mask=identifica_parede_relacionada_e_26.out2)

# group: Zonas NO - Nível 1 > Seleciona Z3
# Descrição <Clique duas vezes aqui para editar a descrição do grupo>
filterByBoolMask_87 = List.FilterByBoolMask(list=filterByBoolMask_80.in, mask=code_block_57.out4)
code_block_62 = CodeBlock(a=filterByBoolMask_87.in) { b = a.Boundaries; List.Flatten(b); }
byJoinedCurves_27 = PolyCurve.ByJoinedCurves(curves=code_block_62.out1)
byPatch_27 = Surface.ByPatch(closedCurve=byJoinedCurves_27)

# group: Zonas NO - Nível 1 > Identifica quais paredes estão dentro da Zona N
# Descrição <Clique duas vezes aqui para editar a descrição do grupo>
doesIntersect_27 = Geometry.DoesIntersect(geometry=byPatch_27@L1, other=getLocation)
filterByBoolMask_88 = List.FilterByBoolMask(list=all_elements_of_category@L3, mask=doesIntersect_27)
code_block_63 = CodeBlock(a=filterByBoolMask_88.in) { b = List.Flatten(a); c = List.UniqueItems(b); List.Clean(c); }

# group: Zonas NO - Nível 1 > Seleciona paredes externas e internas
# Descrição <Clique duas vezes aqui para editar a descrição do grupo>
identifica_parede_relacionada_e_27 = CodeBlock(paredes=code_block_63.out2) { a = paredes.ElementType; b = a.GetParameterValueByName("Função"); b == 1; }  # "Identifica parede relacionada e se é externa"
filterByBoolMask_89 = List.FilterByBoolMask(list=code_block_63.out2, mask=identifica_parede_relacionada_e_27.out2)

# group: Zonas NO - Nível 1 > Seleciona Z4
# Descrição <Clique duas vezes aqui para editar a descrição do grupo>
filterByBoolMask_90 = List.FilterByBoolMask(list=filterByBoolMask_80.in, mask=code_block_57.out5)
code_block_64 = CodeBlock(a=filterByBoolMask_90.in) { b = a.Boundaries; List.Flatten(b); }
byJoinedCurves_28 = PolyCurve.ByJoinedCurves(curves=code_block_64.out1)
byPatch_28 = Surface.ByPatch(closedCurve=byJoinedCurves_28)

# group: Zonas NO - Nível 1 > Identifica quais paredes estão dentro da Zona N
# Descrição <Clique duas vezes aqui para editar a descrição do grupo>
doesIntersect_28 = Geometry.DoesIntersect(geometry=byPatch_28@L1, other=getLocation)
filterByBoolMask_91 = List.FilterByBoolMask(list=all_elements_of_category@L3, mask=doesIntersect_28)
code_block_65 = CodeBlock(a=filterByBoolMask_91.in) { b = List.Flatten(a); c = List.UniqueItems(b); List.Clean(c); }

# group: Zonas NO - Nível 1 > Seleciona paredes externas e internas
# Descrição <Clique duas vezes aqui para editar a descrição do grupo>
identifica_parede_relacionada_e_28 = CodeBlock(paredes=code_block_65.out2) { a = paredes.ElementType; b = a.GetParameterValueByName("Função"); b == 1; }  # "Identifica parede relacionada e se é externa"
filterByBoolMask_92 = List.FilterByBoolMask(list=code_block_65.out2, mask=identifica_parede_relacionada_e_28.out2)

# group: Zonas NO - Nível 1
# Descrição <Clique duas vezes aqui para editar a descrição do grupo>
paredes_externas_21 = CodeBlock(ParedesExt=filterByBoolMask_83.in) { ParedesExternas = List.Flatten(ParedesExt); a = ParedesExternas.GetParameterValueByName("Área"); }
python_script_25 = Python(IN[0]=paredes_externas_21.a)  # CPython3; same code as python_script
dados_qualitativos_pe_direito_e_25 = CodeBlock(a=python_script_25, Paredes=filterByBoolMask_83.in, zona=filterByBoolMask_81.in, superf=byPatch_25)  # "Dados qualitativos, pe direito e area"
# ---------- dados_qualitativos_pe_direito_e_25.designscript (13 lines) ----------
sa = Math.Sum(a);
b = Paredes.GetParameterValueByName("Altura desconectada");
pedireito = Math.Sum(a*b)/sa;
nome = zona.GetParameterValueByName("Nome");
areazona = Autodesk.Surface.Area(superf);
tipozona = "Perimetral";
orienta = "NO";
// lista com resultados
"Envoltória";
42;
2;
resultados = List.Flatten([nome,areazona,pedireito,tipozona,orienta]);
false;
# ----------------------------------------
getHostedElements_21 = Element.GetHostedElements(element=filterByBoolMask_83.in)
janelas_da_fachada_21 = CodeBlock(janelasexternas=getHostedElements_21)  # same code as janelas_da_fachada
componentes_e_paf_25 = CodeBlock(zona=filterByBoolMask_81.in, a=python_script_25, areaabertura=janelas_da_fachada_21.out5)
# ---------- componentes_e_paf_25.designscript (10 lines) ----------
nome = zona.GetParameterValueByName("Nome");
sa = Math.Sum(a);
PAF = areaabertura/(areaabertura + sa);
cob = "Pvto interm.";
// lista com resultados
"Envoltória";
42;
9;
resultados = List.Flatten([nome,nome,cob,nome,nome,PAF]);
false;
# ----------------------------------------
paredes_externas_22 = CodeBlock(ParedesExt=filterByBoolMask_86.in) { ParedesExternas = List.Flatten(ParedesExt); a = ParedesExternas.GetParameterValueByName("Área"); }
python_script_26 = Python(IN[0]=paredes_externas_22.a)  # CPython3; same code as python_script
dados_qualitativos_pe_direito_e_26 = CodeBlock(a=python_script_26, Paredes=filterByBoolMask_86.in, zona=filterByBoolMask_84.in, superf=byPatch_26)  # "Dados qualitativos, pe direito e area"
# ---------- dados_qualitativos_pe_direito_e_26.designscript (13 lines) ----------
sa = Math.Sum(a);
b = Paredes.GetParameterValueByName("Altura desconectada");
pedireito = Math.Sum(a*b)/sa;
nome = zona.GetParameterValueByName("Nome");
areazona = Autodesk.Surface.Area(superf);
tipozona = "Perimetral";
orienta = "NO";
// lista com resultados
"Envoltória";
43;
2;
resultados = List.Flatten([nome,areazona,pedireito,tipozona,orienta]);
false;
# ----------------------------------------
getHostedElements_22 = Element.GetHostedElements(element=filterByBoolMask_86.in)
janelas_da_fachada_22 = CodeBlock(janelasexternas=getHostedElements_22)  # same code as janelas_da_fachada
componentes_e_paf_26 = CodeBlock(zona=filterByBoolMask_84.in, a=python_script_26, areaabertura=janelas_da_fachada_22.out5)
# ---------- componentes_e_paf_26.designscript (10 lines) ----------
nome = zona.GetParameterValueByName("Nome");
sa = Math.Sum(a);
PAF = areaabertura/(areaabertura + sa);
cob = "Pvto interm.";
// lista com resultados
"Envoltória";
43;
9;
resultados = List.Flatten([nome,nome,cob,nome,nome,PAF]);
false;
# ----------------------------------------
paredes_externas_23 = CodeBlock(ParedesExt=filterByBoolMask_89.in) { ParedesExternas = List.Flatten(ParedesExt); a = ParedesExternas.GetParameterValueByName("Área"); }
python_script_27 = Python(IN[0]=paredes_externas_23.a)  # CPython3; same code as python_script
dados_qualitativos_pe_direito_e_27 = CodeBlock(a=python_script_27, Paredes=filterByBoolMask_89.in, zona=filterByBoolMask_87.in, superf=byPatch_27)  # "Dados qualitativos, pe direito e area"
# ---------- dados_qualitativos_pe_direito_e_27.designscript (13 lines) ----------
sa = Math.Sum(a);
b = Paredes.GetParameterValueByName("Altura desconectada");
pedireito = Math.Sum(a*b)/sa;
nome = zona.GetParameterValueByName("Nome");
areazona = Autodesk.Surface.Area(superf);
tipozona = "Perimetral";
orienta = "NO";
// lista com resultados
"Envoltória";
44;
2;
resultados = List.Flatten([nome,areazona,pedireito,tipozona,orienta]);
false;
# ----------------------------------------
getHostedElements_23 = Element.GetHostedElements(element=filterByBoolMask_89.in)
janelas_da_fachada_23 = CodeBlock(janelasexternas=getHostedElements_23)  # same code as janelas_da_fachada
componentes_e_paf_27 = CodeBlock(zona=filterByBoolMask_87.in, a=python_script_27, areaabertura=janelas_da_fachada_23.out5)
# ---------- componentes_e_paf_27.designscript (10 lines) ----------
nome = zona.GetParameterValueByName("Nome");
sa = Math.Sum(a);
PAF = areaabertura/(areaabertura + sa);
cob = "Pvto interm.";
// lista com resultados
"Envoltória";
44;
9;
resultados = List.Flatten([nome,nome,cob,nome,nome,PAF]);
false;
# ----------------------------------------
paredes_externas_24 = CodeBlock(ParedesExt=filterByBoolMask_92.in) { ParedesExternas = List.Flatten(ParedesExt); a = ParedesExternas.GetParameterValueByName("Área"); }
python_script_28 = Python(IN[0]=paredes_externas_24.a)  # CPython3; same code as python_script
dados_qualitativos_pe_direito_e_28 = CodeBlock(a=python_script_28, Paredes=filterByBoolMask_92.in, zona=filterByBoolMask_90.in, superf=byPatch_28)  # "Dados qualitativos, pe direito e area"
# ---------- dados_qualitativos_pe_direito_e_28.designscript (13 lines) ----------
sa = Math.Sum(a);
b = Paredes.GetParameterValueByName("Altura desconectada");
pedireito = Math.Sum(a*b)/sa;
nome = zona.GetParameterValueByName("Nome");
areazona = Autodesk.Surface.Area(superf);
tipozona = "Perimetral";
orienta = "NO";
// lista com resultados
"Envoltória";
45;
2;
resultados = List.Flatten([nome,areazona,pedireito,tipozona,orienta]);
false;
# ----------------------------------------
getHostedElements_24 = Element.GetHostedElements(element=filterByBoolMask_92.in)
janelas_da_fachada_24 = CodeBlock(janelasexternas=getHostedElements_24)  # same code as janelas_da_fachada
componentes_e_paf_28 = CodeBlock(zona=filterByBoolMask_90.in, a=python_script_28, areaabertura=janelas_da_fachada_24.out5)
# ---------- componentes_e_paf_28.designscript (10 lines) ----------
nome = zona.GetParameterValueByName("Nome");
sa = Math.Sum(a);
PAF = areaabertura/(areaabertura + sa);
cob = "Pvto interm.";
// lista com resultados
"Envoltória";
45;
9;
resultados = List.Flatten([nome,nome,cob,nome,nome,PAF]);
false;
# ----------------------------------------

# group: Zonas NO - Nível 1 > Exporta dados paredes para planilha
# Descrição <Clique duas vezes aqui para editar a descrição do grupo>
exportToExcel_49 = Data.ExportToExcel(filePath=file_path, sheetName=dados_qualitativos_pe_direito_e_25.out7, startRow=dados_qualitativos_pe_direito_e_25.out8, startColumn=dados_qualitativos_pe_direito_e_25.out9, data=dados_qualitativos_pe_direito_e_25.resultados@L3)
exportToExcel_50 = Data.ExportToExcel(filePath=file_path, sheetName=componentes_e_paf_25.out4, startRow=componentes_e_paf_25.out5, startColumn=componentes_e_paf_25.out6, data=componentes_e_paf_25.resultados@L3)

# group: Zonas NO - Nível 1 > Exporta dados paredes para planilha
# Descrição <Clique duas vezes aqui para editar a descrição do grupo>
exportToExcel_51 = Data.ExportToExcel(filePath=file_path, sheetName=dados_qualitativos_pe_direito_e_26.out7, startRow=dados_qualitativos_pe_direito_e_26.out8, startColumn=dados_qualitativos_pe_direito_e_26.out9, data=dados_qualitativos_pe_direito_e_26.resultados@L3)
exportToExcel_52 = Data.ExportToExcel(filePath=file_path, sheetName=componentes_e_paf_26.out4, startRow=componentes_e_paf_26.out5, startColumn=componentes_e_paf_26.out6, data=componentes_e_paf_26.resultados@L3)

# group: Zonas NO - Nível 1 > Exporta dados paredes para planilha
# Descrição <Clique duas vezes aqui para editar a descrição do grupo>
exportToExcel_53 = Data.ExportToExcel(filePath=file_path, sheetName=dados_qualitativos_pe_direito_e_27.out7, startRow=dados_qualitativos_pe_direito_e_27.out8, startColumn=dados_qualitativos_pe_direito_e_27.out9, data=dados_qualitativos_pe_direito_e_27.resultados@L3)
exportToExcel_54 = Data.ExportToExcel(filePath=file_path, sheetName=componentes_e_paf_27.out4, startRow=componentes_e_paf_27.out5, startColumn=componentes_e_paf_27.out6, data=componentes_e_paf_27.resultados@L3)

# group: Zonas NO - Nível 1 > Exporta dados paredes para planilha
# Descrição <Clique duas vezes aqui para editar a descrição do grupo>
exportToExcel_55 = Data.ExportToExcel(filePath=file_path, sheetName=dados_qualitativos_pe_direito_e_28.out7, startRow=dados_qualitativos_pe_direito_e_28.out8, startColumn=dados_qualitativos_pe_direito_e_28.out9, data=dados_qualitativos_pe_direito_e_28.resultados@L3)
exportToExcel_56 = Data.ExportToExcel(filePath=file_path, sheetName=componentes_e_paf_28.out4, startRow=componentes_e_paf_28.out5, startColumn=componentes_e_paf_28.out6, data=componentes_e_paf_28.resultados@L3)

# group: Zonas SE - Nível 1 > Seleciona Zona SE
# Descrição <Clique duas vezes aqui para editar a descrição do grupo>
filterByBoolMask_93 = List.FilterByBoolMask(list=filterByBoolMask.in, mask=code_block_2.out9)

# group: Zonas SE - Nível 1 > Identifica numeração da zona
# Descrição <Clique duas vezes aqui para editar a descrição do grupo>
code_block_66 = CodeBlock(area=filterByBoolMask_93.in)  # same code as code_block_3

# group: Zonas SE - Nível 1 > Seleciona Z1
# Descrição <Clique duas vezes aqui para editar a descrição do grupo>
filterByBoolMask_94 = List.FilterByBoolMask(list=filterByBoolMask_93.in, mask=code_block_66.out2)
code_block_67 = CodeBlock(a=filterByBoolMask_94.in) { b = a.Boundaries; List.Flatten(b); }
byJoinedCurves_29 = PolyCurve.ByJoinedCurves(curves=code_block_67.out1)
byPatch_29 = Surface.ByPatch(closedCurve=byJoinedCurves_29)

# group: Zonas SE - Nível 1 > Identifica quais paredes estão dentro da Zona N
# Descrição <Clique duas vezes aqui para editar a descrição do grupo>
doesIntersect_29 = Geometry.DoesIntersect(geometry=byPatch_29@L1, other=getLocation)
filterByBoolMask_95 = List.FilterByBoolMask(list=all_elements_of_category@L3, mask=doesIntersect_29)
code_block_68 = CodeBlock(a=filterByBoolMask_95.in) { b = List.Flatten(a); c = List.UniqueItems(b); List.Clean(c); }

# group: Zonas SE - Nível 1 > Seleciona paredes externas e internas
# Descrição <Clique duas vezes aqui para editar a descrição do grupo>
identifica_parede_relacionada_e_29 = CodeBlock(paredes=code_block_68.out2) { a = paredes.ElementType; b = a.GetParameterValueByName("Função"); b == 1; }  # "Identifica parede relacionada e se é externa"
filterByBoolMask_96 = List.FilterByBoolMask(list=code_block_68.out2, mask=identifica_parede_relacionada_e_29.out2)

# group: Zonas SE - Nível 1 > Seleciona Z2
# Descrição <Clique duas vezes aqui para editar a descrição do grupo>
filterByBoolMask_97 = List.FilterByBoolMask(list=filterByBoolMask_93.in, mask=code_block_66.out3)
code_block_69 = CodeBlock(a=filterByBoolMask_97.in) { b = a.Boundaries; List.Flatten(b); }
byJoinedCurves_30 = PolyCurve.ByJoinedCurves(curves=code_block_69.out1)
byPatch_30 = Surface.ByPatch(closedCurve=byJoinedCurves_30)

# group: Zonas SE - Nível 1 > Identifica quais paredes estão dentro da Zona N
# Descrição <Clique duas vezes aqui para editar a descrição do grupo>
doesIntersect_30 = Geometry.DoesIntersect(geometry=byPatch_30@L1, other=getLocation)
filterByBoolMask_98 = List.FilterByBoolMask(list=all_elements_of_category@L3, mask=doesIntersect_30)
code_block_70 = CodeBlock(a=filterByBoolMask_98.in) { b = List.Flatten(a); c = List.UniqueItems(b); List.Clean(c); }

# group: Zonas SE - Nível 1 > Seleciona paredes externas e internas
# Descrição <Clique duas vezes aqui para editar a descrição do grupo>
identifica_parede_relacionada_e_30 = CodeBlock(paredes=code_block_70.out2) { a = paredes.ElementType; b = a.GetParameterValueByName("Função"); b == 1; }  # "Identifica parede relacionada e se é externa"
filterByBoolMask_99 = List.FilterByBoolMask(list=code_block_70.out2, mask=identifica_parede_relacionada_e_30.out2)

# group: Zonas SE - Nível 1 > Seleciona Z3
# Descrição <Clique duas vezes aqui para editar a descrição do grupo>
filterByBoolMask_100 = List.FilterByBoolMask(list=filterByBoolMask_93.in, mask=code_block_66.out4)
code_block_71 = CodeBlock(a=filterByBoolMask_100.in) { b = a.Boundaries; List.Flatten(b); }
byJoinedCurves_31 = PolyCurve.ByJoinedCurves(curves=code_block_71.out1)
byPatch_31 = Surface.ByPatch(closedCurve=byJoinedCurves_31)

# group: Zonas SE - Nível 1 > Identifica quais paredes estão dentro da Zona N
# Descrição <Clique duas vezes aqui para editar a descrição do grupo>
doesIntersect_31 = Geometry.DoesIntersect(geometry=byPatch_31@L1, other=getLocation)
filterByBoolMask_101 = List.FilterByBoolMask(list=all_elements_of_category@L3, mask=doesIntersect_31)
code_block_72 = CodeBlock(a=filterByBoolMask_101.in) { b = List.Flatten(a); c = List.UniqueItems(b); List.Clean(c); }

# group: Zonas SE - Nível 1 > Seleciona paredes externas e internas
# Descrição <Clique duas vezes aqui para editar a descrição do grupo>
identifica_parede_relacionada_e_31 = CodeBlock(paredes=code_block_72.out2) { a = paredes.ElementType; b = a.GetParameterValueByName("Função"); b == 1; }  # "Identifica parede relacionada e se é externa"
filterByBoolMask_102 = List.FilterByBoolMask(list=code_block_72.out2, mask=identifica_parede_relacionada_e_31.out2)

# group: Zonas SE - Nível 1 > Seleciona Z4
# Descrição <Clique duas vezes aqui para editar a descrição do grupo>
filterByBoolMask_103 = List.FilterByBoolMask(list=filterByBoolMask_93.in, mask=code_block_66.out5)
code_block_73 = CodeBlock(a=filterByBoolMask_103.in) { b = a.Boundaries; List.Flatten(b); }
byJoinedCurves_32 = PolyCurve.ByJoinedCurves(curves=code_block_73.out1)
byPatch_32 = Surface.ByPatch(closedCurve=byJoinedCurves_32)

# group: Zonas SE - Nível 1 > Identifica quais paredes estão dentro da Zona N
# Descrição <Clique duas vezes aqui para editar a descrição do grupo>
doesIntersect_32 = Geometry.DoesIntersect(geometry=byPatch_32@L1, other=getLocation)
filterByBoolMask_104 = List.FilterByBoolMask(list=all_elements_of_category@L3, mask=doesIntersect_32)
code_block_74 = CodeBlock(a=filterByBoolMask_104.in) { b = List.Flatten(a); c = List.UniqueItems(b); List.Clean(c); }

# group: Zonas SE - Nível 1 > Seleciona paredes externas e internas
# Descrição <Clique duas vezes aqui para editar a descrição do grupo>
identifica_parede_relacionada_e_32 = CodeBlock(paredes=code_block_74.out2) { a = paredes.ElementType; b = a.GetParameterValueByName("Função"); b == 1; }  # "Identifica parede relacionada e se é externa"
filterByBoolMask_105 = List.FilterByBoolMask(list=code_block_74.out2, mask=identifica_parede_relacionada_e_32.out2)

# group: Zonas SE - Nível 1
# Descrição <Clique duas vezes aqui para editar a descrição do grupo>
paredes_externas_25 = CodeBlock(ParedesExt=filterByBoolMask_96.in) { ParedesExternas = List.Flatten(ParedesExt); a = ParedesExternas.GetParameterValueByName("Área"); }
python_script_29 = Python(IN[0]=paredes_externas_25.a)  # CPython3; same code as python_script
dados_qualitativos_pe_direito_e_29 = CodeBlock(a=python_script_29, Paredes=filterByBoolMask_96.in, zona=filterByBoolMask_94.in, superf=byPatch_29)  # "Dados qualitativos, pe direito e area"
# ---------- dados_qualitativos_pe_direito_e_29.designscript (13 lines) ----------
sa = Math.Sum(a);
b = Paredes.GetParameterValueByName("Altura desconectada");
pedireito = Math.Sum(a*b)/sa;
nome = zona.GetParameterValueByName("Nome");
areazona = Autodesk.Surface.Area(superf);
tipozona = "Perimetral";
orienta = "SE";
// lista com resultados
"Envoltória";
46;
2;
resultados = List.Flatten([nome,areazona,pedireito,tipozona,orienta]);
false;
# ----------------------------------------
getHostedElements_25 = Element.GetHostedElements(element=filterByBoolMask_96.in)
janelas_da_fachada_25 = CodeBlock(janelasexternas=getHostedElements_25)  # same code as janelas_da_fachada
componentes_e_paf_29 = CodeBlock(zona=filterByBoolMask_94.in, a=python_script_29, areaabertura=janelas_da_fachada_25.out5)
# ---------- componentes_e_paf_29.designscript (10 lines) ----------
nome = zona.GetParameterValueByName("Nome");
sa = Math.Sum(a);
PAF = areaabertura/(areaabertura + sa);
cob = "Pvto interm.";
// lista com resultados
"Envoltória";
46;
9;
resultados = List.Flatten([nome,nome,cob,nome,nome,PAF]);
false;
# ----------------------------------------
paredes_externas_26 = CodeBlock(ParedesExt=filterByBoolMask_99.in) { ParedesExternas = List.Flatten(ParedesExt); a = ParedesExternas.GetParameterValueByName("Área"); }
python_script_30 = Python(IN[0]=paredes_externas_26.a)  # CPython3; same code as python_script
dados_qualitativos_pe_direito_e_30 = CodeBlock(a=python_script_30, Paredes=filterByBoolMask_99.in, zona=filterByBoolMask_97.in, superf=byPatch_30)  # "Dados qualitativos, pe direito e area"
# ---------- dados_qualitativos_pe_direito_e_30.designscript (13 lines) ----------
sa = Math.Sum(a);
b = Paredes.GetParameterValueByName("Altura desconectada");
pedireito = Math.Sum(a*b)/sa;
nome = zona.GetParameterValueByName("Nome");
areazona = Autodesk.Surface.Area(superf);
tipozona = "Perimetral";
orienta = "SE";
// lista com resultados
"Envoltória";
47;
2;
resultados = List.Flatten([nome,areazona,pedireito,tipozona,orienta]);
false;
# ----------------------------------------
getHostedElements_26 = Element.GetHostedElements(element=filterByBoolMask_99.in)
janelas_da_fachada_26 = CodeBlock(janelasexternas=getHostedElements_26)  # same code as janelas_da_fachada
componentes_e_paf_30 = CodeBlock(zona=filterByBoolMask_97.in, a=python_script_30, areaabertura=janelas_da_fachada_26.out5)
# ---------- componentes_e_paf_30.designscript (10 lines) ----------
nome = zona.GetParameterValueByName("Nome");
sa = Math.Sum(a);
PAF = areaabertura/(areaabertura + sa);
cob = "Pvto interm.";
// lista com resultados
"Envoltória";
47;
9;
resultados = List.Flatten([nome,nome,cob,nome,nome,PAF]);
false;
# ----------------------------------------
paredes_externas_27 = CodeBlock(ParedesExt=filterByBoolMask_102.in) { ParedesExternas = List.Flatten(ParedesExt); a = ParedesExternas.GetParameterValueByName("Área"); }
python_script_31 = Python(IN[0]=paredes_externas_27.a)  # CPython3; same code as python_script
dados_qualitativos_pe_direito_e_31 = CodeBlock(a=python_script_31, Paredes=filterByBoolMask_102.in, zona=filterByBoolMask_100.in, superf=byPatch_31)  # "Dados qualitativos, pe direito e area"
# ---------- dados_qualitativos_pe_direito_e_31.designscript (13 lines) ----------
sa = Math.Sum(a);
b = Paredes.GetParameterValueByName("Altura desconectada");
pedireito = Math.Sum(a*b)/sa;
nome = zona.GetParameterValueByName("Nome");
areazona = Autodesk.Surface.Area(superf);
tipozona = "Perimetral";
orienta = "SE";
// lista com resultados
"Envoltória";
48;
2;
resultados = List.Flatten([nome,areazona,pedireito,tipozona,orienta]);
false;
# ----------------------------------------
getHostedElements_27 = Element.GetHostedElements(element=filterByBoolMask_102.in)
janelas_da_fachada_27 = CodeBlock(janelasexternas=getHostedElements_27)  # same code as janelas_da_fachada
componentes_e_paf_31 = CodeBlock(zona=filterByBoolMask_100.in, a=python_script_31, areaabertura=janelas_da_fachada_27.out5)
# ---------- componentes_e_paf_31.designscript (10 lines) ----------
nome = zona.GetParameterValueByName("Nome");
sa = Math.Sum(a);
PAF = areaabertura/(areaabertura + sa);
cob = "Pvto interm.";
// lista com resultados
"Envoltória";
48;
9;
resultados = List.Flatten([nome,nome,cob,nome,nome,PAF]);
false;
# ----------------------------------------
paredes_externas_28 = CodeBlock(ParedesExt=filterByBoolMask_105.in) { ParedesExternas = List.Flatten(ParedesExt); a = ParedesExternas.GetParameterValueByName("Área"); }
python_script_32 = Python(IN[0]=paredes_externas_28.a)  # CPython3; same code as python_script
dados_qualitativos_pe_direito_e_32 = CodeBlock(a=python_script_32, Paredes=filterByBoolMask_105.in, zona=filterByBoolMask_103.in, superf=byPatch_32)  # "Dados qualitativos, pe direito e area"
# ---------- dados_qualitativos_pe_direito_e_32.designscript (13 lines) ----------
sa = Math.Sum(a);
b = Paredes.GetParameterValueByName("Altura desconectada");
pedireito = Math.Sum(a*b)/sa;
nome = zona.GetParameterValueByName("Nome");
areazona = Autodesk.Surface.Area(superf);
tipozona = "Perimetral";
orienta = "SE";
// lista com resultados
"Envoltória";
49;
2;
resultados = List.Flatten([nome,areazona,pedireito,tipozona,orienta]);
false;
# ----------------------------------------
getHostedElements_28 = Element.GetHostedElements(element=filterByBoolMask_105.in)
janelas_da_fachada_28 = CodeBlock(janelasexternas=getHostedElements_28)  # same code as janelas_da_fachada
componentes_e_paf_32 = CodeBlock(zona=filterByBoolMask_103.in, a=python_script_32, areaabertura=janelas_da_fachada_28.out5)
# ---------- componentes_e_paf_32.designscript (10 lines) ----------
nome = zona.GetParameterValueByName("Nome");
sa = Math.Sum(a);
PAF = areaabertura/(areaabertura + sa);
cob = "Pvto interm.";
// lista com resultados
"Envoltória";
49;
9;
resultados = List.Flatten([nome,nome,cob,nome,nome,PAF]);
false;
# ----------------------------------------

# group: Zonas SE - Nível 1 > Exporta dados paredes para planilha
# Descrição <Clique duas vezes aqui para editar a descrição do grupo>
exportToExcel_57 = Data.ExportToExcel(filePath=file_path, sheetName=dados_qualitativos_pe_direito_e_29.out7, startRow=dados_qualitativos_pe_direito_e_29.out8, startColumn=dados_qualitativos_pe_direito_e_29.out9, data=dados_qualitativos_pe_direito_e_29.resultados@L3)
exportToExcel_58 = Data.ExportToExcel(filePath=file_path, sheetName=componentes_e_paf_29.out4, startRow=componentes_e_paf_29.out5, startColumn=componentes_e_paf_29.out6, data=componentes_e_paf_29.resultados@L3)

# group: Zonas SE - Nível 1 > Exporta dados paredes para planilha
# Descrição <Clique duas vezes aqui para editar a descrição do grupo>
exportToExcel_59 = Data.ExportToExcel(filePath=file_path, sheetName=dados_qualitativos_pe_direito_e_30.out7, startRow=dados_qualitativos_pe_direito_e_30.out8, startColumn=dados_qualitativos_pe_direito_e_30.out9, data=dados_qualitativos_pe_direito_e_30.resultados@L3)
exportToExcel_60 = Data.ExportToExcel(filePath=file_path, sheetName=componentes_e_paf_30.out4, startRow=componentes_e_paf_30.out5, startColumn=componentes_e_paf_30.out6, data=componentes_e_paf_30.resultados@L3)

# group: Zonas SE - Nível 1 > Exporta dados paredes para planilha
# Descrição <Clique duas vezes aqui para editar a descrição do grupo>
exportToExcel_61 = Data.ExportToExcel(filePath=file_path, sheetName=dados_qualitativos_pe_direito_e_31.out7, startRow=dados_qualitativos_pe_direito_e_31.out8, startColumn=dados_qualitativos_pe_direito_e_31.out9, data=dados_qualitativos_pe_direito_e_31.resultados@L3)
exportToExcel_62 = Data.ExportToExcel(filePath=file_path, sheetName=componentes_e_paf_31.out4, startRow=componentes_e_paf_31.out5, startColumn=componentes_e_paf_31.out6, data=componentes_e_paf_31.resultados@L3)

# group: Zonas SE - Nível 1 > Exporta dados paredes para planilha
# Descrição <Clique duas vezes aqui para editar a descrição do grupo>
exportToExcel_63 = Data.ExportToExcel(filePath=file_path, sheetName=dados_qualitativos_pe_direito_e_32.out7, startRow=dados_qualitativos_pe_direito_e_32.out8, startColumn=dados_qualitativos_pe_direito_e_32.out9, data=dados_qualitativos_pe_direito_e_32.resultados@L3)
exportToExcel_64 = Data.ExportToExcel(filePath=file_path, sheetName=componentes_e_paf_32.out4, startRow=componentes_e_paf_32.out5, startColumn=componentes_e_paf_32.out6, data=componentes_e_paf_32.resultados@L3)

# group: Zonas SO - Nível 1 > Seleciona Zona SO
# Descrição <Clique duas vezes aqui para editar a descrição do grupo>
filterByBoolMask_106 = List.FilterByBoolMask(list=filterByBoolMask.in, mask=code_block_2.out10)

# group: Zonas SO - Nível 1 > Identifica numeração da zona
# Descrição <Clique duas vezes aqui para editar a descrição do grupo>
code_block_75 = CodeBlock(area=filterByBoolMask_106.in)  # same code as code_block_3

# group: Zonas SO - Nível 1 > Seleciona Z1
# Descrição <Clique duas vezes aqui para editar a descrição do grupo>
filterByBoolMask_107 = List.FilterByBoolMask(list=filterByBoolMask_106.in, mask=code_block_75.out2)
code_block_76 = CodeBlock(a=filterByBoolMask_107.in) { b = a.Boundaries; List.Flatten(b); }
byJoinedCurves_33 = PolyCurve.ByJoinedCurves(curves=code_block_76.out1)
byPatch_33 = Surface.ByPatch(closedCurve=byJoinedCurves_33)

# group: Zonas SO - Nível 1 > Identifica quais paredes estão dentro da Zona N
# Descrição <Clique duas vezes aqui para editar a descrição do grupo>
doesIntersect_33 = Geometry.DoesIntersect(geometry=byPatch_33@L1, other=getLocation)
filterByBoolMask_108 = List.FilterByBoolMask(list=all_elements_of_category@L3, mask=doesIntersect_33)
code_block_77 = CodeBlock(a=filterByBoolMask_108.in) { b = List.Flatten(a); c = List.UniqueItems(b); List.Clean(c); }

# group: Zonas SO - Nível 1 > Seleciona paredes externas e internas
# Descrição <Clique duas vezes aqui para editar a descrição do grupo>
identifica_parede_relacionada_e_33 = CodeBlock(paredes=code_block_77.out2) { a = paredes.ElementType; b = a.GetParameterValueByName("Função"); b == 1; }  # "Identifica parede relacionada e se é externa"
filterByBoolMask_109 = List.FilterByBoolMask(list=code_block_77.out2, mask=identifica_parede_relacionada_e_33.out2)

# group: Zonas SO - Nível 1 > Seleciona Z2
# Descrição <Clique duas vezes aqui para editar a descrição do grupo>
filterByBoolMask_110 = List.FilterByBoolMask(list=filterByBoolMask_106.in, mask=code_block_75.out3)
code_block_78 = CodeBlock(a=filterByBoolMask_110.in) { b = a.Boundaries; List.Flatten(b); }
byJoinedCurves_34 = PolyCurve.ByJoinedCurves(curves=code_block_78.out1)
byPatch_34 = Surface.ByPatch(closedCurve=byJoinedCurves_34)

# group: Zonas SO - Nível 1 > Identifica quais paredes estão dentro da Zona N
# Descrição <Clique duas vezes aqui para editar a descrição do grupo>
doesIntersect_34 = Geometry.DoesIntersect(geometry=byPatch_34@L1, other=getLocation)
filterByBoolMask_111 = List.FilterByBoolMask(list=all_elements_of_category@L3, mask=doesIntersect_34)
code_block_79 = CodeBlock(a=filterByBoolMask_111.in) { b = List.Flatten(a); c = List.UniqueItems(b); List.Clean(c); }

# group: Zonas SO - Nível 1 > Seleciona paredes externas e internas
# Descrição <Clique duas vezes aqui para editar a descrição do grupo>
identifica_parede_relacionada_e_34 = CodeBlock(paredes=code_block_79.out2) { a = paredes.ElementType; b = a.GetParameterValueByName("Função"); b == 1; }  # "Identifica parede relacionada e se é externa"
filterByBoolMask_112 = List.FilterByBoolMask(list=code_block_79.out2, mask=identifica_parede_relacionada_e_34.out2)

# group: Zonas SO - Nível 1 > Seleciona Z3
# Descrição <Clique duas vezes aqui para editar a descrição do grupo>
filterByBoolMask_113 = List.FilterByBoolMask(list=filterByBoolMask_106.in, mask=code_block_75.out4)
code_block_80 = CodeBlock(a=filterByBoolMask_113.in) { b = a.Boundaries; List.Flatten(b); }
byJoinedCurves_35 = PolyCurve.ByJoinedCurves(curves=code_block_80.out1)
byPatch_35 = Surface.ByPatch(closedCurve=byJoinedCurves_35)

# group: Zonas SO - Nível 1 > Identifica quais paredes estão dentro da Zona N
# Descrição <Clique duas vezes aqui para editar a descrição do grupo>
doesIntersect_35 = Geometry.DoesIntersect(geometry=byPatch_35@L1, other=getLocation)
filterByBoolMask_114 = List.FilterByBoolMask(list=all_elements_of_category@L3, mask=doesIntersect_35)
code_block_81 = CodeBlock(a=filterByBoolMask_114.in) { b = List.Flatten(a); c = List.UniqueItems(b); List.Clean(c); }

# group: Zonas SO - Nível 1 > Seleciona paredes externas e internas
# Descrição <Clique duas vezes aqui para editar a descrição do grupo>
identifica_parede_relacionada_e_35 = CodeBlock(paredes=code_block_81.out2) { a = paredes.ElementType; b = a.GetParameterValueByName("Função"); b == 1; }  # "Identifica parede relacionada e se é externa"
filterByBoolMask_115 = List.FilterByBoolMask(list=code_block_81.out2, mask=identifica_parede_relacionada_e_35.out2)

# group: Zonas SO - Nível 1 > Seleciona Z4
# Descrição <Clique duas vezes aqui para editar a descrição do grupo>
filterByBoolMask_116 = List.FilterByBoolMask(list=filterByBoolMask_106.in, mask=code_block_75.out5)
code_block_82 = CodeBlock(a=filterByBoolMask_116.in) { b = a.Boundaries; List.Flatten(b); }
byJoinedCurves_36 = PolyCurve.ByJoinedCurves(curves=code_block_82.out1)
byPatch_36 = Surface.ByPatch(closedCurve=byJoinedCurves_36)

# group: Zonas SO - Nível 1 > Identifica quais paredes estão dentro da Zona N
# Descrição <Clique duas vezes aqui para editar a descrição do grupo>
doesIntersect_36 = Geometry.DoesIntersect(geometry=byPatch_36@L1, other=getLocation)
filterByBoolMask_117 = List.FilterByBoolMask(list=all_elements_of_category@L3, mask=doesIntersect_36)
code_block_83 = CodeBlock(a=filterByBoolMask_117.in) { b = List.Flatten(a); c = List.UniqueItems(b); List.Clean(c); }

# group: Zonas SO - Nível 1 > Seleciona paredes externas e internas
# Descrição <Clique duas vezes aqui para editar a descrição do grupo>
identifica_parede_relacionada_e_36 = CodeBlock(paredes=code_block_83.out2) { a = paredes.ElementType; b = a.GetParameterValueByName("Função"); b == 1; }  # "Identifica parede relacionada e se é externa"
filterByBoolMask_118 = List.FilterByBoolMask(list=code_block_83.out2, mask=identifica_parede_relacionada_e_36.out2)

# group: Zonas SO - Nível 1
# Descrição <Clique duas vezes aqui para editar a descrição do grupo>
paredes_externas_29 = CodeBlock(ParedesExt=filterByBoolMask_109.in) { ParedesExternas = List.Flatten(ParedesExt); a = ParedesExternas.GetParameterValueByName("Área"); }
python_script_33 = Python(IN[0]=paredes_externas_29.a)  # CPython3; same code as python_script
dados_qualitativos_pe_direito_e_33 = CodeBlock(a=python_script_33, Paredes=filterByBoolMask_109.in, zona=filterByBoolMask_107.in, superf=byPatch_33)  # "Dados qualitativos, pe direito e area"
# ---------- dados_qualitativos_pe_direito_e_33.designscript (13 lines) ----------
sa = Math.Sum(a);
b = Paredes.GetParameterValueByName("Altura desconectada");
pedireito = Math.Sum(a*b)/sa;
nome = zona.GetParameterValueByName("Nome");
areazona = Autodesk.Surface.Area(superf);
tipozona = "Perimetral";
orienta = "SO";
// lista com resultados
"Envoltória";
50;
2;
resultados = List.Flatten([nome,areazona,pedireito,tipozona,orienta]);
false;
# ----------------------------------------
getHostedElements_29 = Element.GetHostedElements(element=filterByBoolMask_109.in)
janelas_da_fachada_29 = CodeBlock(janelasexternas=getHostedElements_29)  # same code as janelas_da_fachada
componentes_e_paf_33 = CodeBlock(zona=filterByBoolMask_107.in, a=python_script_33, areaabertura=janelas_da_fachada_29.out5)
# ---------- componentes_e_paf_33.designscript (10 lines) ----------
nome = zona.GetParameterValueByName("Nome");
sa = Math.Sum(a);
PAF = areaabertura/(areaabertura + sa);
cob = "Pvto interm.";
// lista com resultados
"Envoltória";
50;
9;
resultados = List.Flatten([nome,nome,cob,nome,nome,PAF]);
false;
# ----------------------------------------
paredes_externas_30 = CodeBlock(ParedesExt=filterByBoolMask_112.in) { ParedesExternas = List.Flatten(ParedesExt); a = ParedesExternas.GetParameterValueByName("Área"); }
python_script_34 = Python(IN[0]=paredes_externas_30.a)  # CPython3; same code as python_script
dados_qualitativos_pe_direito_e_34 = CodeBlock(a=python_script_34, Paredes=filterByBoolMask_112.in, zona=filterByBoolMask_110.in, superf=byPatch_34)  # "Dados qualitativos, pe direito e area"
# ---------- dados_qualitativos_pe_direito_e_34.designscript (13 lines) ----------
sa = Math.Sum(a);
b = Paredes.GetParameterValueByName("Altura desconectada");
pedireito = Math.Sum(a*b)/sa;
nome = zona.GetParameterValueByName("Nome");
areazona = Autodesk.Surface.Area(superf);
tipozona = "Perimetral";
orienta = "SO";
// lista com resultados
"Envoltória";
51;
2;
resultados = List.Flatten([nome,areazona,pedireito,tipozona,orienta]);
false;
# ----------------------------------------
getHostedElements_30 = Element.GetHostedElements(element=filterByBoolMask_112.in)
janelas_da_fachada_30 = CodeBlock(janelasexternas=getHostedElements_30)  # same code as janelas_da_fachada
componentes_e_paf_34 = CodeBlock(zona=filterByBoolMask_110.in, a=python_script_34, areaabertura=janelas_da_fachada_30.out5)
# ---------- componentes_e_paf_34.designscript (10 lines) ----------
nome = zona.GetParameterValueByName("Nome");
sa = Math.Sum(a);
PAF = areaabertura/(areaabertura + sa);
cob = "Pvto interm.";
// lista com resultados
"Envoltória";
51;
9;
resultados = List.Flatten([nome,nome,cob,nome,nome,PAF]);
false;
# ----------------------------------------
paredes_externas_31 = CodeBlock(ParedesExt=filterByBoolMask_115.in) { ParedesExternas = List.Flatten(ParedesExt); a = ParedesExternas.GetParameterValueByName("Área"); }
python_script_35 = Python(IN[0]=paredes_externas_31.a)  # CPython3; same code as python_script
dados_qualitativos_pe_direito_e_35 = CodeBlock(a=python_script_35, Paredes=filterByBoolMask_115.in, zona=filterByBoolMask_113.in, superf=byPatch_35)  # "Dados qualitativos, pe direito e area"
# ---------- dados_qualitativos_pe_direito_e_35.designscript (13 lines) ----------
sa = Math.Sum(a);
b = Paredes.GetParameterValueByName("Altura desconectada");
pedireito = Math.Sum(a*b)/sa;
nome = zona.GetParameterValueByName("Nome");
areazona = Autodesk.Surface.Area(superf);
tipozona = "Perimetral";
orienta = "SO";
// lista com resultados
"Envoltória";
52;
2;
resultados = List.Flatten([nome,areazona,pedireito,tipozona,orienta]);
false;
# ----------------------------------------
getHostedElements_31 = Element.GetHostedElements(element=filterByBoolMask_115.in)
janelas_da_fachada_31 = CodeBlock(janelasexternas=getHostedElements_31)  # same code as janelas_da_fachada
componentes_e_paf_35 = CodeBlock(zona=filterByBoolMask_113.in, a=python_script_35, areaabertura=janelas_da_fachada_31.out5)
# ---------- componentes_e_paf_35.designscript (10 lines) ----------
nome = zona.GetParameterValueByName("Nome");
sa = Math.Sum(a);
PAF = areaabertura/(areaabertura + sa);
cob = "Pvto interm.";
// lista com resultados
"Envoltória";
52;
9;
resultados = List.Flatten([nome,nome,cob,nome,nome,PAF]);
false;
# ----------------------------------------
paredes_externas_32 = CodeBlock(ParedesExt=filterByBoolMask_118.in) { ParedesExternas = List.Flatten(ParedesExt); a = ParedesExternas.GetParameterValueByName("Área"); }
python_script_36 = Python(IN[0]=paredes_externas_32.a)  # CPython3; same code as python_script
dados_qualitativos_pe_direito_e_36 = CodeBlock(a=python_script_36, Paredes=filterByBoolMask_118.in, zona=filterByBoolMask_116.in, superf=byPatch_36)  # "Dados qualitativos, pe direito e area"
# ---------- dados_qualitativos_pe_direito_e_36.designscript (13 lines) ----------
sa = Math.Sum(a);
b = Paredes.GetParameterValueByName("Altura desconectada");
pedireito = Math.Sum(a*b)/sa;
nome = zona.GetParameterValueByName("Nome");
areazona = Autodesk.Surface.Area(superf);
tipozona = "Perimetral";
orienta = "SO";
// lista com resultados
"Envoltória";
53;
2;
resultados = List.Flatten([nome,areazona,pedireito,tipozona,orienta]);
false;
# ----------------------------------------
getHostedElements_32 = Element.GetHostedElements(element=filterByBoolMask_118.in)
janelas_da_fachada_32 = CodeBlock(janelasexternas=getHostedElements_32)  # same code as janelas_da_fachada
componentes_e_paf_36 = CodeBlock(zona=filterByBoolMask_116.in, a=python_script_36, areaabertura=janelas_da_fachada_32.out5)
# ---------- componentes_e_paf_36.designscript (10 lines) ----------
nome = zona.GetParameterValueByName("Nome");
sa = Math.Sum(a);
PAF = areaabertura/(areaabertura + sa);
cob = "Pvto interm.";
// lista com resultados
"Envoltória";
53;
9;
resultados = List.Flatten([nome,nome,cob,nome,nome,PAF]);
false;
# ----------------------------------------

# group: Zonas SO - Nível 1 > Exporta dados paredes para planilha
# Descrição <Clique duas vezes aqui para editar a descrição do grupo>
exportToExcel_65 = Data.ExportToExcel(filePath=file_path, sheetName=dados_qualitativos_pe_direito_e_33.out7, startRow=dados_qualitativos_pe_direito_e_33.out8, startColumn=dados_qualitativos_pe_direito_e_33.out9, data=dados_qualitativos_pe_direito_e_33.resultados@L3)
exportToExcel_66 = Data.ExportToExcel(filePath=file_path, sheetName=componentes_e_paf_33.out4, startRow=componentes_e_paf_33.out5, startColumn=componentes_e_paf_33.out6, data=componentes_e_paf_33.resultados@L3)

# group: Zonas SO - Nível 1 > Exporta dados paredes para planilha
# Descrição <Clique duas vezes aqui para editar a descrição do grupo>
exportToExcel_67 = Data.ExportToExcel(filePath=file_path, sheetName=dados_qualitativos_pe_direito_e_34.out7, startRow=dados_qualitativos_pe_direito_e_34.out8, startColumn=dados_qualitativos_pe_direito_e_34.out9, data=dados_qualitativos_pe_direito_e_34.resultados@L3)
exportToExcel_68 = Data.ExportToExcel(filePath=file_path, sheetName=componentes_e_paf_34.out4, startRow=componentes_e_paf_34.out5, startColumn=componentes_e_paf_34.out6, data=componentes_e_paf_34.resultados@L3)

# group: Zonas SO - Nível 1 > Exporta dados paredes para planilha
# Descrição <Clique duas vezes aqui para editar a descrição do grupo>
exportToExcel_69 = Data.ExportToExcel(filePath=file_path, sheetName=dados_qualitativos_pe_direito_e_35.out7, startRow=dados_qualitativos_pe_direito_e_35.out8, startColumn=dados_qualitativos_pe_direito_e_35.out9, data=dados_qualitativos_pe_direito_e_35.resultados@L3)
exportToExcel_70 = Data.ExportToExcel(filePath=file_path, sheetName=componentes_e_paf_35.out4, startRow=componentes_e_paf_35.out5, startColumn=componentes_e_paf_35.out6, data=componentes_e_paf_35.resultados@L3)

# group: Zonas SO - Nível 1 > Exporta dados paredes para planilha
# Descrição <Clique duas vezes aqui para editar a descrição do grupo>
exportToExcel_71 = Data.ExportToExcel(filePath=file_path, sheetName=dados_qualitativos_pe_direito_e_36.out7, startRow=dados_qualitativos_pe_direito_e_36.out8, startColumn=dados_qualitativos_pe_direito_e_36.out9, data=dados_qualitativos_pe_direito_e_36.resultados@L3)
exportToExcel_72 = Data.ExportToExcel(filePath=file_path, sheetName=componentes_e_paf_36.out4, startRow=componentes_e_paf_36.out5, startColumn=componentes_e_paf_36.out6, data=componentes_e_paf_36.resultados@L3)

# group: Seleciona zonas nível 2
# Descrição <Clique duas vezes aqui para editar a descrição do grupo>
filterByBoolMask_119 = List.FilterByBoolMask(list=all_elements_of_category_2, mask=code_block.out3)

# group: Identifica orientação das zonas
# Descrição <Clique duas vezes aqui para editar a descrição do grupo>
code_block_84 = CodeBlock(area=filterByBoolMask_119.in)  # same code as code_block_2

# group: Zonas SO - Nível 1 > Seleciona Zona SO
# Descrição <Clique duas vezes aqui para editar a descrição do grupo>
filterByBoolMask_120 = List.FilterByBoolMask(list=filterByBoolMask_119.in, mask=code_block_84.out10)

# group: Zonas SO - Nível 1 > Identifica numeração da zona
# Descrição <Clique duas vezes aqui para editar a descrição do grupo>
code_block_85 = CodeBlock(area=filterByBoolMask_120.in)  # same code as code_block_3

# group: Zonas SO - Nível 1 > Seleciona Z4
# Descrição <Clique duas vezes aqui para editar a descrição do grupo>
filterByBoolMask_121 = List.FilterByBoolMask(list=filterByBoolMask_120.in, mask=code_block_85.out5)
code_block_86 = CodeBlock(a=filterByBoolMask_121.in) { b = a.Boundaries; List.Flatten(b); }
byJoinedCurves_37 = PolyCurve.ByJoinedCurves(curves=code_block_86.out1)
byPatch_37 = Surface.ByPatch(closedCurve=byJoinedCurves_37)

# group: Zonas SO - Nível 1 > Identifica quais paredes estão dentro da Zona N
# Descrição <Clique duas vezes aqui para editar a descrição do grupo>
doesIntersect_37 = Geometry.DoesIntersect(geometry=byPatch_37@L1, other=getLocation)
filterByBoolMask_122 = List.FilterByBoolMask(list=all_elements_of_category@L3, mask=doesIntersect_37)
code_block_87 = CodeBlock(a=filterByBoolMask_122.in) { b = List.Flatten(a); c = List.UniqueItems(b); List.Clean(c); }

# group: Zonas SO - Nível 1 > Seleciona paredes externas e internas
# Descrição <Clique duas vezes aqui para editar a descrição do grupo>
identifica_parede_relacionada_e_37 = CodeBlock(paredes=code_block_87.out2) { a = paredes.ElementType; b = a.GetParameterValueByName("Função"); b == 1; }  # "Identifica parede relacionada e se é externa"
filterByBoolMask_123 = List.FilterByBoolMask(list=code_block_87.out2, mask=identifica_parede_relacionada_e_37.out2)

# group: Zonas SO - Nível 1 > Seleciona Z1
# Descrição <Clique duas vezes aqui para editar a descrição do grupo>
filterByBoolMask_124 = List.FilterByBoolMask(list=filterByBoolMask_120.in, mask=code_block_85.out2)
code_block_88 = CodeBlock(a=filterByBoolMask_124.in) { b = a.Boundaries; List.Flatten(b); }
byJoinedCurves_38 = PolyCurve.ByJoinedCurves(curves=code_block_88.out1)
byPatch_38 = Surface.ByPatch(closedCurve=byJoinedCurves_38)

# group: Zonas SO - Nível 1 > Identifica quais paredes estão dentro da Zona N
# Descrição <Clique duas vezes aqui para editar a descrição do grupo>
doesIntersect_38 = Geometry.DoesIntersect(geometry=byPatch_38@L1, other=getLocation)
filterByBoolMask_125 = List.FilterByBoolMask(list=all_elements_of_category@L3, mask=doesIntersect_38)
code_block_89 = CodeBlock(a=filterByBoolMask_125.in) { b = List.Flatten(a); c = List.UniqueItems(b); List.Clean(c); }

# group: Zonas SO - Nível 1 > Seleciona paredes externas e internas
# Descrição <Clique duas vezes aqui para editar a descrição do grupo>
identifica_parede_relacionada_e_38 = CodeBlock(paredes=code_block_89.out2) { a = paredes.ElementType; b = a.GetParameterValueByName("Função"); b == 1; }  # "Identifica parede relacionada e se é externa"
filterByBoolMask_126 = List.FilterByBoolMask(list=code_block_89.out2, mask=identifica_parede_relacionada_e_38.out2)

# group: Zonas SO - Nível 1 > Seleciona Z2
# Descrição <Clique duas vezes aqui para editar a descrição do grupo>
filterByBoolMask_127 = List.FilterByBoolMask(list=filterByBoolMask_120.in, mask=code_block_85.out3)
code_block_90 = CodeBlock(a=filterByBoolMask_127.in) { b = a.Boundaries; List.Flatten(b); }
byJoinedCurves_39 = PolyCurve.ByJoinedCurves(curves=code_block_90.out1)
byPatch_39 = Surface.ByPatch(closedCurve=byJoinedCurves_39)

# group: Zonas SO - Nível 1 > Identifica quais paredes estão dentro da Zona N
# Descrição <Clique duas vezes aqui para editar a descrição do grupo>
doesIntersect_39 = Geometry.DoesIntersect(geometry=byPatch_39@L1, other=getLocation)
filterByBoolMask_128 = List.FilterByBoolMask(list=all_elements_of_category@L3, mask=doesIntersect_39)
code_block_91 = CodeBlock(a=filterByBoolMask_128.in) { b = List.Flatten(a); c = List.UniqueItems(b); List.Clean(c); }

# group: Zonas SO - Nível 1 > Seleciona paredes externas e internas
# Descrição <Clique duas vezes aqui para editar a descrição do grupo>
identifica_parede_relacionada_e_39 = CodeBlock(paredes=code_block_91.out2) { a = paredes.ElementType; b = a.GetParameterValueByName("Função"); b == 1; }  # "Identifica parede relacionada e se é externa"
filterByBoolMask_129 = List.FilterByBoolMask(list=code_block_91.out2, mask=identifica_parede_relacionada_e_39.out2)

# group: Zonas SO - Nível 1 > Seleciona Z3
# Descrição <Clique duas vezes aqui para editar a descrição do grupo>
filterByBoolMask_130 = List.FilterByBoolMask(list=filterByBoolMask_120.in, mask=code_block_85.out4)
code_block_92 = CodeBlock(a=filterByBoolMask_130.in) { b = a.Boundaries; List.Flatten(b); }
byJoinedCurves_40 = PolyCurve.ByJoinedCurves(curves=code_block_92.out1)
byPatch_40 = Surface.ByPatch(closedCurve=byJoinedCurves_40)

# group: Zonas SO - Nível 1 > Identifica quais paredes estão dentro da Zona N
# Descrição <Clique duas vezes aqui para editar a descrição do grupo>
doesIntersect_40 = Geometry.DoesIntersect(geometry=byPatch_40@L1, other=getLocation)
filterByBoolMask_131 = List.FilterByBoolMask(list=all_elements_of_category@L3, mask=doesIntersect_40)
code_block_93 = CodeBlock(a=filterByBoolMask_131.in) { b = List.Flatten(a); c = List.UniqueItems(b); List.Clean(c); }

# group: Zonas SO - Nível 1 > Seleciona paredes externas e internas
# Descrição <Clique duas vezes aqui para editar a descrição do grupo>
identifica_parede_relacionada_e_40 = CodeBlock(paredes=code_block_93.out2) { a = paredes.ElementType; b = a.GetParameterValueByName("Função"); b == 1; }  # "Identifica parede relacionada e se é externa"
filterByBoolMask_132 = List.FilterByBoolMask(list=code_block_93.out2, mask=identifica_parede_relacionada_e_40.out2)

# group: Zonas SO - Nível 1
# Descrição <Clique duas vezes aqui para editar a descrição do grupo>
paredes_externas_33 = CodeBlock(ParedesExt=filterByBoolMask_123.in) { ParedesExternas = List.Flatten(ParedesExt); a = ParedesExternas.GetParameterValueByName("Área"); }
python_script_37 = Python(IN[0]=paredes_externas_33.a)  # CPython3; same code as python_script
getHostedElements_33 = Element.GetHostedElements(element=filterByBoolMask_123.in)
janelas_da_fachada_33 = CodeBlock(janelasexternas=getHostedElements_33)  # same code as janelas_da_fachada
componentes_e_paf_37 = CodeBlock(zona=filterByBoolMask_121.in, a=python_script_37, areaabertura=janelas_da_fachada_33.out5)
# ---------- componentes_e_paf_37.designscript (10 lines) ----------
nome = zona.GetParameterValueByName("Nome");
sa = Math.Sum(a);
PAF = areaabertura/(areaabertura + sa);
cob = "Pvto interm.";
// lista com resultados
"Envoltória";
89;
9;
resultados = List.Flatten([nome,nome,cob,nome,nome,PAF]);
false;
# ----------------------------------------
dados_qualitativos_pe_direito_e_37 = CodeBlock(a=python_script_37, Paredes=filterByBoolMask_123.in, zona=filterByBoolMask_121.in, superf=byPatch_37)  # "Dados qualitativos, pe direito e area"
# ---------- dados_qualitativos_pe_direito_e_37.designscript (13 lines) ----------
sa = Math.Sum(a);
b = Paredes.GetParameterValueByName("Altura desconectada");
pedireito = Math.Sum(a*b)/sa;
nome = zona.GetParameterValueByName("Nome");
areazona = Autodesk.Surface.Area(superf);
tipozona = "Perimetral";
orienta = "SO";
// lista com resultados
"Envoltória";
89;
2;
resultados = List.Flatten([nome,areazona,pedireito,tipozona,orienta]);
false;
# ----------------------------------------
paredes_externas_34 = CodeBlock(ParedesExt=filterByBoolMask_126.in) { ParedesExternas = List.Flatten(ParedesExt); a = ParedesExternas.GetParameterValueByName("Área"); }
python_script_38 = Python(IN[0]=paredes_externas_34.a)  # CPython3; same code as python_script
dados_qualitativos_pe_direito_e_38 = CodeBlock(a=python_script_38, Paredes=filterByBoolMask_126.in, zona=filterByBoolMask_124.in, superf=byPatch_38)  # "Dados qualitativos, pe direito e area"
# ---------- dados_qualitativos_pe_direito_e_38.designscript (13 lines) ----------
sa = Math.Sum(a);
b = Paredes.GetParameterValueByName("Altura desconectada");
pedireito = Math.Sum(a*b)/sa;
nome = zona.GetParameterValueByName("Nome");
areazona = Autodesk.Surface.Area(superf);
tipozona = "Perimetral";
orienta = "SO";
// lista com resultados
"Envoltória";
86;
2;
resultados = List.Flatten([nome,areazona,pedireito,tipozona,orienta]);
false;
# ----------------------------------------
getHostedElements_34 = Element.GetHostedElements(element=filterByBoolMask_126.in)
janelas_da_fachada_34 = CodeBlock(janelasexternas=getHostedElements_34)  # same code as janelas_da_fachada
componentes_e_paf_38 = CodeBlock(zona=filterByBoolMask_124.in, a=python_script_38, areaabertura=janelas_da_fachada_34.out5)
# ---------- componentes_e_paf_38.designscript (10 lines) ----------
nome = zona.GetParameterValueByName("Nome");
sa = Math.Sum(a);
PAF = areaabertura/(areaabertura + sa);
cob = "Pvto interm.";
// lista com resultados
"Envoltória";
86;
9;
resultados = List.Flatten([nome,nome,cob,nome,nome,PAF]);
false;
# ----------------------------------------
paredes_externas_35 = CodeBlock(ParedesExt=filterByBoolMask_129.in) { ParedesExternas = List.Flatten(ParedesExt); a = ParedesExternas.GetParameterValueByName("Área"); }
python_script_39 = Python(IN[0]=paredes_externas_35.a)  # CPython3; same code as python_script
dados_qualitativos_pe_direito_e_39 = CodeBlock(a=python_script_39, Paredes=filterByBoolMask_129.in, zona=filterByBoolMask_127.in, superf=byPatch_39)  # "Dados qualitativos, pe direito e area"
# ---------- dados_qualitativos_pe_direito_e_39.designscript (13 lines) ----------
sa = Math.Sum(a);
b = Paredes.GetParameterValueByName("Altura desconectada");
pedireito = Math.Sum(a*b)/sa;
nome = zona.GetParameterValueByName("Nome");
areazona = Autodesk.Surface.Area(superf);
tipozona = "Perimetral";
orienta = "SO";
// lista com resultados
"Envoltória";
87;
2;
resultados = List.Flatten([nome,areazona,pedireito,tipozona,orienta]);
false;
# ----------------------------------------
getHostedElements_35 = Element.GetHostedElements(element=filterByBoolMask_129.in)
janelas_da_fachada_35 = CodeBlock(janelasexternas=getHostedElements_35)  # same code as janelas_da_fachada
componentes_e_paf_39 = CodeBlock(zona=filterByBoolMask_127.in, a=python_script_39, areaabertura=janelas_da_fachada_35.out5)
# ---------- componentes_e_paf_39.designscript (10 lines) ----------
nome = zona.GetParameterValueByName("Nome");
sa = Math.Sum(a);
PAF = areaabertura/(areaabertura + sa);
cob = "Pvto interm.";
// lista com resultados
"Envoltória";
87;
9;
resultados = List.Flatten([nome,nome,cob,nome,nome,PAF]);
false;
# ----------------------------------------
paredes_externas_36 = CodeBlock(ParedesExt=filterByBoolMask_132.in) { ParedesExternas = List.Flatten(ParedesExt); a = ParedesExternas.GetParameterValueByName("Área"); }
python_script_40 = Python(IN[0]=paredes_externas_36.a)  # CPython3; same code as python_script
dados_qualitativos_pe_direito_e_40 = CodeBlock(a=python_script_40, Paredes=filterByBoolMask_132.in, zona=filterByBoolMask_130.in, superf=byPatch_40)  # "Dados qualitativos, pe direito e area"
# ---------- dados_qualitativos_pe_direito_e_40.designscript (13 lines) ----------
sa = Math.Sum(a);
b = Paredes.GetParameterValueByName("Altura desconectada");
pedireito = Math.Sum(a*b)/sa;
nome = zona.GetParameterValueByName("Nome");
areazona = Autodesk.Surface.Area(superf);
tipozona = "Perimetral";
orienta = "SO";
// lista com resultados
"Envoltória";
88;
2;
resultados = List.Flatten([nome,areazona,pedireito,tipozona,orienta]);
false;
# ----------------------------------------
getHostedElements_36 = Element.GetHostedElements(element=filterByBoolMask_132.in)
janelas_da_fachada_36 = CodeBlock(janelasexternas=getHostedElements_36)  # same code as janelas_da_fachada
componentes_e_paf_40 = CodeBlock(zona=filterByBoolMask_130.in, a=python_script_40, areaabertura=janelas_da_fachada_36.out5)
# ---------- componentes_e_paf_40.designscript (10 lines) ----------
nome = zona.GetParameterValueByName("Nome");
sa = Math.Sum(a);
PAF = areaabertura/(areaabertura + sa);
cob = "Pvto interm.";
// lista com resultados
"Envoltória";
88;
9;
resultados = List.Flatten([nome,nome,cob,nome,nome,PAF]);
false;
# ----------------------------------------

# group: Zonas SO - Nível 1 > Exporta dados paredes para planilha
# Descrição <Clique duas vezes aqui para editar a descrição do grupo>
exportToExcel_73 = Data.ExportToExcel(filePath=file_path, sheetName=componentes_e_paf_37.out4, startRow=componentes_e_paf_37.out5, startColumn=componentes_e_paf_37.out6, data=componentes_e_paf_37.resultados@L3)
exportToExcel_74 = Data.ExportToExcel(filePath=file_path, sheetName=dados_qualitativos_pe_direito_e_37.out7, startRow=dados_qualitativos_pe_direito_e_37.out8, startColumn=dados_qualitativos_pe_direito_e_37.out9, data=dados_qualitativos_pe_direito_e_37.resultados@L3)

# group: Zonas SO - Nível 1 > Exporta dados paredes para planilha
# Descrição <Clique duas vezes aqui para editar a descrição do grupo>
exportToExcel_75 = Data.ExportToExcel(filePath=file_path, sheetName=dados_qualitativos_pe_direito_e_38.out7, startRow=dados_qualitativos_pe_direito_e_38.out8, startColumn=dados_qualitativos_pe_direito_e_38.out9, data=dados_qualitativos_pe_direito_e_38.resultados@L3)
exportToExcel_76 = Data.ExportToExcel(filePath=file_path, sheetName=componentes_e_paf_38.out4, startRow=componentes_e_paf_38.out5, startColumn=componentes_e_paf_38.out6, data=componentes_e_paf_38.resultados@L3)

# group: Zonas SO - Nível 1 > Exporta dados paredes para planilha
# Descrição <Clique duas vezes aqui para editar a descrição do grupo>
exportToExcel_77 = Data.ExportToExcel(filePath=file_path, sheetName=dados_qualitativos_pe_direito_e_39.out7, startRow=dados_qualitativos_pe_direito_e_39.out8, startColumn=dados_qualitativos_pe_direito_e_39.out9, data=dados_qualitativos_pe_direito_e_39.resultados@L3)
exportToExcel_78 = Data.ExportToExcel(filePath=file_path, sheetName=componentes_e_paf_39.out4, startRow=componentes_e_paf_39.out5, startColumn=componentes_e_paf_39.out6, data=componentes_e_paf_39.resultados@L3)

# group: Zonas SO - Nível 1 > Exporta dados paredes para planilha
# Descrição <Clique duas vezes aqui para editar a descrição do grupo>
exportToExcel_79 = Data.ExportToExcel(filePath=file_path, sheetName=dados_qualitativos_pe_direito_e_40.out7, startRow=dados_qualitativos_pe_direito_e_40.out8, startColumn=dados_qualitativos_pe_direito_e_40.out9, data=dados_qualitativos_pe_direito_e_40.resultados@L3)
exportToExcel_80 = Data.ExportToExcel(filePath=file_path, sheetName=componentes_e_paf_40.out4, startRow=componentes_e_paf_40.out5, startColumn=componentes_e_paf_40.out6, data=componentes_e_paf_40.resultados@L3)

# group: Zonas NO - Nível 1 > Seleciona Zona NO
# Descrição <Clique duas vezes aqui para editar a descrição do grupo>
filterByBoolMask_133 = List.FilterByBoolMask(list=filterByBoolMask_119.in, mask=code_block_84.out8)

# group: Zonas NO - Nível 1 > Identifica numeração da zona
# Descrição <Clique duas vezes aqui para editar a descrição do grupo>
code_block_94 = CodeBlock(area=filterByBoolMask_133.in)  # same code as code_block_3

# group: Zonas NO - Nível 1 > Seleciona Z2
# Descrição <Clique duas vezes aqui para editar a descrição do grupo>
filterByBoolMask_134 = List.FilterByBoolMask(list=filterByBoolMask_133.in, mask=code_block_94.out3)
code_block_95 = CodeBlock(a=filterByBoolMask_134.in) { b = a.Boundaries; List.Flatten(b); }
byJoinedCurves_41 = PolyCurve.ByJoinedCurves(curves=code_block_95.out1)
byPatch_41 = Surface.ByPatch(closedCurve=byJoinedCurves_41)

# group: Zonas NO - Nível 1 > Identifica quais paredes estão dentro da Zona N
# Descrição <Clique duas vezes aqui para editar a descrição do grupo>
doesIntersect_41 = Geometry.DoesIntersect(geometry=byPatch_41@L1, other=getLocation)
filterByBoolMask_135 = List.FilterByBoolMask(list=all_elements_of_category@L3, mask=doesIntersect_41)
code_block_96 = CodeBlock(a=filterByBoolMask_135.in) { b = List.Flatten(a); c = List.UniqueItems(b); List.Clean(c); }

# group: Zonas NO - Nível 1 > Seleciona paredes externas e internas
# Descrição <Clique duas vezes aqui para editar a descrição do grupo>
identifica_parede_relacionada_e_41 = CodeBlock(paredes=code_block_96.out2) { a = paredes.ElementType; b = a.GetParameterValueByName("Função"); b == 1; }  # "Identifica parede relacionada e se é externa"
filterByBoolMask_136 = List.FilterByBoolMask(list=code_block_96.out2, mask=identifica_parede_relacionada_e_41.out2)

# group: Zonas NO - Nível 1 > Seleciona Z3
# Descrição <Clique duas vezes aqui para editar a descrição do grupo>
filterByBoolMask_137 = List.FilterByBoolMask(list=filterByBoolMask_133.in, mask=code_block_94.out4)
code_block_97 = CodeBlock(a=filterByBoolMask_137.in) { b = a.Boundaries; List.Flatten(b); }
byJoinedCurves_42 = PolyCurve.ByJoinedCurves(curves=code_block_97.out1)
byPatch_42 = Surface.ByPatch(closedCurve=byJoinedCurves_42)

# group: Zonas NO - Nível 1 > Identifica quais paredes estão dentro da Zona N
# Descrição <Clique duas vezes aqui para editar a descrição do grupo>
doesIntersect_42 = Geometry.DoesIntersect(geometry=byPatch_42@L1, other=getLocation)
filterByBoolMask_138 = List.FilterByBoolMask(list=all_elements_of_category@L3, mask=doesIntersect_42)
code_block_98 = CodeBlock(a=filterByBoolMask_138.in) { b = List.Flatten(a); c = List.UniqueItems(b); List.Clean(c); }

# group: Zonas NO - Nível 1 > Seleciona paredes externas e internas
# Descrição <Clique duas vezes aqui para editar a descrição do grupo>
identifica_parede_relacionada_e_42 = CodeBlock(paredes=code_block_98.out2) { a = paredes.ElementType; b = a.GetParameterValueByName("Função"); b == 1; }  # "Identifica parede relacionada e se é externa"
filterByBoolMask_139 = List.FilterByBoolMask(list=code_block_98.out2, mask=identifica_parede_relacionada_e_42.out2)

# group: Zonas NO - Nível 1 > Seleciona Z4
# Descrição <Clique duas vezes aqui para editar a descrição do grupo>
filterByBoolMask_140 = List.FilterByBoolMask(list=filterByBoolMask_133.in, mask=code_block_94.out5)
code_block_99 = CodeBlock(a=filterByBoolMask_140.in) { b = a.Boundaries; List.Flatten(b); }
byJoinedCurves_43 = PolyCurve.ByJoinedCurves(curves=code_block_99.out1)
byPatch_43 = Surface.ByPatch(closedCurve=byJoinedCurves_43)

# group: Zonas NO - Nível 1 > Identifica quais paredes estão dentro da Zona N
# Descrição <Clique duas vezes aqui para editar a descrição do grupo>
doesIntersect_43 = Geometry.DoesIntersect(geometry=byPatch_43@L1, other=getLocation)
filterByBoolMask_141 = List.FilterByBoolMask(list=all_elements_of_category@L3, mask=doesIntersect_43)
code_block_100 = CodeBlock(a=filterByBoolMask_141.in) { b = List.Flatten(a); c = List.UniqueItems(b); List.Clean(c); }

# group: Zonas NO - Nível 1 > Seleciona paredes externas e internas
# Descrição <Clique duas vezes aqui para editar a descrição do grupo>
identifica_parede_relacionada_e_43 = CodeBlock(paredes=code_block_100.out2) { a = paredes.ElementType; b = a.GetParameterValueByName("Função"); b == 1; }  # "Identifica parede relacionada e se é externa"
filterByBoolMask_142 = List.FilterByBoolMask(list=code_block_100.out2, mask=identifica_parede_relacionada_e_43.out2)

# group: Zonas SE - Nível 1 > Seleciona Zona SE
# Descrição <Clique duas vezes aqui para editar a descrição do grupo>
filterByBoolMask_143 = List.FilterByBoolMask(list=filterByBoolMask_119.in, mask=code_block_84.out9)

# group: Zonas SE - Nível 1 > Identifica numeração da zona
# Descrição <Clique duas vezes aqui para editar a descrição do grupo>
code_block_101 = CodeBlock(area=filterByBoolMask_143.in)  # same code as code_block_3

# group: Zonas SE - Nível 1 > Seleciona Z1
# Descrição <Clique duas vezes aqui para editar a descrição do grupo>
filterByBoolMask_144 = List.FilterByBoolMask(list=filterByBoolMask_143.in, mask=code_block_101.out2)
code_block_102 = CodeBlock(a=filterByBoolMask_144.in) { b = a.Boundaries; List.Flatten(b); }
byJoinedCurves_44 = PolyCurve.ByJoinedCurves(curves=code_block_102.out1)
byPatch_44 = Surface.ByPatch(closedCurve=byJoinedCurves_44)

# group: Zonas SE - Nível 1 > Identifica quais paredes estão dentro da Zona N
# Descrição <Clique duas vezes aqui para editar a descrição do grupo>
doesIntersect_44 = Geometry.DoesIntersect(geometry=byPatch_44@L1, other=getLocation)
filterByBoolMask_145 = List.FilterByBoolMask(list=all_elements_of_category@L3, mask=doesIntersect_44)
code_block_103 = CodeBlock(a=filterByBoolMask_145.in) { b = List.Flatten(a); c = List.UniqueItems(b); List.Clean(c); }

# group: Zonas SE - Nível 1 > Seleciona paredes externas e internas
# Descrição <Clique duas vezes aqui para editar a descrição do grupo>
identifica_parede_relacionada_e_44 = CodeBlock(paredes=code_block_103.out2) { a = paredes.ElementType; b = a.GetParameterValueByName("Função"); b == 1; }  # "Identifica parede relacionada e se é externa"
filterByBoolMask_146 = List.FilterByBoolMask(list=code_block_103.out2, mask=identifica_parede_relacionada_e_44.out2)

# group: Zonas SE - Nível 1 > Seleciona Z2
# Descrição <Clique duas vezes aqui para editar a descrição do grupo>
filterByBoolMask_147 = List.FilterByBoolMask(list=filterByBoolMask_143.in, mask=code_block_101.out3)
code_block_104 = CodeBlock(a=filterByBoolMask_147.in) { b = a.Boundaries; List.Flatten(b); }
byJoinedCurves_45 = PolyCurve.ByJoinedCurves(curves=code_block_104.out1)
byPatch_45 = Surface.ByPatch(closedCurve=byJoinedCurves_45)

# group: Zonas SE - Nível 1 > Identifica quais paredes estão dentro da Zona N
# Descrição <Clique duas vezes aqui para editar a descrição do grupo>
doesIntersect_45 = Geometry.DoesIntersect(geometry=byPatch_45@L1, other=getLocation)
filterByBoolMask_148 = List.FilterByBoolMask(list=all_elements_of_category@L3, mask=doesIntersect_45)
code_block_105 = CodeBlock(a=filterByBoolMask_148.in) { b = List.Flatten(a); c = List.UniqueItems(b); List.Clean(c); }

# group: Zonas SE - Nível 1 > Seleciona paredes externas e internas
# Descrição <Clique duas vezes aqui para editar a descrição do grupo>
identifica_parede_relacionada_e_45 = CodeBlock(paredes=code_block_105.out2) { a = paredes.ElementType; b = a.GetParameterValueByName("Função"); b == 1; }  # "Identifica parede relacionada e se é externa"
filterByBoolMask_149 = List.FilterByBoolMask(list=code_block_105.out2, mask=identifica_parede_relacionada_e_45.out2)

# group: Zonas SE - Nível 1 > Seleciona Z3
# Descrição <Clique duas vezes aqui para editar a descrição do grupo>
filterByBoolMask_150 = List.FilterByBoolMask(list=filterByBoolMask_143.in, mask=code_block_101.out4)
code_block_106 = CodeBlock(a=filterByBoolMask_150.in) { b = a.Boundaries; List.Flatten(b); }
byJoinedCurves_46 = PolyCurve.ByJoinedCurves(curves=code_block_106.out1)
byPatch_46 = Surface.ByPatch(closedCurve=byJoinedCurves_46)

# group: Zonas SE - Nível 1 > Identifica quais paredes estão dentro da Zona N
# Descrição <Clique duas vezes aqui para editar a descrição do grupo>
doesIntersect_46 = Geometry.DoesIntersect(geometry=byPatch_46@L1, other=getLocation)
filterByBoolMask_151 = List.FilterByBoolMask(list=all_elements_of_category@L3, mask=doesIntersect_46)
code_block_107 = CodeBlock(a=filterByBoolMask_151.in) { b = List.Flatten(a); c = List.UniqueItems(b); List.Clean(c); }

# group: Zonas SE - Nível 1 > Seleciona paredes externas e internas
# Descrição <Clique duas vezes aqui para editar a descrição do grupo>
identifica_parede_relacionada_e_46 = CodeBlock(paredes=code_block_107.out2) { a = paredes.ElementType; b = a.GetParameterValueByName("Função"); b == 1; }  # "Identifica parede relacionada e se é externa"
filterByBoolMask_152 = List.FilterByBoolMask(list=code_block_107.out2, mask=identifica_parede_relacionada_e_46.out2)

# group: Zonas SE - Nível 1 > Seleciona Z4
# Descrição <Clique duas vezes aqui para editar a descrição do grupo>
filterByBoolMask_153 = List.FilterByBoolMask(list=filterByBoolMask_143.in, mask=code_block_101.out5)
code_block_108 = CodeBlock(a=filterByBoolMask_153.in) { b = a.Boundaries; List.Flatten(b); }
byJoinedCurves_47 = PolyCurve.ByJoinedCurves(curves=code_block_108.out1)
byPatch_47 = Surface.ByPatch(closedCurve=byJoinedCurves_47)

# group: Zonas SE - Nível 1 > Identifica quais paredes estão dentro da Zona N
# Descrição <Clique duas vezes aqui para editar a descrição do grupo>
doesIntersect_47 = Geometry.DoesIntersect(geometry=byPatch_47@L1, other=getLocation)
filterByBoolMask_154 = List.FilterByBoolMask(list=all_elements_of_category@L3, mask=doesIntersect_47)
code_block_109 = CodeBlock(a=filterByBoolMask_154.in) { b = List.Flatten(a); c = List.UniqueItems(b); List.Clean(c); }

# group: Zonas SE - Nível 1 > Seleciona paredes externas e internas
# Descrição <Clique duas vezes aqui para editar a descrição do grupo>
identifica_parede_relacionada_e_47 = CodeBlock(paredes=code_block_109.out2) { a = paredes.ElementType; b = a.GetParameterValueByName("Função"); b == 1; }  # "Identifica parede relacionada e se é externa"
filterByBoolMask_155 = List.FilterByBoolMask(list=code_block_109.out2, mask=identifica_parede_relacionada_e_47.out2)

# group: Zonas SE - Nível 1
# Descrição <Clique duas vezes aqui para editar a descrição do grupo>
paredes_externas_37 = CodeBlock(ParedesExt=filterByBoolMask_146.in) { ParedesExternas = List.Flatten(ParedesExt); a = ParedesExternas.GetParameterValueByName("Área"); }
python_script_41 = Python(IN[0]=paredes_externas_37.a)  # CPython3; same code as python_script
dados_qualitativos_pe_direito_e_41 = CodeBlock(a=python_script_41, Paredes=filterByBoolMask_146.in, zona=filterByBoolMask_144.in, superf=byPatch_44)  # "Dados qualitativos, pe direito e area"
# ---------- dados_qualitativos_pe_direito_e_41.designscript (13 lines) ----------
sa = Math.Sum(a);
b = Paredes.GetParameterValueByName("Altura desconectada");
pedireito = Math.Sum(a*b)/sa;
nome = zona.GetParameterValueByName("Nome");
areazona = Autodesk.Surface.Area(superf);
tipozona = "Perimetral";
orienta = "SE";
// lista com resultados
"Envoltória";
82;
2;
resultados = List.Flatten([nome,areazona,pedireito,tipozona,orienta]);
false;
# ----------------------------------------
getHostedElements_37 = Element.GetHostedElements(element=filterByBoolMask_146.in)
janelas_da_fachada_37 = CodeBlock(janelasexternas=getHostedElements_37)  # same code as janelas_da_fachada
componentes_e_paf_41 = CodeBlock(zona=filterByBoolMask_144.in, a=python_script_41, areaabertura=janelas_da_fachada_37.out5)
# ---------- componentes_e_paf_41.designscript (10 lines) ----------
nome = zona.GetParameterValueByName("Nome");
sa = Math.Sum(a);
PAF = areaabertura/(areaabertura + sa);
cob = "Pvto interm.";
// lista com resultados
"Envoltória";
82;
9;
resultados = List.Flatten([nome,nome,cob,nome,nome,PAF]);
false;
# ----------------------------------------
paredes_externas_38 = CodeBlock(ParedesExt=filterByBoolMask_149.in) { ParedesExternas = List.Flatten(ParedesExt); a = ParedesExternas.GetParameterValueByName("Área"); }
python_script_42 = Python(IN[0]=paredes_externas_38.a)  # CPython3; same code as python_script
dados_qualitativos_pe_direito_e_42 = CodeBlock(a=python_script_42, Paredes=filterByBoolMask_149.in, zona=filterByBoolMask_147.in, superf=byPatch_45)  # "Dados qualitativos, pe direito e area"
# ---------- dados_qualitativos_pe_direito_e_42.designscript (13 lines) ----------
sa = Math.Sum(a);
b = Paredes.GetParameterValueByName("Altura desconectada");
pedireito = Math.Sum(a*b)/sa;
nome = zona.GetParameterValueByName("Nome");
areazona = Autodesk.Surface.Area(superf);
tipozona = "Perimetral";
orienta = "SE";
// lista com resultados
"Envoltória";
83;
2;
resultados = List.Flatten([nome,areazona,pedireito,tipozona,orienta]);
false;
# ----------------------------------------
getHostedElements_38 = Element.GetHostedElements(element=filterByBoolMask_149.in)
janelas_da_fachada_38 = CodeBlock(janelasexternas=getHostedElements_38)  # same code as janelas_da_fachada
componentes_e_paf_42 = CodeBlock(zona=filterByBoolMask_147.in, a=python_script_42, areaabertura=janelas_da_fachada_38.out5)
# ---------- componentes_e_paf_42.designscript (10 lines) ----------
nome = zona.GetParameterValueByName("Nome");
sa = Math.Sum(a);
PAF = areaabertura/(areaabertura + sa);
cob = "Pvto interm.";
// lista com resultados
"Envoltória";
83;
9;
resultados = List.Flatten([nome,nome,cob,nome,nome,PAF]);
false;
# ----------------------------------------
paredes_externas_39 = CodeBlock(ParedesExt=filterByBoolMask_152.in) { ParedesExternas = List.Flatten(ParedesExt); a = ParedesExternas.GetParameterValueByName("Área"); }
python_script_43 = Python(IN[0]=paredes_externas_39.a)  # CPython3; same code as python_script
dados_qualitativos_pe_direito_e_43 = CodeBlock(a=python_script_43, Paredes=filterByBoolMask_152.in, zona=filterByBoolMask_150.in, superf=byPatch_46)  # "Dados qualitativos, pe direito e area"
# ---------- dados_qualitativos_pe_direito_e_43.designscript (13 lines) ----------
sa = Math.Sum(a);
b = Paredes.GetParameterValueByName("Altura desconectada");
pedireito = Math.Sum(a*b)/sa;
nome = zona.GetParameterValueByName("Nome");
areazona = Autodesk.Surface.Area(superf);
tipozona = "Perimetral";
orienta = "SE";
// lista com resultados
"Envoltória";
84;
2;
resultados = List.Flatten([nome,areazona,pedireito,tipozona,orienta]);
false;
# ----------------------------------------
getHostedElements_39 = Element.GetHostedElements(element=filterByBoolMask_152.in)
janelas_da_fachada_39 = CodeBlock(janelasexternas=getHostedElements_39)  # same code as janelas_da_fachada
componentes_e_paf_43 = CodeBlock(zona=filterByBoolMask_150.in, a=python_script_43, areaabertura=janelas_da_fachada_39.out5)
# ---------- componentes_e_paf_43.designscript (10 lines) ----------
nome = zona.GetParameterValueByName("Nome");
sa = Math.Sum(a);
PAF = areaabertura/(areaabertura + sa);
cob = "Pvto interm.";
// lista com resultados
"Envoltória";
84;
9;
resultados = List.Flatten([nome,nome,cob,nome,nome,PAF]);
false;
# ----------------------------------------
paredes_externas_40 = CodeBlock(ParedesExt=filterByBoolMask_155.in) { ParedesExternas = List.Flatten(ParedesExt); a = ParedesExternas.GetParameterValueByName("Área"); }
python_script_44 = Python(IN[0]=paredes_externas_40.a)  # CPython3; same code as python_script
dados_qualitativos_pe_direito_e_44 = CodeBlock(a=python_script_44, Paredes=filterByBoolMask_155.in, zona=filterByBoolMask_153.in, superf=byPatch_47)  # "Dados qualitativos, pe direito e area"
# ---------- dados_qualitativos_pe_direito_e_44.designscript (13 lines) ----------
sa = Math.Sum(a);
b = Paredes.GetParameterValueByName("Altura desconectada");
pedireito = Math.Sum(a*b)/sa;
nome = zona.GetParameterValueByName("Nome");
areazona = Autodesk.Surface.Area(superf);
tipozona = "Perimetral";
orienta = "SE";
// lista com resultados
"Envoltória";
85;
2;
resultados = List.Flatten([nome,areazona,pedireito,tipozona,orienta]);
false;
# ----------------------------------------
getHostedElements_40 = Element.GetHostedElements(element=filterByBoolMask_155.in)
janelas_da_fachada_40 = CodeBlock(janelasexternas=getHostedElements_40)  # same code as janelas_da_fachada
componentes_e_paf_44 = CodeBlock(zona=filterByBoolMask_153.in, a=python_script_44, areaabertura=janelas_da_fachada_40.out5)
# ---------- componentes_e_paf_44.designscript (10 lines) ----------
nome = zona.GetParameterValueByName("Nome");
sa = Math.Sum(a);
PAF = areaabertura/(areaabertura + sa);
cob = "Pvto interm.";
// lista com resultados
"Envoltória";
85;
9;
resultados = List.Flatten([nome,nome,cob,nome,nome,PAF]);
false;
# ----------------------------------------

# group: Zonas SE - Nível 1 > Exporta dados paredes para planilha
# Descrição <Clique duas vezes aqui para editar a descrição do grupo>
exportToExcel_81 = Data.ExportToExcel(filePath=file_path, sheetName=dados_qualitativos_pe_direito_e_41.out7, startRow=dados_qualitativos_pe_direito_e_41.out8, startColumn=dados_qualitativos_pe_direito_e_41.out9, data=dados_qualitativos_pe_direito_e_41.resultados@L3)
exportToExcel_82 = Data.ExportToExcel(filePath=file_path, sheetName=componentes_e_paf_41.out4, startRow=componentes_e_paf_41.out5, startColumn=componentes_e_paf_41.out6, data=componentes_e_paf_41.resultados@L3)

# group: Zonas SE - Nível 1 > Exporta dados paredes para planilha
# Descrição <Clique duas vezes aqui para editar a descrição do grupo>
exportToExcel_83 = Data.ExportToExcel(filePath=file_path, sheetName=dados_qualitativos_pe_direito_e_42.out7, startRow=dados_qualitativos_pe_direito_e_42.out8, startColumn=dados_qualitativos_pe_direito_e_42.out9, data=dados_qualitativos_pe_direito_e_42.resultados@L3)
exportToExcel_84 = Data.ExportToExcel(filePath=file_path, sheetName=componentes_e_paf_42.out4, startRow=componentes_e_paf_42.out5, startColumn=componentes_e_paf_42.out6, data=componentes_e_paf_42.resultados@L3)

# group: Zonas SE - Nível 1 > Exporta dados paredes para planilha
# Descrição <Clique duas vezes aqui para editar a descrição do grupo>
exportToExcel_85 = Data.ExportToExcel(filePath=file_path, sheetName=dados_qualitativos_pe_direito_e_43.out7, startRow=dados_qualitativos_pe_direito_e_43.out8, startColumn=dados_qualitativos_pe_direito_e_43.out9, data=dados_qualitativos_pe_direito_e_43.resultados@L3)
exportToExcel_86 = Data.ExportToExcel(filePath=file_path, sheetName=componentes_e_paf_43.out4, startRow=componentes_e_paf_43.out5, startColumn=componentes_e_paf_43.out6, data=componentes_e_paf_43.resultados@L3)

# group: Zonas SE - Nível 1 > Exporta dados paredes para planilha
# Descrição <Clique duas vezes aqui para editar a descrição do grupo>
exportToExcel_87 = Data.ExportToExcel(filePath=file_path, sheetName=dados_qualitativos_pe_direito_e_44.out7, startRow=dados_qualitativos_pe_direito_e_44.out8, startColumn=dados_qualitativos_pe_direito_e_44.out9, data=dados_qualitativos_pe_direito_e_44.resultados@L3)
exportToExcel_88 = Data.ExportToExcel(filePath=file_path, sheetName=componentes_e_paf_44.out4, startRow=componentes_e_paf_44.out5, startColumn=componentes_e_paf_44.out6, data=componentes_e_paf_44.resultados@L3)

# group: Zonas NO - Nível 1 > Seleciona Z1
# Descrição <Clique duas vezes aqui para editar a descrição do grupo>
filterByBoolMask_156 = List.FilterByBoolMask(list=filterByBoolMask_133.in, mask=code_block_94.out2)
code_block_110 = CodeBlock(a=filterByBoolMask_156.in) { b = a.Boundaries; List.Flatten(b); }
byJoinedCurves_48 = PolyCurve.ByJoinedCurves(curves=code_block_110.out1)
byPatch_48 = Surface.ByPatch(closedCurve=byJoinedCurves_48)

# group: Zonas NO - Nível 1 > Identifica quais paredes estão dentro da Zona N
# Descrição <Clique duas vezes aqui para editar a descrição do grupo>
doesIntersect_48 = Geometry.DoesIntersect(geometry=byPatch_48@L1, other=getLocation)
filterByBoolMask_157 = List.FilterByBoolMask(list=all_elements_of_category@L3, mask=doesIntersect_48)
code_block_111 = CodeBlock(a=filterByBoolMask_157.in) { b = List.Flatten(a); c = List.UniqueItems(b); List.Clean(c); }

# group: Zonas NO - Nível 1 > Seleciona paredes externas e internas
# Descrição <Clique duas vezes aqui para editar a descrição do grupo>
identifica_parede_relacionada_e_48 = CodeBlock(paredes=code_block_111.out2) { a = paredes.ElementType; b = a.GetParameterValueByName("Função"); b == 1; }  # "Identifica parede relacionada e se é externa"
filterByBoolMask_158 = List.FilterByBoolMask(list=code_block_111.out2, mask=identifica_parede_relacionada_e_48.out2)

# group: Zonas NO - Nível 1
# Descrição <Clique duas vezes aqui para editar a descrição do grupo>
paredes_externas_41 = CodeBlock(ParedesExt=filterByBoolMask_136.in) { ParedesExternas = List.Flatten(ParedesExt); a = ParedesExternas.GetParameterValueByName("Área"); }
python_script_45 = Python(IN[0]=paredes_externas_41.a)  # CPython3; same code as python_script
getHostedElements_41 = Element.GetHostedElements(element=filterByBoolMask_136.in)
janelas_da_fachada_41 = CodeBlock(janelasexternas=getHostedElements_41)  # same code as janelas_da_fachada
componentes_e_paf_45 = CodeBlock(zona=filterByBoolMask_134.in, a=python_script_45, areaabertura=janelas_da_fachada_41.out5)
# ---------- componentes_e_paf_45.designscript (10 lines) ----------
nome = zona.GetParameterValueByName("Nome");
sa = Math.Sum(a);
PAF = areaabertura/(areaabertura + sa);
cob = "Pvto interm.";
// lista com resultados
"Envoltória";
79;
9;
resultados = List.Flatten([nome,nome,cob,nome,nome,PAF]);
false;
# ----------------------------------------
paredes_externas_42 = CodeBlock(ParedesExt=filterByBoolMask_139.in) { ParedesExternas = List.Flatten(ParedesExt); a = ParedesExternas.GetParameterValueByName("Área"); }
python_script_46 = Python(IN[0]=paredes_externas_42.a)  # CPython3; same code as python_script
dados_qualitativos_pe_direito_e_45 = CodeBlock(a=python_script_46, Paredes=filterByBoolMask_139.in, zona=filterByBoolMask_137.in, superf=byPatch_42)  # "Dados qualitativos, pe direito e area"
# ---------- dados_qualitativos_pe_direito_e_45.designscript (13 lines) ----------
sa = Math.Sum(a);
b = Paredes.GetParameterValueByName("Altura desconectada");
pedireito = Math.Sum(a*b)/sa;
nome = zona.GetParameterValueByName("Nome");
areazona = Autodesk.Surface.Area(superf);
tipozona = "Perimetral";
orienta = "NO";
// lista com resultados
"Envoltória";
80;
2;
resultados = List.Flatten([nome,areazona,pedireito,tipozona,orienta]);
false;
# ----------------------------------------
getHostedElements_42 = Element.GetHostedElements(element=filterByBoolMask_139.in)
janelas_da_fachada_42 = CodeBlock(janelasexternas=getHostedElements_42)  # same code as janelas_da_fachada
componentes_e_paf_46 = CodeBlock(zona=filterByBoolMask_137.in, a=python_script_46, areaabertura=janelas_da_fachada_42.out5)
# ---------- componentes_e_paf_46.designscript (10 lines) ----------
nome = zona.GetParameterValueByName("Nome");
sa = Math.Sum(a);
PAF = areaabertura/(areaabertura + sa);
cob = "Pvto interm.";
// lista com resultados
"Envoltória";
80;
9;
resultados = List.Flatten([nome,nome,cob,nome,nome,PAF]);
false;
# ----------------------------------------
paredes_externas_43 = CodeBlock(ParedesExt=filterByBoolMask_142.in) { ParedesExternas = List.Flatten(ParedesExt); a = ParedesExternas.GetParameterValueByName("Área"); }
python_script_47 = Python(IN[0]=paredes_externas_43.a)  # CPython3; same code as python_script
dados_qualitativos_pe_direito_e_46 = CodeBlock(a=python_script_47, Paredes=filterByBoolMask_142.in, zona=filterByBoolMask_140.in, superf=byPatch_43)  # "Dados qualitativos, pe direito e area"
# ---------- dados_qualitativos_pe_direito_e_46.designscript (13 lines) ----------
sa = Math.Sum(a);
b = Paredes.GetParameterValueByName("Altura desconectada");
pedireito = Math.Sum(a*b)/sa;
nome = zona.GetParameterValueByName("Nome");
areazona = Autodesk.Surface.Area(superf);
tipozona = "Perimetral";
orienta = "NO";
// lista com resultados
"Envoltória";
81;
2;
resultados = List.Flatten([nome,areazona,pedireito,tipozona,orienta]);
false;
# ----------------------------------------
getHostedElements_43 = Element.GetHostedElements(element=filterByBoolMask_142.in)
janelas_da_fachada_43 = CodeBlock(janelasexternas=getHostedElements_43)  # same code as janelas_da_fachada
componentes_e_paf_47 = CodeBlock(zona=filterByBoolMask_140.in, a=python_script_47, areaabertura=janelas_da_fachada_43.out5)
# ---------- componentes_e_paf_47.designscript (10 lines) ----------
nome = zona.GetParameterValueByName("Nome");
sa = Math.Sum(a);
PAF = areaabertura/(areaabertura + sa);
cob = "Pvto interm.";
// lista com resultados
"Envoltória";
81;
9;
resultados = List.Flatten([nome,nome,cob,nome,nome,PAF]);
false;
# ----------------------------------------
dados_qualitativos_pe_direito_e_47 = CodeBlock(a=python_script_45, Paredes=filterByBoolMask_136.in, zona=filterByBoolMask_134.in, superf=byPatch_41)  # "Dados qualitativos, pe direito e area"
# ---------- dados_qualitativos_pe_direito_e_47.designscript (13 lines) ----------
sa = Math.Sum(a);
b = Paredes.GetParameterValueByName("Altura desconectada");
pedireito = Math.Sum(a*b)/sa;
nome = zona.GetParameterValueByName("Nome");
areazona = Autodesk.Surface.Area(superf);
tipozona = "Perimetral";
orienta = "NO";
// lista com resultados
"Envoltória";
79;
2;
resultados = List.Flatten([nome,areazona,pedireito,tipozona,orienta]);
false;
# ----------------------------------------
paredes_externas_44 = CodeBlock(ParedesExt=filterByBoolMask_158.in) { ParedesExternas = List.Flatten(ParedesExt); a = ParedesExternas.GetParameterValueByName("Área"); }
python_script_48 = Python(IN[0]=paredes_externas_44.a)  # CPython3; same code as python_script
dados_qualitativos_pe_direito_e_48 = CodeBlock(a=python_script_48, Paredes=filterByBoolMask_158.in, zona=filterByBoolMask_156.in, superf=byPatch_48)  # "Dados qualitativos, pe direito e area"
# ---------- dados_qualitativos_pe_direito_e_48.designscript (13 lines) ----------
sa = Math.Sum(a);
b = Paredes.GetParameterValueByName("Altura desconectada");
pedireito = Math.Sum(a*b)/sa;
nome = zona.GetParameterValueByName("Nome");
areazona = Autodesk.Surface.Area(superf);
tipozona = "Perimetral";
orienta = "NO";
// lista com resultados
"Envoltória";
78;
2;
resultados = List.Flatten([nome,areazona,pedireito,tipozona,orienta]);
false;
# ----------------------------------------
getHostedElements_44 = Element.GetHostedElements(element=filterByBoolMask_158.in)
janelas_da_fachada_44 = CodeBlock(janelasexternas=getHostedElements_44)  # same code as janelas_da_fachada
componentes_e_paf_48 = CodeBlock(zona=filterByBoolMask_156.in, a=python_script_48, areaabertura=janelas_da_fachada_44.out5)
# ---------- componentes_e_paf_48.designscript (10 lines) ----------
nome = zona.GetParameterValueByName("Nome");
sa = Math.Sum(a);
PAF = areaabertura/(areaabertura + sa);
cob = "Pvto interm.";
// lista com resultados
"Envoltória";
78;
9;
resultados = List.Flatten([nome,nome,cob,nome,nome,PAF]);
false;
# ----------------------------------------

# group: Zonas NO - Nível 1 > Exporta dados paredes para planilha
# Descrição <Clique duas vezes aqui para editar a descrição do grupo>
exportToExcel_89 = Data.ExportToExcel(filePath=file_path, sheetName=componentes_e_paf_45.out4, startRow=componentes_e_paf_45.out5, startColumn=componentes_e_paf_45.out6, data=componentes_e_paf_45.resultados@L3)
exportToExcel_90 = Data.ExportToExcel(filePath=file_path, sheetName=dados_qualitativos_pe_direito_e_47.out7, startRow=dados_qualitativos_pe_direito_e_47.out8, startColumn=dados_qualitativos_pe_direito_e_47.out9, data=dados_qualitativos_pe_direito_e_47.resultados@L3)

# group: Zonas NO - Nível 1 > Exporta dados paredes para planilha
# Descrição <Clique duas vezes aqui para editar a descrição do grupo>
exportToExcel_91 = Data.ExportToExcel(filePath=file_path, sheetName=dados_qualitativos_pe_direito_e_45.out7, startRow=dados_qualitativos_pe_direito_e_45.out8, startColumn=dados_qualitativos_pe_direito_e_45.out9, data=dados_qualitativos_pe_direito_e_45.resultados@L3)
exportToExcel_92 = Data.ExportToExcel(filePath=file_path, sheetName=componentes_e_paf_46.out4, startRow=componentes_e_paf_46.out5, startColumn=componentes_e_paf_46.out6, data=componentes_e_paf_46.resultados@L3)

# group: Zonas NO - Nível 1 > Exporta dados paredes para planilha
# Descrição <Clique duas vezes aqui para editar a descrição do grupo>
exportToExcel_93 = Data.ExportToExcel(filePath=file_path, sheetName=dados_qualitativos_pe_direito_e_46.out7, startRow=dados_qualitativos_pe_direito_e_46.out8, startColumn=dados_qualitativos_pe_direito_e_46.out9, data=dados_qualitativos_pe_direito_e_46.resultados@L3)
exportToExcel_94 = Data.ExportToExcel(filePath=file_path, sheetName=componentes_e_paf_47.out4, startRow=componentes_e_paf_47.out5, startColumn=componentes_e_paf_47.out6, data=componentes_e_paf_47.resultados@L3)

# group: Zonas NO - Nível 1 > Exporta dados paredes para planilha
# Descrição <Clique duas vezes aqui para editar a descrição do grupo>
exportToExcel_95 = Data.ExportToExcel(filePath=file_path, sheetName=dados_qualitativos_pe_direito_e_48.out7, startRow=dados_qualitativos_pe_direito_e_48.out8, startColumn=dados_qualitativos_pe_direito_e_48.out9, data=dados_qualitativos_pe_direito_e_48.resultados@L3)
exportToExcel_96 = Data.ExportToExcel(filePath=file_path, sheetName=componentes_e_paf_48.out4, startRow=componentes_e_paf_48.out5, startColumn=componentes_e_paf_48.out6, data=componentes_e_paf_48.resultados@L3)

# group: Zonas N - Nível 1 > Seleciona Zona N
# Descrição <Clique duas vezes aqui para editar a descrição do grupo>
filterByBoolMask_159 = List.FilterByBoolMask(list=filterByBoolMask_119.in, mask=code_block_84.out2)

# group: Zonas N - Nível 1 > Identifica numeração da zona
# Descrição <Clique duas vezes aqui para editar a descrição do grupo>
code_block_112 = CodeBlock(area=filterByBoolMask_159.in)  # same code as code_block_3

# group: Zonas N - Nível 1 > Seleciona Z1
# Descrição <Clique duas vezes aqui para editar a descrição do grupo>
filterByBoolMask_160 = List.FilterByBoolMask(list=filterByBoolMask_159.in, mask=code_block_112.out2)
code_block_113 = CodeBlock(a=filterByBoolMask_160.in) { b = a.Boundaries; List.Flatten(b); }
byJoinedCurves_49 = PolyCurve.ByJoinedCurves(curves=code_block_113.out1)
byPatch_49 = Surface.ByPatch(closedCurve=byJoinedCurves_49)

# group: Zonas N - Nível 1 > Identifica quais paredes estão dentro da Zona N
# Descrição <Clique duas vezes aqui para editar a descrição do grupo>
doesIntersect_49 = Geometry.DoesIntersect(geometry=byPatch_49@L1, other=getLocation)
filterByBoolMask_161 = List.FilterByBoolMask(list=all_elements_of_category@L3, mask=doesIntersect_49)
code_block_114 = CodeBlock(a=filterByBoolMask_161.in) { b = List.Flatten(a); c = List.UniqueItems(b); List.Clean(c); }

# group: Zonas N - Nível 1 > Seleciona paredes externas e internas
# Descrição <Clique duas vezes aqui para editar a descrição do grupo>
identifica_parede_relacionada_e_49 = CodeBlock(paredes=code_block_114.out2) { a = paredes.ElementType; b = a.GetParameterValueByName("Função"); b == 1; }  # "Identifica parede relacionada e se é externa"
filterByBoolMask_162 = List.FilterByBoolMask(list=code_block_114.out2, mask=identifica_parede_relacionada_e_49.out2)

# group: Zonas N - Nível 1 > Seleciona Z2
# Descrição <Clique duas vezes aqui para editar a descrição do grupo>
filterByBoolMask_163 = List.FilterByBoolMask(list=filterByBoolMask_159.in, mask=code_block_112.out3)
code_block_115 = CodeBlock(a=filterByBoolMask_163.in) { b = a.Boundaries; List.Flatten(b); }
byJoinedCurves_50 = PolyCurve.ByJoinedCurves(curves=code_block_115.out1)
byPatch_50 = Surface.ByPatch(closedCurve=byJoinedCurves_50)

# group: Zonas N - Nível 1 > Identifica quais paredes estão dentro da Zona N
# Descrição <Clique duas vezes aqui para editar a descrição do grupo>
doesIntersect_50 = Geometry.DoesIntersect(geometry=byPatch_50@L1, other=getLocation)
filterByBoolMask_164 = List.FilterByBoolMask(list=all_elements_of_category@L3, mask=doesIntersect_50)
code_block_116 = CodeBlock(a=filterByBoolMask_164.in) { b = List.Flatten(a); c = List.UniqueItems(b); List.Clean(c); }

# group: Zonas N - Nível 1 > Seleciona paredes externas e internas
# Descrição <Clique duas vezes aqui para editar a descrição do grupo>
identifica_parede_relacionada_e_50 = CodeBlock(paredes=code_block_116.out2) { a = paredes.ElementType; b = a.GetParameterValueByName("Função"); b == 1; }  # "Identifica parede relacionada e se é externa"
filterByBoolMask_165 = List.FilterByBoolMask(list=code_block_116.out2, mask=identifica_parede_relacionada_e_50.out2)

# group: Zonas N - Nível 1 > Seleciona Z3
# Descrição <Clique duas vezes aqui para editar a descrição do grupo>
filterByBoolMask_166 = List.FilterByBoolMask(list=filterByBoolMask_159.in, mask=code_block_112.out4)
code_block_117 = CodeBlock(a=filterByBoolMask_166.in) { b = a.Boundaries; List.Flatten(b); }
byJoinedCurves_51 = PolyCurve.ByJoinedCurves(curves=code_block_117.out1)
byPatch_51 = Surface.ByPatch(closedCurve=byJoinedCurves_51)

# group: Zonas N - Nível 1 > Identifica quais paredes estão dentro da Zona N
# Descrição <Clique duas vezes aqui para editar a descrição do grupo>
doesIntersect_51 = Geometry.DoesIntersect(geometry=byPatch_51@L1, other=getLocation)
filterByBoolMask_167 = List.FilterByBoolMask(list=all_elements_of_category@L3, mask=doesIntersect_51)
code_block_118 = CodeBlock(a=filterByBoolMask_167.in) { b = List.Flatten(a); c = List.UniqueItems(b); List.Clean(c); }

# group: Zonas N - Nível 1 > Seleciona paredes externas e internas
# Descrição <Clique duas vezes aqui para editar a descrição do grupo>
identifica_parede_relacionada_e_51 = CodeBlock(paredes=code_block_118.out2) { a = paredes.ElementType; b = a.GetParameterValueByName("Função"); b == 1; }  # "Identifica parede relacionada e se é externa"
filterByBoolMask_168 = List.FilterByBoolMask(list=code_block_118.out2, mask=identifica_parede_relacionada_e_51.out2)

# group: Zonas N - Nível 1 > Seleciona Z4
# Descrição <Clique duas vezes aqui para editar a descrição do grupo>
filterByBoolMask_169 = List.FilterByBoolMask(list=filterByBoolMask_159.in, mask=code_block_112.out5)
code_block_119 = CodeBlock(a=filterByBoolMask_169.in) { b = a.Boundaries; List.Flatten(b); }
byJoinedCurves_52 = PolyCurve.ByJoinedCurves(curves=code_block_119.out1)
byPatch_52 = Surface.ByPatch(closedCurve=byJoinedCurves_52)

# group: Zonas N - Nível 1 > Identifica quais paredes estão dentro da Zona N
# Descrição <Clique duas vezes aqui para editar a descrição do grupo>
doesIntersect_52 = Geometry.DoesIntersect(geometry=byPatch_52@L1, other=getLocation)
filterByBoolMask_170 = List.FilterByBoolMask(list=all_elements_of_category@L3, mask=doesIntersect_52)
code_block_120 = CodeBlock(a=filterByBoolMask_170.in) { b = List.Flatten(a); c = List.UniqueItems(b); List.Clean(c); }

# group: Zonas N - Nível 1 > Seleciona paredes externas e internas
# Descrição <Clique duas vezes aqui para editar a descrição do grupo>
identifica_parede_relacionada_e_52 = CodeBlock(paredes=code_block_120.out2) { a = paredes.ElementType; b = a.GetParameterValueByName("Função"); b == 1; }  # "Identifica parede relacionada e se é externa"
filterByBoolMask_171 = List.FilterByBoolMask(list=code_block_120.out2, mask=identifica_parede_relacionada_e_52.out2)

# group: Zonas N - Nível 1
# Descrição <Clique duas vezes aqui para editar a descrição do grupo>
paredes_externas_45 = CodeBlock(ParedesExt=filterByBoolMask_162.in) { ParedesExternas = List.Flatten(ParedesExt); a = ParedesExternas.GetParameterValueByName("Área"); }
python_script_49 = Python(IN[0]=paredes_externas_45.a)  # CPython3; same code as python_script
dados_qualitativos_pe_direito_e_49 = CodeBlock(a=python_script_49, Paredes=filterByBoolMask_162.in, zona=filterByBoolMask_160.in, superf=byPatch_49)  # "Dados qualitativos, pe direito e area"
# ---------- dados_qualitativos_pe_direito_e_49.designscript (13 lines) ----------
sa = Math.Sum(a);
b = Paredes.GetParameterValueByName("Altura desconectada");
pedireito = Math.Sum(a*b)/sa;
nome = zona.GetParameterValueByName("Nome");
areazona = Autodesk.Surface.Area(superf);
tipozona = "Perimetral";
orienta = "N";
// lista com resultados
"Envoltória";
54;
2;
resultados = List.Flatten([nome,areazona,pedireito,tipozona,orienta]);
false;
# ----------------------------------------
getHostedElements_45 = Element.GetHostedElements(element=filterByBoolMask_162.in)
janelas_da_fachada_45 = CodeBlock(janelasexternas=getHostedElements_45)  # same code as janelas_da_fachada
componentes_e_paf_49 = CodeBlock(zona=filterByBoolMask_160.in, a=python_script_49, areaabertura=janelas_da_fachada_45.out5)
# ---------- componentes_e_paf_49.designscript (10 lines) ----------
nome = zona.GetParameterValueByName("Nome");
sa = Math.Sum(a);
PAF = areaabertura/(areaabertura + sa);
cob = "Pvto interm.";
// lista com resultados
"Envoltória";
54;
9;
resultados = List.Flatten([nome,nome,cob,nome,nome,PAF]);
false;
# ----------------------------------------
paredes_externas_46 = CodeBlock(ParedesExt=filterByBoolMask_165.in) { ParedesExternas = List.Flatten(ParedesExt); a = ParedesExternas.GetParameterValueByName("Área"); }
python_script_50 = Python(IN[0]=paredes_externas_46.a)  # CPython3; same code as python_script
getHostedElements_46 = Element.GetHostedElements(element=filterByBoolMask_165.in)
janelas_da_fachada_46 = CodeBlock(janelasexternas=getHostedElements_46)  # same code as janelas_da_fachada
componentes_e_paf_50 = CodeBlock(zona=filterByBoolMask_163.in, a=python_script_50, areaabertura=janelas_da_fachada_46.out5)
# ---------- componentes_e_paf_50.designscript (10 lines) ----------
nome = zona.GetParameterValueByName("Nome");
sa = Math.Sum(a);
PAF = areaabertura/(areaabertura + sa);
cob = "Pvto interm.";
// lista com resultados
"Envoltória";
55;
9;
resultados = List.Flatten([nome,nome,cob,nome,nome,PAF]);
false;
# ----------------------------------------
dados_qualitativos_pe_direito_e_50 = CodeBlock(a=python_script_50, Paredes=filterByBoolMask_165.in, zona=filterByBoolMask_163.in, superf=byPatch_50)  # "Dados qualitativos, pe direito e area"
# ---------- dados_qualitativos_pe_direito_e_50.designscript (13 lines) ----------
sa = Math.Sum(a);
b = Paredes.GetParameterValueByName("Altura desconectada");
pedireito = Math.Sum(a*b)/sa;
nome = zona.GetParameterValueByName("Nome");
areazona = Autodesk.Surface.Area(superf);
tipozona = "Perimetral";
orienta = "N";
// lista com resultados
"Envoltória";
55;
2;
resultados = List.Flatten([nome,areazona,pedireito,tipozona,orienta]);
false;
# ----------------------------------------
paredes_externas_47 = CodeBlock(ParedesExt=filterByBoolMask_168.in) { ParedesExternas = List.Flatten(ParedesExt); a = ParedesExternas.GetParameterValueByName("Área"); }
python_script_51 = Python(IN[0]=paredes_externas_47.a)  # CPython3; same code as python_script
dados_qualitativos_pe_direito_e_51 = CodeBlock(a=python_script_51, Paredes=filterByBoolMask_168.in, zona=filterByBoolMask_166.in, superf=byPatch_51)  # "Dados qualitativos, pe direito e area"
# ---------- dados_qualitativos_pe_direito_e_51.designscript (13 lines) ----------
sa = Math.Sum(a);
b = Paredes.GetParameterValueByName("Altura desconectada");
pedireito = Math.Sum(a*b)/sa;
nome = zona.GetParameterValueByName("Nome");
areazona = Autodesk.Surface.Area(superf);
tipozona = "Perimetral";
orienta = "N";
// lista com resultados
"Envoltória";
56;
2;
resultados = List.Flatten([nome,areazona,pedireito,tipozona,orienta]);
false;
# ----------------------------------------
getHostedElements_47 = Element.GetHostedElements(element=filterByBoolMask_168.in)
janelas_da_fachada_47 = CodeBlock(janelasexternas=getHostedElements_47)  # same code as janelas_da_fachada
componentes_e_paf_51 = CodeBlock(zona=filterByBoolMask_166.in, a=python_script_51, areaabertura=janelas_da_fachada_47.out5)
# ---------- componentes_e_paf_51.designscript (10 lines) ----------
nome = zona.GetParameterValueByName("Nome");
sa = Math.Sum(a);
PAF = areaabertura/(areaabertura + sa);
cob = "Pvto interm.";
// lista com resultados
"Envoltória";
56;
9;
resultados = List.Flatten([nome,nome,cob,nome,nome,PAF]);
false;
# ----------------------------------------
paredes_externas_48 = CodeBlock(ParedesExt=filterByBoolMask_171.in) { ParedesExternas = List.Flatten(ParedesExt); a = ParedesExternas.GetParameterValueByName("Área"); }
python_script_52 = Python(IN[0]=paredes_externas_48.a)  # CPython3; same code as python_script
dados_qualitativos_pe_direito_e_52 = CodeBlock(a=python_script_52, Paredes=filterByBoolMask_171.in, zona=filterByBoolMask_169.in, superf=byPatch_52)  # "Dados qualitativos, pe direito e area"
# ---------- dados_qualitativos_pe_direito_e_52.designscript (13 lines) ----------
sa = Math.Sum(a);
b = Paredes.GetParameterValueByName("Altura desconectada");
pedireito = Math.Sum(a*b)/sa;
nome = zona.GetParameterValueByName("Nome");
areazona = Autodesk.Surface.Area(superf);
tipozona = "Perimetral";
orienta = "N";
// lista com resultados
"Envoltória";
57;
2;
resultados = List.Flatten([nome,areazona,pedireito,tipozona,orienta]);
false;
# ----------------------------------------
getHostedElements_48 = Element.GetHostedElements(element=filterByBoolMask_171.in)
janelas_da_fachada_48 = CodeBlock(janelasexternas=getHostedElements_48)  # same code as janelas_da_fachada
componentes_e_paf_52 = CodeBlock(zona=filterByBoolMask_169.in, a=python_script_52, areaabertura=janelas_da_fachada_48.out5)
# ---------- componentes_e_paf_52.designscript (10 lines) ----------
nome = zona.GetParameterValueByName("Nome");
sa = Math.Sum(a);
PAF = areaabertura/(areaabertura + sa);
cob = "Pvto interm.";
// lista com resultados
"Envoltória";
57;
9;
resultados = List.Flatten([nome,nome,cob,nome,nome,PAF]);
false;
# ----------------------------------------

# group: Zonas N - Nível 1 > Exporta dados paredes para planilha
# Descrição <Clique duas vezes aqui para editar a descrição do grupo>
exportToExcel_97 = Data.ExportToExcel(filePath=file_path, sheetName=dados_qualitativos_pe_direito_e_49.out7, startRow=dados_qualitativos_pe_direito_e_49.out8, startColumn=dados_qualitativos_pe_direito_e_49.out9, data=dados_qualitativos_pe_direito_e_49.resultados@L3)
exportToExcel_98 = Data.ExportToExcel(filePath=file_path, sheetName=componentes_e_paf_49.out4, startRow=componentes_e_paf_49.out5, startColumn=componentes_e_paf_49.out6, data=componentes_e_paf_49.resultados@L3)

# group: Zonas N - Nível 1 > Exporta dados paredes para planilha
# Descrição <Clique duas vezes aqui para editar a descrição do grupo>
exportToExcel_99 = Data.ExportToExcel(filePath=file_path, sheetName=componentes_e_paf_50.out4, startRow=componentes_e_paf_50.out5, startColumn=componentes_e_paf_50.out6, data=componentes_e_paf_50.resultados@L3)
exportToExcel_100 = Data.ExportToExcel(filePath=file_path, sheetName=dados_qualitativos_pe_direito_e_50.out7, startRow=dados_qualitativos_pe_direito_e_50.out8, startColumn=dados_qualitativos_pe_direito_e_50.out9, data=dados_qualitativos_pe_direito_e_50.resultados@L3)

# group: Zonas N - Nível 1 > Exporta dados paredes para planilha
# Descrição <Clique duas vezes aqui para editar a descrição do grupo>
exportToExcel_101 = Data.ExportToExcel(filePath=file_path, sheetName=dados_qualitativos_pe_direito_e_51.out7, startRow=dados_qualitativos_pe_direito_e_51.out8, startColumn=dados_qualitativos_pe_direito_e_51.out9, data=dados_qualitativos_pe_direito_e_51.resultados@L3)
exportToExcel_102 = Data.ExportToExcel(filePath=file_path, sheetName=componentes_e_paf_51.out4, startRow=componentes_e_paf_51.out5, startColumn=componentes_e_paf_51.out6, data=componentes_e_paf_51.resultados@L3)

# group: Zonas N - Nível 1 > Exporta dados paredes para planilha
# Descrição <Clique duas vezes aqui para editar a descrição do grupo>
exportToExcel_103 = Data.ExportToExcel(filePath=file_path, sheetName=dados_qualitativos_pe_direito_e_52.out7, startRow=dados_qualitativos_pe_direito_e_52.out8, startColumn=dados_qualitativos_pe_direito_e_52.out9, data=dados_qualitativos_pe_direito_e_52.resultados@L3)
exportToExcel_104 = Data.ExportToExcel(filePath=file_path, sheetName=componentes_e_paf_52.out4, startRow=componentes_e_paf_52.out5, startColumn=componentes_e_paf_52.out6, data=componentes_e_paf_52.resultados@L3)

# group: Zonas L - Nível 1 > Seleciona Zona L
# Descrição <Clique duas vezes aqui para editar a descrição do grupo>
filterByBoolMask_172 = List.FilterByBoolMask(list=filterByBoolMask_119.in, mask=code_block_84.out3)

# group: Zonas L - Nível 1 > Identifica numeração da zona
# Descrição <Clique duas vezes aqui para editar a descrição do grupo>
code_block_121 = CodeBlock(area=filterByBoolMask_172.in)  # same code as code_block_3

# group: Zonas L - Nível 1 > Seleciona Z1
# Descrição <Clique duas vezes aqui para editar a descrição do grupo>
filterByBoolMask_173 = List.FilterByBoolMask(list=filterByBoolMask_172.in, mask=code_block_121.out2)
code_block_122 = CodeBlock(a=filterByBoolMask_173.in) { b = a.Boundaries; List.Flatten(b); }
byJoinedCurves_53 = PolyCurve.ByJoinedCurves(curves=code_block_122.out1)
byPatch_53 = Surface.ByPatch(closedCurve=byJoinedCurves_53)

# group: Zonas L - Nível 1 > Identifica quais paredes estão dentro da Zona N
# Descrição <Clique duas vezes aqui para editar a descrição do grupo>
doesIntersect_53 = Geometry.DoesIntersect(geometry=byPatch_53@L1, other=getLocation)
filterByBoolMask_174 = List.FilterByBoolMask(list=all_elements_of_category@L3, mask=doesIntersect_53)
code_block_123 = CodeBlock(a=filterByBoolMask_174.in) { b = List.Flatten(a); c = List.UniqueItems(b); List.Clean(c); }

# group: Zonas L - Nível 1 > Seleciona paredes externas e internas
# Descrição <Clique duas vezes aqui para editar a descrição do grupo>
identifica_parede_relacionada_e_53 = CodeBlock(paredes=code_block_123.out2) { a = paredes.ElementType; b = a.GetParameterValueByName("Função"); b == 1; }  # "Identifica parede relacionada e se é externa"
filterByBoolMask_175 = List.FilterByBoolMask(list=code_block_123.out2, mask=identifica_parede_relacionada_e_53.out2)

# group: Zonas L - Nível 1 > Seleciona Z2
# Descrição <Clique duas vezes aqui para editar a descrição do grupo>
filterByBoolMask_176 = List.FilterByBoolMask(list=filterByBoolMask_172.in, mask=code_block_121.out3)
code_block_124 = CodeBlock(a=filterByBoolMask_176.in) { b = a.Boundaries; List.Flatten(b); }
byJoinedCurves_54 = PolyCurve.ByJoinedCurves(curves=code_block_124.out1)
byPatch_54 = Surface.ByPatch(closedCurve=byJoinedCurves_54)

# group: Zonas L - Nível 1 > Identifica quais paredes estão dentro da Zona N
# Descrição <Clique duas vezes aqui para editar a descrição do grupo>
doesIntersect_54 = Geometry.DoesIntersect(geometry=byPatch_54@L1, other=getLocation)
filterByBoolMask_177 = List.FilterByBoolMask(list=all_elements_of_category@L3, mask=doesIntersect_54)
code_block_125 = CodeBlock(a=filterByBoolMask_177.in) { b = List.Flatten(a); c = List.UniqueItems(b); List.Clean(c); }

# group: Zonas L - Nível 1 > Seleciona paredes externas e internas
# Descrição <Clique duas vezes aqui para editar a descrição do grupo>
identifica_parede_relacionada_e_54 = CodeBlock(paredes=code_block_125.out2) { a = paredes.ElementType; b = a.GetParameterValueByName("Função"); b == 1; }  # "Identifica parede relacionada e se é externa"
filterByBoolMask_178 = List.FilterByBoolMask(list=code_block_125.out2, mask=identifica_parede_relacionada_e_54.out2)

# group: Zonas L - Nível 1 > Seleciona Z3
# Descrição <Clique duas vezes aqui para editar a descrição do grupo>
filterByBoolMask_179 = List.FilterByBoolMask(list=filterByBoolMask_172.in, mask=code_block_121.out4)
code_block_126 = CodeBlock(a=filterByBoolMask_179.in) { b = a.Boundaries; List.Flatten(b); }
byJoinedCurves_55 = PolyCurve.ByJoinedCurves(curves=code_block_126.out1)
byPatch_55 = Surface.ByPatch(closedCurve=byJoinedCurves_55)

# group: Zonas L - Nível 1 > Identifica quais paredes estão dentro da Zona N
# Descrição <Clique duas vezes aqui para editar a descrição do grupo>
doesIntersect_55 = Geometry.DoesIntersect(geometry=byPatch_55@L1, other=getLocation)
filterByBoolMask_180 = List.FilterByBoolMask(list=all_elements_of_category@L3, mask=doesIntersect_55)
code_block_127 = CodeBlock(a=filterByBoolMask_180.in) { b = List.Flatten(a); c = List.UniqueItems(b); List.Clean(c); }

# group: Zonas L - Nível 1 > Seleciona paredes externas e internas
# Descrição <Clique duas vezes aqui para editar a descrição do grupo>
identifica_parede_relacionada_e_55 = CodeBlock(paredes=code_block_127.out2) { a = paredes.ElementType; b = a.GetParameterValueByName("Função"); b == 1; }  # "Identifica parede relacionada e se é externa"
filterByBoolMask_181 = List.FilterByBoolMask(list=code_block_127.out2, mask=identifica_parede_relacionada_e_55.out2)

# group: Zonas L - Nível 1 > Seleciona Z4
# Descrição <Clique duas vezes aqui para editar a descrição do grupo>
filterByBoolMask_182 = List.FilterByBoolMask(list=filterByBoolMask_172.in, mask=code_block_121.out5)
code_block_128 = CodeBlock(a=filterByBoolMask_182.in) { b = a.Boundaries; List.Flatten(b); }
byJoinedCurves_56 = PolyCurve.ByJoinedCurves(curves=code_block_128.out1)
byPatch_56 = Surface.ByPatch(closedCurve=byJoinedCurves_56)

# group: Zonas L - Nível 1 > Identifica quais paredes estão dentro da Zona N
# Descrição <Clique duas vezes aqui para editar a descrição do grupo>
doesIntersect_56 = Geometry.DoesIntersect(geometry=byPatch_56@L1, other=getLocation)
filterByBoolMask_183 = List.FilterByBoolMask(list=all_elements_of_category@L3, mask=doesIntersect_56)
code_block_129 = CodeBlock(a=filterByBoolMask_183.in) { b = List.Flatten(a); c = List.UniqueItems(b); List.Clean(c); }

# group: Zonas L - Nível 1 > Seleciona paredes externas e internas
# Descrição <Clique duas vezes aqui para editar a descrição do grupo>
identifica_parede_relacionada_e_56 = CodeBlock(paredes=code_block_129.out2) { a = paredes.ElementType; b = a.GetParameterValueByName("Função"); b == 1; }  # "Identifica parede relacionada e se é externa"
filterByBoolMask_184 = List.FilterByBoolMask(list=code_block_129.out2, mask=identifica_parede_relacionada_e_56.out2)

# group: Zonas L - Nível 1
# Descrição <Clique duas vezes aqui para editar a descrição do grupo>
paredes_externas_49 = CodeBlock(ParedesExt=filterByBoolMask_175.in) { ParedesExternas = List.Flatten(ParedesExt); a = ParedesExternas.GetParameterValueByName("Área"); }
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