# Dynamo graph Aba Geração de Energia - QiBuilder.dyn (Dynamo 3.3.0.6316)

# group: Recebe modelos genéricos
# Descrição <Clique duas vezes aqui para editar a descrição do grupo>
categories = Categories("OST_GenericModel")
all_elements_of_category = ElementsOfCategory(Category=categories)

# group: Separa os painéis e identifica os tipos adotados
# Descrição <Clique duas vezes aqui para editar a descrição do grupo>
code_block = CodeBlock(paineis=all_elements_of_category) { l = paineis.GetParameterValueByName("Aplicação"); }
code_block_2 = CodeBlock { "Módulo fotovoltaico"; }
contains = String.Contains(string=code_block, searchFor=code_block_2)
filterByBoolMask = List.FilterByBoolMask(list=all_elements_of_category, mask=contains)
uniqueItems = List.UniqueItems(list=filterByBoolMask.in)

# group: Recebe a região da edificação
# Descrição <Clique duas vezes aqui para editar a descrição do grupo>
python_script = Python()  # CPython3; unwired: IN[0]
# ---------- python_script.python (64 lines) ----------
import clr
clr.AddReference('System.Windows.Forms')
from System.Windows.Forms import Form, Label, ComboBox, Button, AnchorStyles

class RegionSelector(Form):
    def __init__(self):
        self.Text = "Seleção de Região"
        self.Width = 300
        self.Height = 180
        self.StartPosition = 1  # Centraliza na tela

        # Label
        self.label = Label()
        self.label.Text = "Escolha a região:"
        self.label.Left = 20
        self.label.Top = 20
        self.label.Width = 240

        # Combobox
        self.combo = ComboBox()
        self.combo.Left = 20
        self.combo.Top = 50
        self.combo.Width = 240
        self.combo.Items.AddRange(["Norte", "Nordeste", "Centro-Oeste", "Sudeste", "Sul"])
        self.combo.SelectedIndex = 0

        # Botão OK
        self.ok_button = Button()
        self.ok_button.Text = "OK"
        self.ok_button.Left = 100
        self.ok_button.Top = 90
        self.ok_button.Width = 80
        self.ok_button.Anchor = AnchorStyles.Bottom
        self.ok_button.Click += self.ok_clicked

        # Adiciona os controles
        self.Controls.Add(self.label)
        self.Controls.Add(self.combo)
        self.Controls.Add(self.ok_button)

        self.result = None

    def ok_clicked(self, sender, args):
        self.result = self.combo.SelectedItem
        self.Close()

# --- Executa a janela ---
form = RegionSelector()
form.ShowDialog()

region = form.result

# --- Associa valores numéricos ---
values = {
    "Norte": 1191.0,
    "Nordeste": 1844.0,
    "Centro-Oeste": 1652.0,
    "Sudeste": 1733.0,
    "Sul": 1532.0
}

numeric_value = values.get(region, None)

OUT = (region, numeric_value)
# ----------------------------------------
code_block_3 = CodeBlock(a=python_script) { a[1]; }

# group: Busca parâmetros e calcula geração estimada
# Descrição <Clique duas vezes aqui para editar a descrição do grupo>
code_block_4 = CodeBlock(paineis=uniqueItems)
# ---------- code_block_4.designscript (6 lines) ----------
l = paineis.GetParameterValueByName("Comprimento");
h = paineis.GetParameterValueByName("Largura");
areas= h*l/1000;
paineis.GetParameterValueByName("Modelo");
paineis.GetParameterValueByName("Eficiência");
paineis.GetParameterValueByName("Descrição");
# ----------------------------------------
contains_2 = List.Contains(list=all_elements_of_category@L1, item=uniqueItems, lacing=CrossProduct)
transpose = List.Transpose(lists=contains_2)
countTrue = List.CountTrue(list=transpose@L2)
mul = countTrue * code_block_4.areas
mul_2 = mul * code_block_3

# group: Organiza os resultados
# Descrição <Clique duas vezes aqui para editar a descrição do grupo>
code_block_5 = CodeBlock { "Fotovoltaico"; }
count = List.Count(list=uniqueItems)
ofRepeatedItem = List.OfRepeatedItem(item=code_block_5, amount=count)
code_block_6 = CodeBlock(sistema=ofRepeatedItem, modelo=code_block_4.out3, qtd=countTrue, eficiencia=code_block_4.out4, caract=code_block_4.out5, geraestimada=mul_2) { "Opc_Geração"; 12; 1; List.Transpose([sistema, modelo, qtd, eficiencia, caract, geraestimada]); }

# group: Exporta dados
# Descrição <Clique duas vezes aqui para editar a descrição do grupo>
file_path = Filename("..\..\estudo de caso\INI_C-input_interface.xlsx")
exportToExcel = Data.ExportToExcel(filePath=file_path, sheetName=code_block_6.out0, startRow=code_block_6.out1, startColumn=code_block_6.out2, data=code_block_6.out3)
