# Dynamo graph Aba Iluminação.dyn (Dynamo 3.3.0.6316)

# group: Recebe Luminárias
# Descrição <Clique duas vezes aqui para editar a descrição do grupo>
categories = Categories("OST_LightingFixtures")
all_elements_of_category = ElementsOfCategory(Category=categories)

code_block = CodeBlock { 4; }
dropItems = List.DropItems(list=all_elements_of_category, amount=code_block)

# group: Identifica qual ambiente de cada luminária
# Descrição <Clique duas vezes aqui para editar a descrição do grupo>
room = FamilyInstance.Room(familyInstance=dropItems@L2)
code_block_2 = CodeBlock { "Nome"; }
parameterByName = Parameter.ParameterByName(element=room, name=code_block_2)
string_from_object = FromObject(object=parameterByName)
code_block_3 = CodeBlock { 0; 7; }
remove = String.Remove(string=string_from_object@L2, startIndex=code_block_3.out0, count=code_block_3.out1)

# group: Reune as luminárias do mesmo ambiente
# Descrição <Clique duas vezes aqui para editar a descrição do grupo>
flatten = List.Flatten(list=remove)
flatten_2 = List.Flatten(list=dropItems)
list_create = List.Create(item0=flatten, item1=flatten_2)
transpose = List.Transpose(lists=list_create)
python_script = Python(IN[0]=transpose)  # CPython3
# ---------- python_script.python (19 lines) ----------
# Entrada: lista no formato [[ambiente, luminaria], [ambiente, luminaria], ...]
data = IN[0]

from collections import defaultdict

def agrupar_por_ambiente(data):
    grouped = defaultdict(list)
    for item in data:
        if not isinstance(item, list) or len(item) < 2:
            continue
        ambiente = str(item[0]).strip()
        luminaria = str(item[1]).strip()
        grouped[ambiente].append(luminaria)
    
    # Converte para lista de listas ordenada pelo nome do ambiente
    return [[amb, grouped[amb]] for amb in sorted(grouped.keys())]

# Chama a função
OUT = agrupar_por_ambiente(data)
# ----------------------------------------

code_block_4 = CodeBlock { "Área de Uso Comum"; 1; "Com projeto"; }

# group: Identifica nome e área dos ambientes > Recebe Ambientes
# Descrição <Clique duas vezes aqui para editar a descrição do grupo>
categories_2 = Categories("OST_Rooms")
all_elements_of_category_2 = ElementsOfCategory(Category=categories_2)

# group: Identifica nome e área dos ambientes
# Descrição <Clique duas vezes aqui para editar a descrição do grupo>
nome = Python(IN[0]=python_script)  # CPython3
# ---------- nome.python (14 lines) ----------
# Entrada: lista no formato [["Nome: SALA OF DIA", [...]], ...]
data = IN[0]

nomes = []

for item in data:
    if not isinstance(item, list) or len(item) == 0:
        continue
    nome_raw = str(item[0])
    # Remove prefixo "Nome:" (com ou sem espaços)
    nome_limpo = nome_raw.replace("Nome:", "").strip()
    nomes.append(nome_limpo)

OUT = nomes
# ----------------------------------------
name = Room.Name(room=all_elements_of_category_2)
area = Room.Area(room=all_elements_of_category_2)
área = Python(IN[0]=python_script, IN[1]=name, IN[2]=area)  # CPython3
# ---------- área.python (20 lines) ----------
# Entradas
grouped_data = IN[0]  # [["Nome: SALA OF DIA", [...]], ...]
room_names = IN[1]    # ["SALA OF DIA", "ALOJ OF DIA", "WC OF SUP MASC", ...]
room_areas = IN[2]    # [20, 35.4, 67, ...]

# Criar dicionário {nome: área}
area_dict = {}
for name, area in zip(room_names, room_areas):
    area_dict[str(name).strip().upper()] = area

# Montar lista de áreas na mesma ordem da lista agrupada
areas = []
for item in grouped_data:
    nome_raw = str(item[0])
    # Remover "Nome:" e normalizar
    nome_limpo = nome_raw.replace("Nome:", "").strip().upper()
    area = area_dict.get(nome_limpo, None)  # retorna None se não encontrar
    areas.append(area)

OUT = areas
# ----------------------------------------

count = List.Count(list=nome)
ofRepeatedItem = List.OfRepeatedItem(item=code_block_4.out0, amount=count)
ofRepeatedItem_2 = List.OfRepeatedItem(item=code_block_4.out1, amount=count)
ofRepeatedItem_3 = List.OfRepeatedItem(item=code_block_4.out2, amount=count)

# group: Identifica a potência de cada luminária
# Descrição <Clique duas vezes aqui para editar a descrição do grupo>
elementType = Element.ElementType(element=dropItems@L2)
code_block_5 = CodeBlock(luminarias=dropItems, luminariast=elementType) { luminarias.Name; List.Flatten(luminariast.GetParameterValueByName("Potência aparente")); }
python_script_2 = Python(IN[0]=python_script, IN[1]=code_block_5.out0, IN[2]=code_block_5.out1)  # CPython3
# ---------- python_script_2.python (29 lines) ----------
# Entradas:
# IN[0] = lista agrupada [[ "Nome: SALA OF DIA", ["Luminária A", "Luminária B"] ], ...]
# IN[1] = nomes das luminárias do Revit
# IN[2] = potências aparentes correspondentes

data = IN[0]
names = IN[1]
powers = IN[2]

# Cria dicionário {nome da luminária: potência}
power_dict = {}
for n, p in zip(names, powers):
    power_dict[str(n).strip().upper()] = p

# Para cada ambiente, cria uma lista com as potências de suas luminárias
result = []
for ambiente in data:
    if len(ambiente) < 2:
        result.append([])
        continue
    luminarias = ambiente[1]
    potencias = []
    for lum in luminarias:
        key = str(lum).strip().upper()
        pot = power_dict.get(key, None)  # None se não achar
        potencias.append(pot)
    result.append(potencias)

OUT = result
# ----------------------------------------

# group: Identifica a descrição da luminária
# Descrição <Clique duas vezes aqui para editar a descrição do grupo>
elementType_2 = Element.ElementType(element=dropItems@L2)
code_block_6 = CodeBlock(luminarias=dropItems, luminariast=elementType_2) { luminarias.Name; List.Flatten(luminariast.GetParameterValueByName("Descrição")); }
python_script_3 = Python(IN[0]=python_script, IN[1]=code_block_6.out0, IN[2]=code_block_6.out1)  # CPython3; same code as python_script_2

# group: Soma as luminárias pela descrição para cada ambiente
# Descrição <Clique duas vezes aqui para editar a descrição do grupo>
python_script_4 = Python(IN[0]=python_script_2, IN[1]=python_script_3)  # CPython3
# ---------- python_script_4.python (25 lines) ----------
# -*- coding: utf-8 -*-
# Dynamo Python Node
# Entrada esperada:
# IN[0] -> Lista de listas com potências (por ambiente)
# IN[1] -> Lista de listas com descrições (por ambiente)

potencias = IN[0]
descricoes = IN[1]

resultado = []

for p_amb, d_amb in zip(potencias, descricoes):
    # Garante que o ambiente não seja None ou vazio
    if not p_amb or not d_amb:
        resultado.append([0, 0])
        continue
    
    # Soma das potências conforme a descrição
    soma_sensor = sum([p for p, d in zip(p_amb, d_amb) if d != "Sem ajuste de potência"])
    soma_sem_ajuste = sum([p for p, d in zip(p_amb, d_amb) if d == "Sem ajuste de potência"])
    
    resultado.append([soma_sensor, soma_sem_ajuste])

# Saída final
OUT = resultado
# ----------------------------------------
code_block_7 = CodeBlock { 0; 1; }
getItemAtIndex = List.GetItemAtIndex(list=python_script_4@L2, index=code_block_7.out0)
getItemAtIndex_2 = List.GetItemAtIndex(list=python_script_4@L2, index=code_block_7.out1)

# group: Organiza e exporta os dados
# Descrição <Clique duas vezes aqui para editar a descrição do grupo>
file_path = Filename("..\..\estudo de caso\INI_C-input_interface.xlsx")
code_block_8 = CodeBlock(Nome=nome, Partedaedificação=ofRepeatedItem, Áreailuminada=área, Repetição=ofRepeatedItem_2, Previsãodeprojeto=ofRepeatedItem_3, Potênciacomcontrole=getItemAtIndex, Potênciasemcontrole=getItemAtIndex_2)
# ---------- code_block_8.designscript (11 lines) ----------
a = Nome;
b = Partedaedificação;
c = Áreailuminada;
d = Repetição;
e = Previsãodeprojeto;
f = Potênciacomcontrole;
g = Potênciasemcontrole;
"Iluminação";
40;
1;
List.Transpose([a, b, c, d, e, f, g]);
# ----------------------------------------
exportToExcel = Data.ExportToExcel(filePath=file_path, sheetName=code_block_8.out7, startRow=code_block_8.out8, startColumn=code_block_8.out9, data=code_block_8.out10)
code_block_9 = CodeBlock { "Iluminação"; 31; 1; "Área de Uso Comum"; }
exportToExcel_2 = Data.ExportToExcel(filePath=file_path, sheetName=code_block_9.out0, startRow=code_block_9.out1, startColumn=code_block_9.out2, data=code_block_9.out3)

# group: CRITÉRIOS PARA ELEGEBILIDADE DA CLASSIFICAÇÃO A > Cria uma nova geometria expandida para os ambientes
# Descrição <Clique duas vezes aqui para editar a descrição do grupo>
python_script_5 = Python(IN[0]=all_elements_of_category_2, IN[1]=nome)  # CPython3
# ---------- python_script_5.python (21 lines) ----------
ambientes = IN[0]       # lista de elementos do Revit (Rooms)
ordem_nomes = IN[1]     # lista de strings com nomes na ordem desejada

# cria um dicionário: nome → elemento
mapa = {}

for elem in ambientes:
    # obtém o nome do ambiente
    try:
        nome = elem.Name
    except:
        nome = elem.LookupParameter("Name").AsString()
    
    # só adiciona ao mapa se o nome estiver na lista desejada
    if nome in ordem_nomes:
        mapa[nome] = elem

# monta a lista final na ordem desejada
ordenados = [mapa[n] for n in ordem_nomes if n in mapa]

OUT = ordenados
# ----------------------------------------
geometry = Element.Geometry(element=python_script_5)
code_block_10 = CodeBlock(ambientes=geometry) { a = List.Flatten(ambientes); b = Geometry.Explode(a); c = Autodesk.Surface.NormalAtParameter(b,0.5); Vector.Z(c); }
code_block_11 = CodeBlock { 0.9; }
ge = code_block_10.out3 >= code_block_11
filterByBoolMask = List.FilterByBoolMask(list=code_block_10.b, mask=ge)
code_block_12 = CodeBlock(topo=filterByBoolMask.in, ambientes=python_script_5)
# ---------- code_block_12.designscript (11 lines) ----------
a = Autodesk.Surface.PerimeterCurves(topo);
b = PolyCurve.ByJoinedCurves(a);
c = b.Offset(0.10);
d = Autodesk.Surface.ByPatch(c);
e = Autodesk.Surface.Thicken(d, Room.Height(ambientes));
novosambientes = List.Flatten(e);
f = Geometry.BoundingBox(novosambientes);
znovo = Point.Z(BoundingBox.MinPoint(f));
zoriginal = Point.Z(Room.Location(ambientes));
deslocamento = zoriginal - znovo;
Geometry.Translate(novosambientes,0,0,deslocamento);
# ----------------------------------------

# group: CRITÉRIOS PARA ELEGEBILIDADE DA CLASSIFICAÇÃO A > Recebe Paredes
# Descrição <Clique duas vezes aqui para editar a descrição do grupo>
categories_3 = Categories("OST_Walls")
all_elements_of_category_3 = ElementsOfCategory(Category=categories_3)

# group: CRITÉRIOS PARA ELEGEBILIDADE DA CLASSIFICAÇÃO A > Seleciona paredes externas
# Descrição <Clique duas vezes aqui para editar a descrição do grupo>
identifica_parede_relacionada_e = CodeBlock(paredes=all_elements_of_category_3) { a = paredes.ElementType; b = a.GetParameterValueByName("Função"); b == 0; }  # "Identifica parede relacionada e se é externa"
filterByBoolMask_2 = List.FilterByBoolMask(list=all_elements_of_category_3, mask=identifica_parede_relacionada_e.out2)

# group: CRITÉRIOS PARA ELEGEBILIDADE DA CLASSIFICAÇÃO A > Cria a geometria de todas as portas e janelas que estão nas paredes externas
# Descrição <Clique duas vezes aqui para editar a descrição do grupo>
getHostedElements = Element.GetHostedElements(element=filterByBoolMask_2.out@@L1)
code_block_13 = CodeBlock(elementosdasparedes=getHostedElements) { elementosdasparedes.GetCategory; "Janelas"; "Portas"; }
string_from_object_2 = FromObject(object=code_block_13.out0)
code_block_14 = CodeBlock(categorias=string_from_object_2, janelas=code_block_13.out1, portas=code_block_13.out2) { categorias == janelas; categorias == portas; }
filterByBoolMask_3 = List.FilterByBoolMask(list=getHostedElements, mask=code_block_14.out0)
filterByBoolMask_4 = List.FilterByBoolMask(list=getHostedElements, mask=code_block_14.out1)
list_create_2 = List.Create(item0=filterByBoolMask_3.in, item1=filterByBoolMask_4.in)
flatten_3 = List.Flatten(list=list_create_2)
geometry_2 = Element.Geometry(element=flatten_3)

# group: CRITÉRIOS PARA ELEGEBILIDADE DA CLASSIFICAÇÃO A > Verificação contribuição luz natural
# Descrição <Clique duas vezes aqui para editar a descrição do grupo>
doesIntersect = Geometry.DoesIntersect(geometry=code_block_12.out10, other=geometry_2, lacing=CrossProduct)
anyTrue = List.AnyTrue(list=doesIntersect@L3)
code_block_15 = CodeBlock { "Atende"; "Não se aplica"; }
if_ = RefactoredIf(test=anyTrue, true=code_block_15.out0, false=code_block_15.out1)

# group: CRITÉRIOS PARA ELEGEBILIDADE DA CLASSIFICAÇÃO A > Verificação do desligamento automático
# Descrição <Clique duas vezes aqui para editar a descrição do grupo>
code_block_16 = CodeBlock { "Não se aplica"; "Atende"; }
code_block_17 = CodeBlock { 250; }
gt = code_block_17 > área
if_2 = RefactoredIf(test=gt, true=code_block_16.out0, false=code_block_16.out1)

# group: CRITÉRIOS PARA ELEGEBILIDADE DA CLASSIFICAÇÃO A > Controle local
# Descrição <Clique duas vezes aqui para editar a descrição do grupo>
count_2 = List.Count(list=gt)
ofRepeatedItem_4 = List.OfRepeatedItem(item=code_block_16.out1, amount=count_2)

# group: CRITÉRIOS PARA ELEGEBILIDADE DA CLASSIFICAÇÃO A > Organiza e exporta dados da elegibilidade class A
# Descrição <Clique duas vezes aqui para editar a descrição do grupo>
code_block_18 = CodeBlock(luznatural=if_, controletotal=ofRepeatedItem_4, desligautomatico=if_2) { 40; 12; List.Transpose([luznatural, controletotal, desligautomatico]); }
exportToExcel_3 = Data.ExportToExcel(filePath=file_path, sheetName=code_block_8.out7, startRow=code_block_18.out0, startColumn=code_block_18.out1, data=code_block_18.out2)
