# Dynamo graph Aba Início.dyn (Dynamo 3.3.0.6316)

# group: Caminho da planilha
# Descrição <Clique duas vezes aqui para editar a descrição do grupo>
file_path = Filename("..\..\estudo de caso\INI_C-input_interface.xlsx")

# group: Área da envoltória > Recebe Telhados do projeto
# Descrição <Clique duas vezes aqui para editar a descrição do grupo>
categories = Categories("OST_Roofs")
all_elements_of_category = ElementsOfCategory(Category=categories)

# group: Área da envoltória > Identifica telhados com áreas definidas
# Descrição <Clique duas vezes aqui para editar a descrição do grupo>
code_block = CodeBlock(telhados=all_elements_of_category) { a = telhados.GetParameterValueByName("Área"); ","; }
string_from_object = FromObject(object=code_block.a)
contains = String.Contains(string=string_from_object, searchFor=code_block.out1)
filterByBoolMask = List.FilterByBoolMask(list=code_block.a, mask=contains)

# group: Área da envoltória > Recebe Paredes do projeto
# Descrição <Clique duas vezes aqui para editar a descrição do grupo>
categories_2 = Categories("OST_Walls")
all_elements_of_category_2 = ElementsOfCategory(Category=categories_2)

# group: Área da envoltória > Identifica paredes exteriores
# Descrição <Clique duas vezes aqui para editar a descrição do grupo>
code_block_2 = CodeBlock(parede=all_elements_of_category_2) { b = parede.ElementType; c = b.GetParameterValueByName("Função"); c == 1; }
filterByBoolMask_2 = List.FilterByBoolMask(list=all_elements_of_category_2, mask=code_block_2.out2)

# group: Área da envoltória > Destaca as faces das paredes externas, encontra o valor dessas faces, soma e considera a metade (face externa)
# Descrição <Clique duas vezes aqui para editar a descrição do grupo>
code_block_3 = CodeBlock(paredesext=filterByBoolMask_2.in) { a = paredesext.Faces; b = List.Flatten(a.Area); c = Math.Sum(b)/2; }

# group: Área da envoltória > Soma áreas dos telhados e das paredes
# Descrição <Clique duas vezes aqui para editar a descrição do grupo>
code_block_4 = CodeBlock(a=filterByBoolMask.in, areaparedes=code_block_3.c) { areacob = Math.Sum(a); areaparedes+areacob; }

# group: Volume da edificação > Recebe Telhados do projeto
# Descrição <Clique duas vezes aqui para editar a descrição do grupo>
categories_3 = Categories("OST_Roofs")
all_elements_of_category_3 = ElementsOfCategory(Category=categories_3)

# group: Volume da edificação > Recebe todos Níveis modelados
# Descrição <Clique duas vezes aqui para editar a descrição do grupo>
categories_4 = Categories("OST_Levels")
all_elements_of_category_4 = ElementsOfCategory(Category=categories_4)

# group: Volume da edificação > Identifica Nível 2 e Nível 3
# Descrição <Clique duas vezes aqui para editar a descrição do grupo>
string_from_object_2 = FromObject(object=all_elements_of_category_4)
code_block_5 = CodeBlock(a=string_from_object_2) { String.Contains(a, "Nível 2"); String.Contains(a, "Nível 3"); }
filterByBoolMask_3 = List.FilterByBoolMask(list=all_elements_of_category_4, mask=code_block_5.out0)
filterByBoolMask_4 = List.FilterByBoolMask(list=all_elements_of_category_4, mask=code_block_5.out1)

# group: Área Construída > Recebe todas as paredes
# Descrição <Clique duas vezes aqui para editar a descrição do grupo>
categories_5 = Categories("OST_Walls")
all_elements_of_category_5 = ElementsOfCategory(Category=categories_5)

# group: Área Construída > Seleciona paredes externas
# Descrição <Clique duas vezes aqui para editar a descrição do grupo>
identifica_parede_relacionada_e = CodeBlock(paredes=all_elements_of_category_5) { a = paredes.ElementType; b = a.GetParameterValueByName("Função"); b == 1; }  # "Identifica parede relacionada e se é externa"
filterByBoolMask_5 = List.FilterByBoolMask(list=all_elements_of_category_5, mask=identifica_parede_relacionada_e.out2)

# group: Área Construída > Seleciona paredes nível 1
# Descrição <Clique duas vezes aqui para editar a descrição do grupo>
identifica_parede_relacionada_e_2 = CodeBlock(a=filterByBoolMask_5.in) { b = a.GetParameterValueByName("Restrição da base"); }  # "Identifica parede relacionada e se é externa"
string_from_object_3 = FromObject(object=identifica_parede_relacionada_e_2)
code_block_6 = CodeBlock(a=string_from_object_3) { String.Contains(a,"Nível 1"); }
filterByBoolMask_6 = List.FilterByBoolMask(list=filterByBoolMask_5.in, mask=code_block_6)

# group: Área Construída > Seleciona localização, cria boundingbox, calcula área
# Descrição <Clique duas vezes aqui para editar a descrição do grupo>
getLocation = Element.GetLocation(element=filterByBoolMask_6.in)
code_block_7 = CodeBlock(e=getLocation)
# ---------- code_block_7.designscript (6 lines) ----------
a = BoundingBox.ByGeometry(e);
b = BoundingBox.MaxPoint(a);
c = BoundingBox.MinPoint(a);
comprimento = Point.X(b) - Point.X(c);
largura = Point.Y(b) - Point.Y(c);
aa = comprimento * largura;
# ----------------------------------------

# group: Área Construída > Seleciona paredes Nível 2
# Descrição <Clique duas vezes aqui para editar a descrição do grupo>
code_block_8 = CodeBlock(a=string_from_object_3) { String.Contains(a,"Nível 2"); }
filterByBoolMask_7 = List.FilterByBoolMask(list=filterByBoolMask_5.in, mask=code_block_8)

# group: Área Construída > Seleciona localização, cria boundingbox, calcula área
# Descrição <Clique duas vezes aqui para editar a descrição do grupo>
getLocation_2 = Element.GetLocation(element=filterByBoolMask_7.in)
code_block_9 = CodeBlock(e=getLocation_2)  # same code as code_block_7

# group: Volume da edificação > Busca valores de pé direito de cada nível, calcula volume por nível e soma total
# Descrição <Clique duas vezes aqui para editar a descrição do grupo>
code_block_10 = CodeBlock(a=filterByBoolMask_3.in, b=filterByBoolMask_4.in, areas1=code_block_7.aa, areas2=code_block_9.aa)
# ---------- code_block_10.designscript (8 lines) ----------
a1 = a.Elevation;
b1 = b.Elevation;
altura1 = a1;
altura2 = b1 - a1;
alturas = [altura1, altura2];
areasconst = [areas1, areas2];
volume = areasconst * alturas;
Math.Sum(List.Flatten(volume));
# ----------------------------------------

# group: Volume da edificação > A partir dos telhados cria linhas-> superfícies-> solidos-> identifica o volume
# Descrição <Clique duas vezes aqui para editar a descrição do grupo>
geometry = Element.Geometry(element=all_elements_of_category_3)
explode = Geometry.Explode(geometry=geometry)
perimeterCurves = Surface.PerimeterCurves(surface=explode)
byJoinedCurves = PolyCurve.ByJoinedCurves(curves=perimeterCurves)
startPoint = Curve.StartPoint(curve=byJoinedCurves)
X = Point.X(point=startPoint)
Y = Point.Y(point=startPoint)
byCoordinates = Point.ByCoordinates(x=X, y=Y, z=code_block_10.b1)
byStartPointEndPoint = Line.ByStartPointEndPoint(startPoint=startPoint, endPoint=byCoordinates)
code_block_11 = CodeBlock { true; }
bySweep = Solid.BySweep(profile=byJoinedCurves, path=byStartPointEndPoint, cutEndOff=code_block_11)
volume = Solid.Volume(solid=bySweep)

# group: Volume da edificação > Identifica telhados com volumes definidos
# Descrição <Clique duas vezes aqui para editar a descrição do grupo>
string_from_object_4 = FromObject(object=volume)
code_block_12 = CodeBlock { ","; }
contains_2 = String.Contains(string=string_from_object_4, searchFor=code_block_12)
filterByBoolMask_8 = List.FilterByBoolMask(list=volume, mask=contains_2)
code_block_13 = CodeBlock(a=filterByBoolMask_8.in) { Math.Sum(List.Flatten(a)); }

# group: Volume da edificação > Soma volumes dos telhados e das paredes
# Descrição <Clique duas vezes aqui para editar a descrição do grupo>
code_block_14 = CodeBlock(a=code_block_13, volumeparedes=code_block_10.out7) { volumecob = Math.Sum(a); volumeparedes+volumecob; }

# group: Fator de Forma
# Descrição <Clique duas vezes aqui para editar a descrição do grupo>
code_block_15 = CodeBlock(areaenvolt=code_block_4.out1, volumeenvolt=code_block_14.out1) { "Início"; 20; 2; FF = areaenvolt/volumeenvolt; false; }

# group: Exporta Fator de forma para planilha
# Descrição <Clique duas vezes aqui para editar a descrição do grupo>
exportToExcel = Data.ExportToExcel(filePath=file_path, sheetName=code_block_15.out0, startRow=code_block_15.out1, startColumn=code_block_15.out2, data=code_block_15.FF, overWrite=code_block_15.out4)

# group: Área Construída > Soma área total construída
# Descrição <Clique duas vezes aqui para editar a descrição do grupo>
code_block_16 = CodeBlock(a=code_block_7.aa, b=code_block_9.aa) { "Início"; 18; 2; a+b; false; }

# group: Área Construída > Exporta Área Construída Total para planilha
# Descrição <Clique duas vezes aqui para editar a descrição do grupo>
exportToExcel_2 = Data.ExportToExcel(filePath=file_path, sheetName=code_block_16.out0, startRow=code_block_16.out1, startColumn=code_block_16.out2, data=code_block_16.out3)

# group: Etapa e tipo de sistema
# Descrição <Clique duas vezes aqui para editar a descrição do grupo>
code_block_17 = CodeBlock { "Início"; 13; 2; "Projeto"; 16; 2; "Sistema Interligado Nacional"; }

# group: Exporta Fator de forma para planilha
# Descrição <Clique duas vezes aqui para editar a descrição do grupo>
exportToExcel_3 = Data.ExportToExcel(filePath=file_path, sheetName=code_block_17.out0, startRow=code_block_17.out1, startColumn=code_block_17.out2, data=code_block_17.out3)

# group: Exporta Fator de forma para planilha
# Descrição <Clique duas vezes aqui para editar a descrição do grupo>
exportToExcel_4 = Data.ExportToExcel(filePath=file_path, sheetName=code_block_17.out0, startRow=code_block_17.out4, startColumn=code_block_17.out5, data=code_block_17.out6)
